# Grasshopper definition AWP_Automated _Piling _Platforms.gh (Grasshopper 1.0.7)
# plug-ins: MetaHopper, Pufferfish, Human UI, Human, EF - R7 Beta, TT Toolbox

# ---- group: Import _ui / Select Crv Input _ui
panel = Panel("""Manually Drawn Platform Edge Curve
CSV Import Platform Edge Curve""")
listbox = CreateListBox(ListItems=panel, SelectedIndex=0, Height=100)
values = ValueListener(Elements=listbox, SomeProperty=True)  # -> Values, Indices
python = GhPythonScript(x=values.Values)  # -> out, a
# ---------- python: Python ----------
__author__ = "bensay"
__version__ = "2022.09.22"

import rhinoscriptsyntax as rs

a = []

if x == "Manually Drawn Platform Edge Curve":
    a.append(0)
elif x == "CSV Import Platform Edge Curve":
    a.append(1)
# ---------- end python ----------
expander = CreateExpander(UIElements=listbox, Header="Select Your Curve Input", Open=True)
E = Data(expander)
a = Data(python.a)

# ---- group: Arial Font Types _ui
# Product Owner: Benjamin Sayers
# Email: benjamin.sayers@costain.com
# Discipline Lead: Joseph Kearney
# Email: joseph.kearney@costain.com
number_slider = Slider(6, range=0..10)
# An automated design tool for working platform
# drawing production and earthworks estimation.
fonts = FontTable()
item = ListItem(List=fonts, Index=number_slider, Wrap=True)
font_type = Panel(item)

# ---- group: Import _ui / CSV Curve Input _ui / Crv CSV File Picker _ui
filepicker = CreateFilePicker(ButtonLabelText="Select SOP File (CSV)", DialogType=0, MustExist=True, Filter="All Files|*.*")
values_2 = ValueListener(Elements=filepicker, SomeProperty=True)  # -> Values, Indices
adjustpos = AdjustElementPositioning(ElementsToAdjust=filepicker, AbsolutePositioning=False, Width=365, Height=Slider(33, range=0..100))
expander_2 = CreateExpander(UIElements=flatten(filepicker), Header="Import SOP Points from a CSV File", Open=True)

# ---- group: Import _ui / CSV Curve Input _ui / SOP CSV Logic _ui
F = Data(values_2.Values)
file = ReadFile(File=F, PerLineParse=True)
python_2 = GhPythonScript(x=file)  # -> out, a
# ---------- python_2: Python ----------
__author__ = "bensay"
__version__ = "2022.09.23"

import rhinoscriptsyntax as rs

strmet = str(x) 
a = (strmet.split(','))
# ---------- end python_2 ----------
flip = FlipMatrix(Data=python_2.a)
cull_i = CullIndex(List=flip, Indices=0, Wrap=True)
flip_2 = FlipMatrix(Data=cull_i)
cull_i_2 = CullIndex(List=flip_2, Indices=0, Wrap=True)
item_2 = ListItem(List=cull_i_2, Index=0, Wrap=True)  # -> Item, Item1, Item2
pt = ConstructPoint(XCoordinate=item_2.Item, YCoordinate=item_2.Item1, ZCoordinate=item_2.Item2)
pline = PolyLine(Vertices=flatten(pt), Closed=invert(False))
pl = Data(pline)

# ---- group: Exports _ui / Bake Geometry _ui
# Export Tab
panel_2 = Panel("Bake Geometry")
button = CreateButton(ButtonName=panel_2, ButtonStyle=0)
values_3 = ValueListener(Elements=button, SomeProperty=True)  # -> Values, Indices
expander_3 = CreateExpander(UIElements=button, Header="Bake Model", Open=True)
adjustpos_2 = AdjustElementPositioning(ElementsToAdjust=button, Margin="10", AbsolutePositioning=False, Width=200, HorizontalAlignment=1)
bake_model_bool = Data(values_3.Values)
bake_model = Data(expander_3)

# ---- group: Import _ui / Import DWG Surface _ui / Surface DWG File Picker _ui
# Import Tab
panel_3 = Panel("Pick DWG/DGN File")
filepicker_2 = CreateFilePicker(ButtonLabelText=panel_3, DialogType=0, MustExist=True, Filter="AutoCAD Files|*.dwg*|DGN Files|*.dgn*")
values_4 = ValueListener(Elements=filepicker_2, SomeProperty=True)  # -> Values, Indices

# ---- group: Exports _ui / Export CSV File Path _ui
# Info Tab
panel_4 = Panel("CSV File Path")
filepicker_3 = CreateFilePicker(ButtonLabelText=panel_4, DialogType=0, MustExist=False, Filter="CSV Files|*.csv*")
values_5 = ValueListener(Elements=filepicker_3, SomeProperty=True)  # -> Values, Indices
picker = Data(filepicker_3)
value = Data(values_5.Values)

# ---- group: Bake Geometry _ui
button_2 = CreateButton(ButtonName="Print Drawing Sheets", ButtonStyle=0)
values_6 = ValueListener(Elements=button_2, SomeProperty=True)  # -> Values, Indices
expander_4 = CreateExpander(UIElements=button_2, Header="Drawings", Open=True)
adjustpos_3 = AdjustElementPositioning(ElementsToAdjust=button_2, Margin="10", AbsolutePositioning=False, Width=200, HorizontalAlignment=1)
dwg_model = Data(expander_4)
dwg_bool = Data(values_6.Values)

# ---- group: Section Cut _ui / Annotation _ui / Working Platform _ui
selobj = GetSelectedObjects(AllObjects_Object=[working_platform_depth, hatch_scale])  # -> ComponentObjects, ParamObjects, OtherObjects
slider = CreateSlider(Slider=selobj.ParamObjects, ShowBounds=False, ShowTicks=False, ShowTooltip=False, ShowValLabel=True, showLabel=True)
values_7 = ValueListener(Elements=slider, SomeProperty=True)  # -> Values, Indices
setobj = SetObjectValue(ObjectToSet=graft(selobj.ParamObjects), ValueToSet=values_7.Values)

# ---- group: Section Cut _ui
selobj_2 = GetSelectedObjects(AllObjects_Object=section_rotation)  # -> ComponentObjects, ParamObjects, OtherObjects
slider_2 = CreateSlider(Slider=selobj_2.ParamObjects, ShowBounds=False, ShowTicks=False, ShowTooltip=False, ShowValLabel=True, showLabel=True)
values_8 = ValueListener(Elements=slider_2, SomeProperty=True)  # -> Values, Indices
setobj_2 = SetObjectValue(ObjectToSet=graft(selobj_2.ParamObjects), ValueToSet=values_8.Values)

# ---- group: Section Cut _ui / SOPs _ui / Earth Hatching _ui
selobj_3 = GetSelectedObjects(AllObjects_Object=[earthworks_hatching_radius, hatch_scale_2])  # -> ComponentObjects, ParamObjects, OtherObjects
slider_3 = CreateSlider(Slider=selobj_3.ParamObjects, ShowBounds=False, ShowTicks=False, ShowTooltip=False, ShowValLabel=True, showLabel=True)
values_9 = ValueListener(Elements=slider_3, SomeProperty=True)  # -> Values, Indices
setobj_3 = SetObjectValue(ObjectToSet=graft(selobj_3.ParamObjects), ValueToSet=values_9.Values)

# ---- group: Section Cut _ui / Create Spot Level Pt _ui
# Section Tab
panel_5 = Panel("Create Section Location Points")
button_3 = CreateButton(ButtonName=panel_5, ButtonStyle=0)
values_10 = ValueListener(Elements=button_3, SomeProperty=True)  # -> Values, Indices
python_3 = GhPythonScript(x=values_10.Values)  # -> out, a
# ---------- python_3: Python ----------
__author__ = "bensay"
__version__ = "2022.09.21"

import rhinoscriptsyntax as rs

if x:
    rs.Command("_Points")
# ---------- end python_3 ----------

# ---- group: Section Cut _ui / Select Spot Level Locations _ui
pickbtn = CreateRhinoPickButton(
    ButtonName="Select Section Location Points",
    Prompt="Select Rhino Geometry",
    AllowMultiple=True,
    AllowNone=True,
    Type=4,
    ButtonStyle=0)
values_11 = ValueListener(Elements=pickbtn, SomeProperty=True)  # -> Values, Indices
pt_2 = Point(values_11.Values)

# ---- group: Section Cut _ui / SOPs _ui / Exclusion zone barrier _ui
selobj_4 = GetSelectedObjects(AllObjects_Object=[exclusion_zone_dim_height, exclusion_zone_leader_length])  # -> ComponentObjects, ParamObjects, OtherObjects
slider_4 = CreateSlider(Slider=selobj_4.ParamObjects, ShowBounds=False, ShowTicks=False, ShowTooltip=False, ShowValLabel=True, showLabel=True)
values_12 = ValueListener(Elements=slider_4, SomeProperty=True)  # -> Values, Indices
setobj_4 = SetObjectValue(ObjectToSet=graft(selobj_4.ParamObjects), ValueToSet=values_12.Values)

# ---- group: Exports _ui / Export CSV _ui
button_4 = CreateButton(ButtonName="Export", ButtonStyle=0)
values_13 = ValueListener(Elements=button_4, SomeProperty=True)  # -> Values, Indices
value_2 = Data(values_13.Values)
btn = Data(button_4)

# ---- group: Section Cut _ui / Annotation _ui
selobj_5 = GetSelectedObjects(AllObjects_Object=dim_leader_length)  # -> ComponentObjects, ParamObjects, OtherObjects
slider_5 = CreateSlider(Slider=selobj_5.ParamObjects, ShowBounds=False, ShowTicks=False, ShowTooltip=False, ShowValLabel=True, showLabel=True)
values_14 = ValueListener(Elements=slider_5, SomeProperty=True)  # -> Values, Indices
setobj_5 = SetObjectValue(ObjectToSet=graft(selobj_5.ParamObjects), ValueToSet=values_14.Values)

# ---- group: Section Cut _ui / Slope Gradient _ui
# Model Tab
panel_6 = Panel("Slope Gradient: 1 in")
textbox = CreateTextBox(Label=panel_6, UpdateButton=True, showLabel=True)
values_15 = ValueListener(Elements=textbox, SomeProperty=True)  # -> Values, Indices
settextbox = SetTextBoxContents(TextBoxToModify=textbox, NewTextBoxContents=values_15.Values)
expander_5 = CreateExpander(UIElements=textbox, Header="Slope Gradient: 1 in X", Open=True)
slope_gradient_expander = Data(expander_5)
slope_gradient_value = Data(values_15.Values)

# ---- group: Import _ui / Import DWG Surface _ui / Import Buttion _ui
button_5 = CreateButton(ButtonName="Import", ButtonStyle=0)
values_16 = ValueListener(Elements=button_5, SomeProperty=True)  # -> Values, Indices

# ---- group: Import _ui / Import DWG Surface _ui / Reset Button _ui
button_6 = CreateButton(ButtonName="Reset", ButtonStyle=0)
values_17 = ValueListener(Elements=button_6, SomeProperty=True)  # -> Values, Indices

# ---- group: Import Buttion _ui
button_7 = CreateButton(ButtonName="Draw Polyline", ButtonStyle=0)
values_18 = ValueListener(Elements=button_7, SomeProperty=True)  # -> Values, Indices
python_4 = GhPythonScript(x=values_18.Values)  # -> out, a
# ---------- python_4: Python ----------
__author__ = "bensay"
__version__ = "2022.09.22"

import rhinoscriptsyntax as rs

if x:
    rs.Command("_Polyline")
# ---------- end python_4 ----------

# ---- group: Import _ui / Select Rhino Crv _ui
pickbtn_2 = CreateRhinoPickButton(
    ButtonName="Select Manual Polyline",
    Prompt="Select Rhino Geometry",
    AllowMultiple=False,
    AllowNone=True,
    Type=2,
    ButtonStyle=0)
values_19 = ValueListener(Elements=pickbtn_2, SomeProperty=True)  # -> Values, Indices
stack = CreateStack(UIElements=[button_7, pickbtn_2], Horizontal=True)
expander_6 = CreateExpander(UIElements=flatten(stack), Header="Select A Manually Drawn Platform Edge", Open=True)
crv = Curve(values_19.Values)

# ----
# Deploy
# Automated Working Platforms
# Toggle 'True' to run program
toggle = BooleanToggle(True)

# ---- group: Info Tab _ui / Costain Branding _ui / Copyright Info _ui
label = CreateLabel(LabelText="Costain Group Ltd.", LabelSize=8, Justification=0)
horizontal_alignment = ValueList({"Left": 0, "Center": 1, "Right": 2}, selected="Center")
vertical_alignment = ValueList({"Top": 2, "Middle": 1, "Bottom": 0}, selected="Middle")
adjustpos_4 = AdjustElementPositioning(
    ElementsToAdjust=label,
    Margin=Slider(0, range=0..100),
    AbsolutePositioning=True,
    HorizontalAlignment=horizontal_alignment,
    VerticalAlignment=vertical_alignment)
costain_text = Data(label)

# ---- group: Info Tab _ui / Contact Info _ui / Discipline Lead _ui
dummy_text = Panel("joseph.kearney@costain.com")
label_2 = CreateLabel(LabelText=dummy_text, LabelSize=12, Justification=0)

# ---- group: Info Tab _ui / Contact Info _ui / Prodcut Owner _ui
dummy_text_2 = Panel("benjamin.sayers@costain.com")
label_3 = CreateLabel(LabelText=dummy_text_2, LabelSize=12, Justification=0)

# ---- group: Info Tab _ui / Contact Info _ui / Discipline Lead _ui
dummy_text_3 = Panel("Discipline Lead: Joseph Kearney")
label_4 = CreateLabel(LabelText=dummy_text_3, LabelSize=12, Justification=0)

# ----
python_5 = GhPythonScript(x=toggle)  # -> out, a
# ---------- python_5: Python ----------
__author__ = "bensay"
__version__ = "2022.09.16"

import rhinoscriptsyntax as rs

if x:
    rs.Command("Fullscreen")
else:
    rs.Command("Fullscreen")
# ---------- end python_5 ----------

# ---- group: Info Tab _ui / Contact Info _ui / Product Owner _ui
dummy_text_4 = Panel("Product Owner: Benjamin Sayers")
label_5 = CreateLabel(LabelText=dummy_text_4, LabelSize=12, Justification=0)

# ---- group: GA Plan _ui / Retaining Wall SOP Selection _ui
textbox_2 = CreateTextBox(Label="Enter SOP Number", DefaultText="1,2,3", UpdateButton=True, showLabel=True)
values_20 = ValueListener(Elements=textbox_2, SomeProperty=True)  # -> Values, Indices
python_6 = GhPythonScript(x=values_20.Values)  # -> out, a; same code as python_2
larger = LargerThan(FirstNumber=python_6.a, SecondNumber=0)  # -> LargerThan, OrEqualTo
cull = CullPattern(List=python_6.a, CullPattern=larger.LargerThan)
expander_7 = CreateExpander(UIElements=flatten(textbox_2), Header="Set Retaining Wall SOPs", Open=True)
retaining_wall_sop = Data(expander_7)
sop_cull_index = Data(python_6.a)

# ---- group: GA Plan _ui / Create Spot Level Pt _ui
button_8 = CreateButton(ButtonName="Create Spot Level Points", ButtonStyle=0)
values_21 = ValueListener(Elements=button_8, SomeProperty=True)  # -> Values, Indices
python_7 = GhPythonScript(x=values_21.Values)  # -> out, a; same code as python_3

# ---- group: Info Tab _ui / Info Text _ui / Product Description _ui
product_description = Panel("An automated design tool for working platform drawing production and earthworks estimation.")
tb = CreateTextBlock(Text=product_description, TextSize=12, Justification=1)

# ---- group: Info Tab _ui / Info Text _ui / Product Title _ui
product_title = Panel("Automated Working Platforms")
label_6 = CreateLabel(LabelText=product_title, LabelSize=24, Justification=0)

# ---- group: Import _ui / Import DWG Surface _ui / Import DWG _ui
bool = Boolean(values_16.Values)
path = FilePath(values_4.Values)
bool_2 = Boolean(values_17.Values)
c_script = CSharpScript(file=path, import=bool, reset=bool_2)  # -> out, geometries; inputs file: String, import: Boolean, reset: Boolean
# ---------- c_script: C# usings ----------
using System.Linq;
using Rhino.DocObjects;
# ---------- c_script: C# ----------
    if(import){
      RhinoDoc.ActiveDoc.Objects.UnselectAll();
      string cmd = "!_-Import " + "\"" + file + "\"" + " _Enter";
      Rhino.RhinoApp.RunScript(cmd, false);
      var selectedObjs = RhinoDoc.ActiveDoc.Objects.GetSelectedObjects(false, false).ToList();
      geos = new List<GeometryBase>();
      foreach(RhinoObject selectedObj in selectedObjs){
        var geo = selectedObj.Geometry;
        geos.Add(geo);
        //RhinoDoc.ActiveDoc.Objects.Delete(selectedObj, true);
      }
    }

    if(reset){
      geos.Clear();
    }

    geometries = geos;
# ---------- c_script: C# additional code ----------
  private List<GeometryBase> geos = new List<GeometryBase>();
# ---------- end c_script ----------
geo = Geometry(c_script.geometries)

# ---- group: Section Cut _ui / SOPs _ui
expander_8 = CreateExpander(UIElements=slider_4, Header="Exclusion Zone", Open=True)
expander_9 = CreateExpander(UIElements=slider_3, Header="Earthworks Hatch", Open=True)
earthworks_hatching = Data(expander_9)
exclusion_zone = Data(expander_8)

# ---- group: Import _ui / Import DWG Surface _ui
merge = Merge(Data1=flatten(filepicker_2), Data2=flatten(button_5), Data3=flatten(button_6))
stack_2 = CreateStack(UIElements=merge, Horizontal=True)
expander_10 = CreateExpander(UIElements=stack_2, Header="Import DWG Topo Surface", Open=True)

# ---- group: GA Plan _ui / SOPs _ui / Text Offset _ui
selobj_6 = GetSelectedObjects(AllObjects_Object=text_offset)  # -> ComponentObjects, ParamObjects, OtherObjects
slider_6 = CreateSlider(Slider=selobj_6.ParamObjects, ShowBounds=False, ShowTicks=False, ShowTooltip=False, ShowValLabel=True, showLabel=True)
values_22 = ValueListener(Elements=slider_6, SomeProperty=True)  # -> Values, Indices
setobj_6 = SetObjectValue(ObjectToSet=graft(selobj_6.ParamObjects), ValueToSet=values_22.Values)

# ---- group: GA Plan _ui / SOPs _ui / SOP Point Size _ui
selobj_7 = GetSelectedObjects(AllObjects_Object=point_size)  # -> ComponentObjects, ParamObjects, OtherObjects
slider_7 = CreateSlider(Slider=selobj_7.ParamObjects, ShowBounds=False, ShowTicks=False, ShowTooltip=False, ShowValLabel=True, showLabel=True)
values_23 = ValueListener(Elements=slider_7, SomeProperty=True)  # -> Values, Indices
setobj_7 = SetObjectValue(ObjectToSet=graft(selobj_7.ParamObjects), ValueToSet=values_23.Values)

# ---- group: GA Plan _ui / SOPs _ui / Text Height _ui
selobj_8 = GetSelectedObjects(AllObjects_Object=text_height)  # -> ComponentObjects, ParamObjects, OtherObjects
slider_8 = CreateSlider(Slider=selobj_8.ParamObjects, ShowBounds=False, ShowTicks=False, ShowTooltip=False, ShowValLabel=True, showLabel=True)
values_24 = ValueListener(Elements=slider_8, SomeProperty=True)  # -> Values, Indices
setobj_8 = SetObjectValue(ObjectToSet=graft(selobj_8.ParamObjects), ValueToSet=values_24.Values)

# ---- group: Import _ui / Import DWG Surface _ui
adjustpos_5 = AdjustElementPositioning(ElementsToAdjust=filepicker_2, AbsolutePositioning=False, Width=365, Height=Slider(33, range=0..100))
import_dwg_srf = Data(expander_10)

# ---- group: Section Cut _ui / Annotation _ui
expander_11 = CreateExpander(UIElements=slider, Header="Working Platform", Open=True)
working_platform = Data(expander_11)

# ---- group: Window Size _ui
panel_height = Slider(1, range=0..1)
panel_width = Slider(2.8, range=0..10)
# UI
getscreen = GetScreenDimensions()  # -> Width, Height
division = Division(A=getscreen.Width, B=panel_width)
division_2 = Division(A=getscreen.Height, B=panel_height)

# ---- group: Section Cut _ui / Annotation _ui
expander_12 = CreateExpander(UIElements=slider_5, Header="Annotation", Open=True)
annotation = Data(expander_12)

# ---- group: Exports _ui / Export CSV _ui
picker_2 = Data(picker)
btn_2 = Data(btn)
merge_2 = Merge(Data1=picker_2, Data2=btn_2)
stack_3 = CreateStack(UIElements=merge_2, Horizontal=True)
expander_13 = CreateExpander(UIElements=stack_3, Header="Export SOP CSV Coordinates", Open=True)
export_csv = Data(expander_13)

# ---- group: Exports _ui / Export CSV Adjustments _ui
btn_3 = Data(btn)
picker_3 = Data(picker)
number_slider_2 = Slider(37, range=0..100)
adjustpos_6 = AdjustElementPositioning(ElementsToAdjust=btn_3, AbsolutePositioning=False, Width=Slider(70, range=0..100), Height=number_slider_2)
adjustpos_7 = AdjustElementPositioning(ElementsToAdjust=picker_3, AbsolutePositioning=False, Width=Slider(400, range=0..1000), Height=number_slider_2)

# ---- group: GA Plan _ui / Edge Zone _ui / Edge Zone Dimension _ui
selobj_9 = GetSelectedObjects(AllObjects_Object=edge_zone_width)  # -> ComponentObjects, ParamObjects, OtherObjects
slider_9 = CreateSlider(Slider=selobj_9.ParamObjects, ShowBounds=False, ShowTicks=False, ShowTooltip=False, ShowValLabel=True, showLabel=True)
values_25 = ValueListener(Elements=slider_9, SomeProperty=True)  # -> Values, Indices
setobj_9 = SetObjectValue(ObjectToSet=graft(selobj_9.ParamObjects), ValueToSet=values_25.Values)

# ---- group: Section Cut _ui
merge_3 = Merge(Data1=flatten(button_3), Data2=flatten(pickbtn))
stack_4 = CreateStack(UIElements=merge_3, Horizontal=True)

merge_4 = Merge(Data1=flatten(stack_4), Data2=flatten(slider_2))
expander_14 = CreateExpander(UIElements=merge_4, Header="Set Section Curves", Open=True)
section_cuts = Data(expander_14)

# ---- group: Info Tab _ui / Info Text _ui
horizontal_alignment_2 = ValueList({"Left": 0, "Center": 1, "Right": 2}, selected="Center")
adjustpos_8 = AdjustElementPositioning(
    ElementsToAdjust=tb,
    Margin=Slider(20, range=0..100),
    AbsolutePositioning=False,
    HorizontalAlignment=horizontal_alignment_2)
adjustpos_9 = AdjustElementPositioning(
    ElementsToAdjust=label_6,
    Margin=Slider(30, range=0..100),
    AbsolutePositioning=False,
    HorizontalAlignment=horizontal_alignment_2)
adjustelem = AdjustElementAppearance(ElementsToAdjust=tb, Foreground=ColourSwatch(SwatchColor=RGB(255, 255, 255)))
adjustelem_2 = AdjustElementAppearance(ElementsToAdjust=label_6, FontSize=Slider(18, range=0..100))
product_title_2 = Data(label_6)
product_description_2 = Data(tb)

# ---- group: Info Tab _ui / Contact Info _ui
horizontal_alignment_3 = ValueList({"Left": 0, "Center": 1, "Right": 2}, selected="Center")
merge_5 = Merge(Data1=flatten(label_5), Data2=flatten(label_3))
merge_6 = Merge(Data1=flatten(label_4), Data2=flatten(label_2))
number_slider_3 = Slider(20, range=0..100)
stack_5 = CreateStack(UIElements=merge_5, Horizontal=invert(True))
stack_6 = CreateStack(UIElements=merge_6, Horizontal=invert(True))
joe_contact_info = Data(stack_6)
ben_contact_info = Data(stack_5)
adjustpos_10 = AdjustElementPositioning(ElementsToAdjust=stack_6, Margin=number_slider_3, AbsolutePositioning=False, HorizontalAlignment=horizontal_alignment_3)
adjustpos_11 = AdjustElementPositioning(ElementsToAdjust=stack_5, Margin=number_slider_3, AbsolutePositioning=False, HorizontalAlignment=horizontal_alignment_3)

# ----
python_8 = GhPythonScript(x=dwg_bool)  # -> out, a
# ---------- python_8: Python ----------
__author__ = "bensay"
__version__ = "2022.10.24"

import rhinoscriptsyntax as rs
import scriptcontext as sc

if x:
    rs.Command('_Print')
# ---------- end python_8 ----------

# ---- group: Drawing _ui / Total +/- Volumes _ui / Total Volume _ui
dummy_text_5 = Panel("Total Volume +/-:")
label_7 = CreateLabel(LabelText=dummy_text_5, LabelSize=12, Justification=0)

# ---- group: Drawing _ui / Fill Volume Text _ui / Full Volume _ui
dummy_text_6 = Panel("Fill Volume:")
label_8 = CreateLabel(LabelText=dummy_text_6, LabelSize=12, Justification=0)

# ---- group: Drawing _ui / Cut Volume Text _ui / Cut Volume _ui
dummy_text_7 = Panel("Cut Volume: ")
label_9 = CreateLabel(LabelText=dummy_text_7, LabelSize=12, Justification=0)

# ---- group: GA Plan _ui / SOPs _ui
merge_7 = Merge(Data1=flatten(slider_8), Data2=flatten(slider_7), Data3=flatten(slider_6))
expander_15 = CreateExpander(UIElements=merge_7, Header="SOPs", Open=True)
sops = Data()

# ---- group: Launch UI _ui
S = Data(toggle)
W = Data(division)
H = Data(getscreen.Height)
F_2 = Data(item)
launchwin = LaunchWindow(Show=S, Name="Automated Design", Width=W, Height=H, FontFamily=F_2, ChildStatus=1, EnableHorizScroll=False)
W_2 = Data(launchwin)

# ---- group: Drawing _ui / Calculate Earthworks Volumes _ui
toggle_2 = CreateToggle(Default=False, Label="Calculate")
values_26 = ValueListener(Elements=toggle_2, SomeProperty=True)  # -> Values, Indices
python_9 = GhPythonScript(x=values_26.Values)  # -> out, a
# ---------- python_9: Python ----------
__author__ = "bensay"
__version__ = "2022.10.24"

import rhinoscriptsyntax as rs

a = []

if x:
    a.append(1)
else:
    a.append(0)
# ---------- end python_9 ----------
adjustpos_12 = AdjustElementPositioning(
    ElementsToAdjust=toggle_2,
    Margin=Slider(5, range=0..10),
    AbsolutePositioning=False,
    Width=Slider(100, range=0..100),
    HorizontalAlignment=1,
    VerticalAlignment=1)
toggle_3 = Data(toggle_2)
bool_3 = Data(python_9.a)

# ----
slope_gradient = Data(slope_gradient_expander)

# ---- group: Section Tab _ui
working_platform_2 = Data(working_platform)
exclusion_zone_2 = Data(exclusion_zone)
section_cuts_2 = Data(section_cuts)
annotation_2 = Data(annotation)
earthworks = Data(earthworks_hatching)
merge_8 = Merge(
    Data1=section_cuts_2,
    Data2=annotation_2,
    Data3=working_platform_2,
    Data4=exclusion_zone_2,
    Data5=earthworks,
    Data6=slope_gradient)
section = Data(merge_8)

# ----
panel_7 = Panel(values.Values)

# ---- group: Panel Location _ui
window_width = Data(getscreen.Width)
panel_width_2 = Data(division)
window_height = Data(getscreen.Height)
panel_height_2 = Data(division_2)
subtraction = Subtraction(A=window_height, B=panel_height_2)
subtraction_2 = Subtraction(A=window_width, B=panel_width_2)
join = TextJoin(Text=[subtraction_2, subtraction], Join=",")
location = Data(join)

# ---- group: Block Filter Import _in
geom = Data(geo)
dpipeline = DynamicGeometryPipeline(
    LayerFilter="*",
    TypeFilter="Block",
    NameFilter="*",
    GroupByLayer=False,
    GroupByType=False,
    IncludeHidden=True,
    IncludeLocked=True,
    enableFullPath=False,
    listenToAttributes=True)
python_10 = GhPythonScript(x=geom, y=dpipeline)  # -> out, geom, block, gate
# ---------- python_10: Python ----------
__author__ = "bensay"
__version__ = "2022.10.20"

import rhinoscriptsyntax as rs

geom = []
block = []
gate = []

if rs.IsBrep(x):
    geom.append(x)
    gate.append(0)
elif rs.IsMesh(x):
    geom.append(x)
    gate.append(0)
else:
    block.append(y)
    gate.append(1)
# ---------- end python_10 ----------
blockexplode = ExplodeBlocks(BlockObjects=python_10.block, explodeGeom=True)  # -> Geometry, Attributes, BlockName, BoundingBox, BlockTransform, InsertionPlane, InstanceCount
mesh = Mesh(blockexplode.Geometry)
mjoin = MeshJoin(Meshes=mesh)
srf = Data(mjoin)
gate = Data(python_10.gate)

# ---- group: Window Styling _ui
accent_colors = ValueList({"Amber", "Blue", "Brown", "Cobalt", "Crimson", "Cyan", "Emerald", "Green", "Indigo", "Lime", "Magenta", "Mauve", "Olive", "Orange", "Pink", "Purple", "Red", "Sienna", "Steel", "Taupe", "Teal", "Violet", "Yellow"}, selected="Blue")
swatch = White(SwatchColor=RGB(255, 255, 255))
launch_window = Data(W_2)
location_2 = Data(location)
winprops = SetWindowProperties(
    Window=launch_window,
    StartingLocation=location_2,
    Theme=Toggle(False),
    AccentColor=accent_colors,
    ShowTitleBar=Toggle(True),
    BackgroundColor=swatch,
    ScaleFactor=1)

# ----
panel_8 = Panel(python_10.gate)
c_script_2 = CSharpScript(reset=bool_2)  # -> out, geometries; inputs mesh: Boolean, reset: Boolean; disabled
# ---------- c_script_2: C# ----------
    if(mesh){
      var selectedObjs = RhinoDoc.ActiveDoc.Objects.GetSelectedObjects(false, false).ToList();
      geos = new List<GeometryBase>();
      foreach(RhinoObject selectedObj in selectedObjs){
        var geo = selectedObj.Geometry;
        geos.Add(geo);
        //RhinoDoc.ActiveDoc.Objects.Delete(selectedObj, true);
      }
    }

    if(reset){
      geos.Clear();
    }

    geometries = geos;
# ---------- c_script_2: C# additional code ----------
  private List<GeometryBase> geos = new List<GeometryBase>();
# ---------- end c_script_2 ----------

# ---- group: Crv selection _in
selection_gate = Data(a)
manual = Data(crv)
csv = Data(pl)
filter = StreamFilter(Gate=selection_gate, Stream0=manual, Stream1=csv)
crv_2 = Data(filter)

# ---- group: Topo Filter _in
selection_gate_2 = Data(gate)
normal_import = Data(geo)
block_import = Data(srf)
filter_2 = StreamFilter(Gate=selection_gate_2, Stream0=normal_import, Stream1=block_import)
srf_2 = Data(filter_2)

# ----
mesh_2 = Mesh(c_script_2.geometries)  # disabled
panel_9 = Panel(c_script_2.geometries)  # disabled

# ---- group: Bake Options _in
panel_10 = Panel("Plan")
panel_11 = Panel("SectionLeader")
panel_12 = Panel("Section")
bake_model_bool_2 = Data(bake_model_bool)

# ----
panel_13 = Panel("Contours")

# ---- group: Contour Spacings (m) _in
major_contour_spacing_m = Slider(10, range=0..10)
minor_contour = Slider(1, range=0..10)

# ---- group: No Go Zone Parameters _in
edge_zone_width = Slider(2, range=0..10)

# ---- group: Topsoil Scrape Parameters _in
topsoil_scrape_gradient = Slider(3, range=0..10)
topsoil_scrape_depth = Slider(0.2, range=0..1)

# ---- group: SOP Parameters _in
text_offset = Slider(0.7, range=0..1)
point_size = Slider(0.5, range=0..1)
text_height = Slider(0.4, range=0..1)

# ---- group: Spot Level _in
spot_level_text_offset = Slider(0.7, range=0..1)

# ---- group: Topo Srf _in
topo_srf = Geometry(srf_2)

# ---- group: Zoom to BBOX _in
python_11 = GhPythonScript(x=topo_srf)  # -> out, a
# ---------- python_11: Python ----------
__author__ = "bensay"
__version__ = "2022.10.21"

import rhinoscriptsyntax as rs

if x:
    bbox = rs.BoundingBox(x)
    rs.ZoomBoundingBox(bbox)
    rs.ClearCommandHistory()
    rs.Command('_SelNone')

if y:
    rs.Command('_SelBlockInstance')
    rs.Command('Hide')
# ---------- end python_11 ----------

# ---- group: Platform Edge _in
manual_select_curve = Curve(crv_2)

# ---- group: GA Plan _ui / Exclusion Zone _ui / Exclusion Zone Removal _ui
crv_3 = Curve(manual_select_curve)
explode = Explode(Curve=crv_3, Recursive=True)  # -> Segments, Vertices
lng = ListLength(List=explode.Segments)
series = Series(Start=0, Step=1, Count=lng)
shift = ShiftList(List=series, Shift=1, Wrap=True)
concat = Concatenate(FragmentA="Between SOP ", FragmentB=series, FragmentC=" & ", FragmentD=shift)
split = SplitList(List=concat, Index=expr("x/2", lng))  # -> ListA, ListB
checklist = CreateChecklist(ChecklistItems=split.ListB, Selected=False)
checklist_2 = CreateChecklist(ChecklistItems=split.ListA, Selected=False)
merge_9 = Merge(Data1=flatten(checklist_2), Data2=flatten(checklist))
stack_7 = CreateStack(UIElements=merge_9, Horizontal=True)
expander_16 = CreateExpander(UIElements=stack_7, Header="Remove Edge Zone Sections", Open=True)
adjustpos_13 = AdjustElementPositioning(
    ElementsToAdjust=[checklist_2, checklist],
    Margin=Slider(4, range=0..10),
    AbsolutePositioning=False,
    HorizontalAlignment=1,
    VerticalAlignment=1)

# ---- group: GA Plan _ui / Edge Zone _ui
merge_10 = Merge(Data1=flatten(slider_9), Data2=flatten(stack_7))
expander_17 = CreateExpander(UIElements=flatten(merge_10), Header="Edge Zone", Open=True)
edge_zones = Data(expander_17)

# ----
edge_zone_culling = Data(expander_16)

# ---- group: GA Plan _ui / Exclusion Zone _ui / Exclusion Zone Bool _ui
values_27 = ValueListener(Elements=checklist_2, SomeProperty=True)  # -> Values, Indices
values_28 = ValueListener(Elements=checklist, SomeProperty=True)  # -> Values, Indices
merge_11 = Merge(Data1=values_27.Values, Data2=values_28.Values)

# ----
dim_text_height = Slider(0.3, range=0..1)

# ---- group: SECTION: Define section cut _in
section_location = Point(pt_2)
section_rotation = Slider(0, range=0..180)
section_bbox_offset = Slider(10, range=0..10)

# ---- group: SECTION: Annotation _in
ground_level_dash_dist = Slider(0.5, range=0..1)
dim_leader_length = Slider(2.7, range=0..10)

# ---- group: SECTION: Platform _in
working_platform_depth = Slider(1.5, range=0..10)
hatch_scale = Slider(0.097, range=0..1)

# ---- group: SECTION: Exclusion zone _in
exclusion_zone_width = Slider(4, range=0..10)

# ---- group: SECTION: Exclusion zone barrier _in
exclusion_zone_dim_height = Slider(0.7, range=0..10)
exclusion_zone_leader_length = Slider(4, range=0..10)
exclusion_zone_barrier_height = Slider(1, range=0..10)
dash_distances = Slider(0.2, range=0..1)
dash_line_thickness = Slider(3, range=0..10)

# ---- group: SECTION: Earth hatching _in
earthworks_hatching_radius = Slider(4, range=0..10)
hatch_scale_2 = Slider(1, range=0..1)

# ---- group: Geometry Filter _visual
crv_4 = Boolean(topo_srf)
topo = Boolean(manual_select_curve)
python_12 = GhPythonScript(x=topo, y=crv_4)  # -> out, a
# ---------- python_12: Python ----------
__author__ = "bensay"
__version__ = "2022.09.21"

import rhinoscriptsyntax as rs

a = []

if x and y:
    a.append(0)
else:
    a.append(1)
# ---------- end python_12 ----------
a_2 = Data(python_12.a)

# ----
terrain_mesh = Data(topo_srf)
bool_gate = Data(bool_3)
filter_3 = StreamFilter(Gate=bool_gate, Stream1=terrain_mesh)
s_0 = Data(filter_3)

fpatch = FragmentPatch(Boundary=manual_select_curve)

# ---- group: Exclusion Zone _analysis
# Exclusion Zone
platform_edge_crv = Data(manual_select_curve)
exclusion_zone_width_2 = Data(edge_zone_width)
edge_cull_pattern = Data(merge_11)
project = Project(Geometry=platform_edge_crv, Plane=PlaneXY(0, 0, 0))  # -> Geometry, Transform
explode_2 = Explode(Curve=project.Geometry, Recursive=True)  # -> Segments, Vertices
cull_2 = CullPattern(List=explode_2.Segments, CullPattern=invert(edge_cull_pattern))
join_2 = JoinCurves(Curves=cull_2, Preserve=False)
offcrv = OffsetCurve(
    Curve=join_2,
    Plane=PlaneXY(0, 0, 0),
    Distance=exclusion_zone_width_2,
    BothSides=expr("-x", exclusion_zone_width_2),
    Kinks=0,
    CapType=0)
midpt = CurveMiddle(Curve=offcrv)
incurve = PointInCurve(Point=midpt, Curve=project.Geometry)  # -> Relationship, Point
larger_2 = LargerThan(FirstNumber=incurve.Relationship, SecondNumber=0)  # -> LargerThan, OrEqualTo
cull_3 = CullPattern(List=offcrv, CullPattern=larger_2.LargerThan)
merge_12 = Merge(Data1=graft(join_2), Data2=cull_3)
lng_2 = ListLength(List=flatten(cull_3))
cls = Closed(Curve=cull_3)  # -> Closed, Periodic
end = EndPoints(Curve=join_2)  # -> Start, End
end_2 = EndPoints(Curve=cull_3)  # -> Start, End
larger_3 = LargerThan(FirstNumber=lng_2, SecondNumber=1)  # -> LargerThan, OrEqualTo
python_13 = GhPythonScript(x=lng_2, y=cls.Closed)  # -> out, a
# ---------- python_13: Python ----------
__author__ = "bensay"
__version__ = "2022.10.26"

import rhinoscriptsyntax as rs

a = []

if x > 1:
    a.append(1)
elif x == 1 and y == True:
    a.append(2)
elif x == 1 and y == False:
    a.append(0)
# ---------- end python_13 ----------
ln = Line(StartPoint=end.Start, EndPoint=end_2.Start)
ln_2 = Line(StartPoint=end.End, EndPoint=end_2.End)
num = Number(larger_3.LargerThan)
item_3 = ListItem(List=flatten(python_13.a), Index=0, Wrap=True)
join_3 = JoinCurves(Curves=flatten([ln, ln_2, cull_3, join_2]), Preserve=False)
filter_4 = StreamFilter(Gate=num, Stream1=merge_12)
loft = Loft(Curves=filter_4, Options={Adjust=False, Closed=False, LoftEnds=0, LoftSimp=0, LoftType=0, Rebuild=10, Refit=0.01})
filter_5 = StreamFilter(Gate=item_3, Stream0=join_3, Stream1=loft, Stream2=[cull_3, join_2])
crv_5 = Curve(filter_5)

# ---- group: Offset Vector _analysis
platform_edge_crv_2 = Data(manual_select_curve)
project_2 = Project(Geometry=platform_edge_crv_2, Plane=PlaneXY(0, 0, 0))  # -> Geometry, Transform
offset_l = OffsetCurveLoose(Curve=project_2.Geometry, Distance=1)
cp = ControlPoints(Curve=project_2.Geometry)  # -> Points, Weights, Knots
cp_2 = ControlPoints(Curve=platform_edge_crv_2)  # -> Points, Weights, Knots
cp_3 = ControlPoints(Curve=offset_l)  # -> Points, Weights, Knots
cullduppoints = RemoveDuplicatePoints(InputPoints=cp.Points, Tolerance=0.001)  # -> OutputPoints, FirstPointIndexes
cullduppoints_2 = RemoveDuplicatePoints(InputPoints=cp_3.Points, Tolerance=0.001)  # -> OutputPoints, FirstPointIndexes
cullduppoints_3 = RemoveDuplicatePoints(InputPoints=cp_2.Points, Tolerance=0.001)  # -> OutputPoints, FirstPointIndexes
clean = CleanTree(RemoveNulls=True, RemoveInvalid=True, RemoveEmpty=True, Tree=cullduppoints.OutputPoints)
clean_2 = CleanTree(RemoveNulls=True, RemoveInvalid=True, RemoveEmpty=True, Tree=cullduppoints_2.OutputPoints)
clean_3 = CleanTree(RemoveNulls=True, RemoveInvalid=True, RemoveEmpty=True, Tree=cullduppoints_3.OutputPoints)
ln_3 = Line(StartPoint=clean, EndPoint=clean_2)
move2pt = MoveToPoint(Geometry=ln_3, PointA=clean, PointB=clean_3)  # -> Moved, Vector, Transform
end_3 = EndPoints(Curve=move2pt.Moved)  # -> Start, End
vec2pt = Vector2Pt(PointA=end_3.Start, PointB=end_3.End, Unitize=False)  # -> Vector, Length
vdis = VectorDisplay(Anchor=end_3.Start, Vector=vec2pt.Vector)
offste_vector = Data(vec2pt.Vector)

# ---- group: Is SOP > 10m+ from surface? _analysiss
# Warning Messages
platform_edge_crv_3 = Data(manual_select_curve)
# Cut / Fill Extents
topo_srf_2 = Data(topo_srf)
explode_3 = Explode(Curve=platform_edge_crv_3, Recursive=True)  # -> Segments, Vertices
Z = UnitZ(Factor=1)
project_3 = ProjectPoint(Point=explode_3.Vertices, Direction=expr("-x", Z), Geometry=topo_srf_2)  # -> Point, Index
project_4 = ProjectPoint(Point=explode_3.Vertices, Direction=Z, Geometry=topo_srf_2)  # -> Point, Index
dist = Distance(PointA=explode_3.Vertices, PointB=project_4.Point)
dist_2 = Distance(PointA=explode_3.Vertices, PointB=project_3.Point)
entwine = Entwine(Branch00=dist, Branch01=dist_2, FlattenInputs=True)
max_height_error_message = Slider(10, range=0..10)
sort = SortList(Keys=flatten(entwine))  # -> reverse(Keys), ValuesA
item_4 = ListItem(List=sort.Keys, Index=0, Wrap=True)
larger_4 = LargerThan(FirstNumber=item_4, SecondNumber=max_height_error_message)  # -> flatten(LargerThan), OrEqualTo
clean_4 = CleanTree(RemoveNulls=True, RemoveInvalid=True, RemoveEmpty=invert(False), Tree=larger_4.LargerThan)
python_14 = GhPythonScript(x=clean_4)  # -> out, a
# ---------- python_14: Python ----------
__author__ = "bensay"
__version__ = "2021.05.06"

import rhinoscriptsyntax as rs

if x == True:
    a = "There is at least one SOP that exceeds +10m Elevation from the topo surface."
else:
    a = ""
# ---------- end python_14 ----------
panel_14 = Panel(python_14.a)
sop_height_error_warning = Data(panel_14)

# ---- group: SOP Plane _analysis
platform_edge_crv_4 = Data(manual_select_curve)
# SOPs
xy = XYPlane(Origin=Point(0, 0, 0))
disc = Discontinuity(Curve=platform_edge_crv_4, Level=1)  # -> Points, Parameters
pl_origin = PlaneOrigin(Base=xy, Origin=disc.Points)
sop_plane_origin = Data(pl_origin)
platform_edge_pts = Data(disc.Points)
xy_plane = Data(xy)

# ---- group: Create Section Plane _section
Z_2 = UnitZ(Factor=1)
section_angle = Data(section_rotation)
vec = VectorXYZ(XComponent=0, YComponent=0, ZComponent=-1)  # -> Vector, Length
# Section
mesh_srf = Data(topo_srf)
section_pt = Data(section_location)
meshray = MeshRay(Mesh=mesh_srf, Point=section_pt, Direction=graft([Z_2, vec.Vector]))  # -> flatten(Point), Hit
clean_5 = CleanTree(RemoveNulls=True, RemoveInvalid=True, RemoveEmpty=invert(False), Tree=meshray.Point)
xy_2 = XYPlane(Origin=Point(0, 0, 0))
item_5 = ListItem(List=clean_5, Index=0, Wrap=True)
xz = XZPlane(Origin=item_5)
pl_origin_2 = PlaneOrigin(Base=xy_2, Origin=section_pt)
rad = Radians(Degrees=section_angle)
rotate = Rotate(Geometry=xz, Angle=rad, Plane=pl_origin_2)  # -> Geometry, Transform
section_plane = Data(rotate.Geometry)

# ---- group: SOP Coords _analysis
platform_edge_pts_2 = Data(sop_plane_origin)
deplane = DeconstructPlane(Plane=platform_edge_pts_2)  # -> Origin, XAxis, YAxis, ZAxis
pdecon = Deconstruct(Point=deplane.Origin)  # -> XComponent, YComponent, ZComponent
X = Data(pdecon.XComponent)
Y = Data(pdecon.YComponent)
Z_3 = Data(pdecon.ZComponent)

# ---- group: Intersect Section crv _section
platform_edge_crv_5 = Data(manual_select_curve)
section_plane_2 = Data(section_plane)
mesh_srf_2 = Data(topo_srf)
fpatch_2 = FragmentPatch(Boundary=platform_edge_crv_5)
sec = MeshPlane(Mesh=mesh_srf_2, Plane=section_plane_2)
sec_2 = BrepPlane(Brep=fpatch_2, Plane=section_plane_2)  # -> Curves, Points
join_4 = JoinCurves(Curves=flatten(sec), Preserve=False)
mesh_srf_section_crv = Data(join_4)
platform_section_crv = Data(sec_2.Curves)

# ---- group: Sort and Join Crvs _section
manual_srf_section_crv = Data(mesh_srf_section_crv)
section_plane_3 = Data(section_plane_2)
bbox = BoundingBox(Content=flatten(manual_srf_section_crv), Plane=section_plane_3, UnionBox=True)  # -> Box, Box_2
rec = Rectangle(bbox.Box)
disc_2 = Discontinuity(Curve=rec, Level=1)  # -> Points, Parameters
end_4 = EndPoints(Curve=manual_srf_section_crv)  # -> Start, End
item_6 = ListItem(List=disc_2.Points, Index=3, Wrap=True)
lng_3 = ListLength(List=manual_srf_section_crv)
dist_3 = Distance(PointA=item_6, PointB=end_4.Start)
larger_5 = LargerThan(FirstNumber=lng_3, SecondNumber="1")  # -> LargerThan, OrEqualTo
sort_2 = SortList(Keys=dist_3, ValuesA=manual_srf_section_crv)  # -> Keys, ValuesA
explode_4 = Explode(Curve=graft(sort_2.ValuesA), Recursive=True)  # -> Segments, Vertices
num_2 = Number(larger_5.LargerThan)
pline_2 = PolyLine(Vertices=flatten(explode_4.Vertices), Closed=False)
filter_6 = StreamFilter(Gate=num_2, Stream0=manual_srf_section_crv, Stream1=pline_2)
mesh_crv = Data(filter_6)

# ---- group: Create SOP Tag _analysis
text_offset_2 = Data(text_offset)
sop_planes = Data(sop_plane_origin)
platform_edge_pts_3 = Data(platform_edge_pts)
X_2 = UnitX(Factor=text_offset_2)
move = Move(Geometry=sop_planes, Motion=X_2)  # -> Geometry, Transform
Y_2 = UnitY(Factor=text_offset_2)
lng_4 = ListLength(List=platform_edge_pts_3)
move_2 = Move(Geometry=move.Geometry, Motion=Y_2)  # -> Geometry, Transform
series_2 = Series(Start=0, Step=1, Count=lng_4)
lng_5 = ListLength(List=series_2)
repeat = RepeatData(Data="SOP ", Length=lng_5)
data = Data(flatten(repeat))
pdecon_2 = Deconstruct(Point=move_2.Geometry)  # -> XComponent, YComponent, ZComponent
data_2 = Data(flatten(series_2))
merge_13 = Merge(Data1=graft(data), Data2=graft(data_2))
pt_3 = ConstructPoint(XCoordinate=pdecon_2.XComponent, YCoordinate=pdecon_2.YComponent, ZCoordinate=0)  # -> graft(Point)
join_5 = TextJoin(Text=merge_13)

# ---- group: SOP Coords
sop = Panel(series_2)
panel_15 = Panel("Schedule Title")
panel_16 = Panel("SOP ")
easting_m = Panel(X)
panel_17 = Panel("Easting (m)")
northing_m = Panel(Y)
panel_18 = Panel("Northing (m)")
elevatoin_m = Panel(Z_3)
panel_19 = Panel("Elevation (m)")

# ----
roundd = RoundToDecimalPlace(NumberX=sop, DecimalPlace=2, RoundType=0)  # -> Rounded, Difference

# ---- group: Is Polygon Closed? _analysis
platform_edge_crv_6 = Data(manual_select_curve)
cls_2 = Closed(Curve=platform_edge_crv_6)  # -> Closed, Periodic
python_15 = GhPythonScript(curveClosed=cls_2.Closed)  # -> out, message, bool
# ---------- python_15: Python ----------
__author__ = "bensay"
__version__ = "2021.05.04"

import rhinoscriptsyntax as rs

if curveClosed == True:
    message = "This calculation will be successful!"
    bool = True
elif curveClosed == False:
    message = "The polyline input for the platform edge is not closed. Please provide a closed polyine."
    bool = False
else:
    message = ""
    bool = ""
# ---------- end python_15 ----------
panel_20 = Panel(cls_2.Closed)
panel_21 = Panel(python_15.message)
bool_4 = Boolean(invert(python_15.bool))
panel_22 = Panel(bool_4)
polygon_closed_warning = Data(panel_21)

# ---- group: Create SOP Geom _analysis
sop_plane_origin_2 = Data(sop_plane_origin)
pt_size = Data(point_size)
X_3 = UnitX(Factor=expr("x*1.5", pt_size))
Y_3 = UnitY(Factor=expr("x*1.5", pt_size))
pt_4 = Point(sop_plane_origin_2)
move_3 = Move(Geometry=pt_4, Motion=expr("-x", X_3))  # -> Geometry, Transform
move_4 = Move(Geometry=pt_4, Motion=expr("-x", Y_3))  # -> Geometry, Transform
move_5 = Move(Geometry=pt_4, Motion=X_3)  # -> Geometry, Transform
move_6 = Move(Geometry=pt_4, Motion=Y_3)  # -> Geometry, Transform
cir = Circle(Plane=sop_plane_origin_2, Radius=pt_size)
ln_4 = Line(StartPoint=move_5.Geometry, EndPoint=move_3.Geometry)
ln_5 = Line(StartPoint=move_6.Geometry, EndPoint=move_4.Geometry)
merge_14 = Merge(Data1=cir, Data2=ln_4, Data3=ln_5)
crv_6 = Curve(merge_14)

# ----
roundd_2 = RoundToDecimalPlace(NumberX=easting_m, DecimalPlace=2, RoundType=0)  # -> Rounded, Difference

# ---- group: Project End Pts to Mesh _section
platform_section_crv_2 = Data(platform_section_crv)
mesh_srf_3 = Data(topo_srf)
end_5 = EndPoints(Curve=platform_section_crv_2)  # -> Start, End
merge_15 = Merge(Data1=end_5.Start, Data2=end_5.End)  # -> graft(Result)
vec_2 = VectorXYZ(XComponent=0, YComponent=0, ZComponent=-1)  # -> Vector, Length
Z_4 = UnitZ(Factor=1)
meshray_2 = MeshRay(Mesh=mesh_srf_3, Point=merge_15, Direction=[Z_4, vec_2.Vector])  # -> Point, Hit
clean_6 = CleanTree(RemoveNulls=True, RemoveInvalid=True, RemoveEmpty=invert(False), Tree=meshray_2.Point)
end_pts_projected_to_mesh_srf = Data(clean_6)
platform_section_crv_end_pts = Data(merge_15)

# ---- group: Create Slope Vector _section
platform_section_crv_3 = Data(platform_section_crv)
platform_end_pts = Data(platform_section_crv_end_pts)
slope_gradient_2 = Data(slope_gradient_value)
section_plane_4 = Data(section_plane)
mesh_end_pts = Data(end_pts_projected_to_mesh_srf)
lng_6 = ListLength(List=platform_section_crv_3)  # -> flatten(Length)
ma = MassAddition(Input=lng_6)  # -> Result, PartialResults
dist_4 = Distance(PointA=platform_end_pts, PointB=mesh_end_pts)
panel_23 = Panel("""1
-1""")
pln = Plane(section_plane_4)
repeat_2 = RepeatData(Data=graft(panel_23), Length=ma.Result)
multiplication = Multiplication(A=dist_4, B=slope_gradient_2)
deplane_2 = DeconstructPlane(Plane=pln)  # -> Origin, XAxis, YAxis, ZAxis
multiplication_2 = Multiplication(A=multiplication, B=graft(repeat_2))
amp = Amplitude(Vector=deplane_2.XAxis, Amplitude=multiplication_2)
gradient_slop_vector = Data(amp)

# ----
roundd_3 = RoundToDecimalPlace(NumberX=northing_m, DecimalPlace=2, RoundType=0)  # -> Rounded, Difference

# ---- group: Project SOPs in Z Direction _analysis
topo_mesh_srf = Data(topo_srf)
sops_2 = Data(clean_3)
Z_5 = UnitZ(Factor=1)
project_5 = ProjectPoint(Point=sops_2, Direction=expr("-x", Z_5), Geometry=topo_mesh_srf)  # -> Point, Index
project_6 = ProjectPoint(Point=sops_2, Direction=Z_5, Geometry=topo_mesh_srf)  # -> Point, Index
merge_16 = Merge(Data1=graft(project_6.Point), Data2=graft(project_5.Point))
clean_7 = CleanTree(RemoveNulls=True, RemoveInvalid=True, RemoveEmpty=invert(False), Tree=merge_16)  # -> flatten(Tree)
dist_5 = Distance(PointA=sops_2, PointB=clean_7)
sort_3 = SortList(Keys=dist_5)  # -> reverse(Keys), ValuesA
item_7 = ListItem(List=flatten(sort_3.Keys), Index=0, Wrap=True)
Z_6 = UnitZ(Factor=expr("-x", item_7))
Z_7 = UnitZ(Factor=item_7)
move_7 = Move(Geometry=sops_2, Motion=expr("x*2", Z_6))  # -> Geometry, Transform
move_8 = Move(Geometry=sops_2, Motion=expr("x*2", Z_7))  # -> Geometry, Transform
max_sop_height = Data(item_7)
projected_sops = Data(move_8.Geometry)
projected_sops_2 = Data(move_7.Geometry)

# ----
roundd_4 = RoundToDecimalPlace(NumberX=elevatoin_m, DecimalPlace=2, RoundType=0)  # -> Rounded, Difference

# ---- group: Headings _in
northing = Data(panel_18)
elevation = Data(panel_19)
sop_2 = Data(panel_16)
easting = Data(panel_17)

# ---- group: Coords _in
northing_2 = Data(roundd_3.Rounded)
elevation_2 = Data(roundd_4.Rounded)
easting_2 = Data(roundd_2.Rounded)
sop_3 = Data(roundd.Rounded)

# ---- group: Create CSV _analysis
merge_17 = Merge(Data1=sop_2, Data2=sop_3)  # -> flatten(Result)
merge_18 = Merge(Data1=easting, Data2=easting_2)  # -> flatten(Result)
merge_19 = Merge(Data1=northing, Data2=northing_2)  # -> flatten(Result)
merge_20 = Merge(Data1=elevation, Data2=elevation_2)  # -> flatten(Result)
merge_21 = Merge(Data1=graft(merge_17), Data2=graft(merge_18), Data3=graft(merge_19), Data4=graft(merge_20))
join_6 = TextJoin(Text=merge_21, Join=",")
flatten = FlattenTree(Tree=join_6, Path="{0}")

# ---- group: Import _ui / SOP Table _ui
sop_data = Data(merge_21)
flip_3 = FlipMatrix(Data=sop_data)
item_8 = ListItem(List=flip_3, Index=0, Wrap=True)
cull_i_3 = CullIndex(List=flip_3, Indices=0, Wrap=True)
datatable = CreateDataTable(Data=simplify(cull_i_3), ColumnHeadings=flatten(item_8), AllowSorting=False, ColumnSizingMode=-1)
setdatatable = SetDataTable(DataTableToSet=datatable, Data=cull_i_3, ColumnHeadings=flatten(item_8))
expander_18 = CreateExpander(UIElements=datatable, Header="SOPs", Open=True)
sop_expander = Data(expander_18)

# ----
warning_messages = Data(sop_expander)

# ---- group: Create Slope Crvs _section
platform_end_pts_2 = Data(platform_section_crv_end_pts)
mesh_end_pts_2 = Data(end_pts_projected_to_mesh_srf)
mesh_section_crv = Data(mesh_crv)
gradient_vect = Data(gradient_slop_vector)
move_9 = Move(Geometry=mesh_end_pts_2, Motion=gradient_vect)  # -> Geometry, Transform
vec2pt_2 = Vector2Pt(PointA=platform_end_pts_2, PointB=move_9.Geometry, Unitize=False)  # -> Vector, Length
project_7 = ProjectPoint(Point=platform_end_pts_2, Direction=vec2pt_2.Vector, Geometry=mesh_section_crv)  # -> Point, Index
ln_6 = Line(StartPoint=platform_end_pts_2, EndPoint=project_7.Point)
platform_end_pts_3 = Data(project_7.Point)
slope_crvs = Data(ln_6)

# ---- group: Section Box _section
section_plane_5 = Data(section_plane)
slope_crv = Data(slope_crvs)
bbox_2 = BoundingBox(Content=flatten(slope_crv), Plane=section_plane_5, UnionBox=True)  # -> Box, Box_2
section_bbox = Rectangle(bbox_2.Box)

# ---- group: SOP Drawing Text _analysis
L = Data(merge_21)
number_slider_4 = Slider(3, range=0..10)
number_slider_5 = Slider(10, range=0..20)
lng_7 = ListLength(List=L)
tstat = TreeStatistics(Tree=lng_7)  # -> Paths, Length, Count
series_3 = Series(Start=0, Step=number_slider_4, Count=tstat.Count)
Y_4 = UnitY(Factor=expr("-x", series_3))
xy_3 = XYPlane(Origin=Point(0, 0, 0))
move_10 = Move(Geometry=xy_3, Motion=Y_4)  # -> Geometry, Transform
series_4 = Series(Start=0, Step=number_slider_5, Count=expr("x+1", lng_7))
X_4 = UnitX(Factor=series_4)
X_5 = UnitX(Factor=expr("x/2", number_slider_5))
move_11 = Move(Geometry=graft(move_10.Geometry), Motion=X_4)  # -> Geometry, Transform
cull_i_4 = CullIndex(List=move_11.Geometry, Indices=-1, Wrap=True)
move_12 = Move(Geometry=cull_i_4, Motion=X_5)  # -> Geometry, Transform

# ---- group: SOP Offset Vectors _analysis
slope_gradient_3 = Data(slope_gradient_value)
offset_vector = Data(offste_vector)
pt_height = Data(max_sop_height)
multiplication_3 = Multiplication(A=pt_height, B=slope_gradient_3)
amp_2 = Amplitude(Vector=offset_vector, Amplitude=multiplication_3)
offset_vectors = Data(amp_2)

# ---- group: Move Points w/ Appropritate Vector
projected_sops_3 = Data(projected_sops)
offset_vectors_2 = Data(offset_vectors)
move_13 = Move(Geometry=projected_sops_3, Motion=offset_vectors_2)  # -> Geometry, Transform
translated_sops = Data(move_13.Geometry)

projected_sops_4 = Data(projected_sops_2)
offset_vectors_3 = Data(offset_vectors)
move_14 = Move(Geometry=projected_sops_4, Motion=offset_vectors_3)  # -> Geometry, Transform
translated_sops_2 = Data(move_14.Geometry)

# ----
number_slider_6 = Slider(61, range=0..300)

item_9 = ListItem(List=move_11.Geometry, Index=0, Wrap=True)  # -> Item1, Item
Y_5 = UnitY(Factor=expr("-x/2", number_slider_4))
ln_7 = Line(StartPoint=item_9.Item1, EndPoint=item_9.Item)
move_15 = Move(Geometry=ln_7, Motion=Y_5)  # -> Geometry, Transform

flip_4 = FlipMatrix(Data=move_11.Geometry)
item_10 = ListItem(List=flip_4, Index=0, Wrap=True)  # -> Item1, Item
Y_6 = UnitY(Factor=expr("-x/2", number_slider_4))
ln_8 = Line(StartPoint=item_10.Item1, EndPoint=item_10.Item)
move_16 = Move(Geometry=ln_8, Motion=Y_6)  # -> Geometry, Transform

# ---- group: Create Fill Volume _analysis
translated_sops_3 = Data(translated_sops_2)
sops_3 = Data(clean_3)
pline_3 = PolyLine(Vertices=sops_3, Closed=True)
pline_4 = PolyLine(Vertices=translated_sops_3, Closed=True)
loft_2 = Loft(
    Curves=flatten([pline_4, pline_3]),
    Options={Adjust=False, Closed=False, LoftEnds=0, LoftSimp=0, LoftType=0, Rebuild=10, Refit=0.01})
capex = CapHolesEx(Brep=loft_2)  # -> Brep, Caps, Solid
fill_volume = Data(capex.Brep)

# ---- group: Create Cut Volume _analysis
translated_sops_4 = Data(translated_sops)
sops_4 = Data(clean_3)
pline_5 = PolyLine(Vertices=sops_4, Closed=True)
pline_6 = PolyLine(Vertices=translated_sops_4, Closed=True)
loft_3 = Loft(
    Curves=flatten([pline_6, pline_5]),
    Options={Adjust=False, Closed=False, LoftEnds=0, LoftSimp=0, LoftType=0, Rebuild=10, Refit=0.01})
capex_2 = CapHolesEx(Brep=loft_3)  # -> Brep, Caps, Solid
cut_volume = Data(capex_2.Brep)

# ---- group: Intersect Cut Volume _analysis
cut_volume_2 = Data(cut_volume)
terrain_mesh_2 = Data(topo_srf)
mesh_intersection = MeshIntersection(MeshesA=terrain_mesh_2, MeshesB=cut_volume_2)
cut_volume_3 = Data(mesh_intersection)

# ---- group: Intersect Terrain _analysis
terrain_mesh_3 = Data(topo_srf)
cut_volume_4 = Data(cut_volume)
mesh_difference = MeshDifference(MeshesA=s_0, MeshesB=cut_volume_4)
terain = Data(mesh_difference)

# ----
gate_2 = Data(a_2)
intersect_terrain = Data(mesh_difference)
exist_terrain = Data(topo_srf)
# Contour Lines
filter_7 = StreamFilter(Gate=gate_2, Stream0=intersect_terrain, Stream1=exist_terrain)
s_0_2 = Data(exist_terrain)

mesh_3 = MeshBrep(
    Brep=cut_volume_2,
    Settings={GridMaxCount=0, GridMinCount=16, JaggedSeams=False, MaxEdgeLength=0, MinEdgeLength=0.0001, MinTolerance=0, Refine=True, RefineAngle=0, RelativeTolerance=0.65, SimplePlanes=True, Tolerance=0})

# ---- group: Mesh Extents _analysis
bounding_box = BoundingBox(Content=s_0_2, Plane=PlaneXY(0, 0, 0), UnionBox=True)  # -> Box, Box_2
deconstruct_box = DeconstructBox(Box=bounding_box.Box)  # -> Plane, X, Y, Z
rectangle = Rectangle(Plane=PlaneXY(0, 0, 0), XSize=deconstruct_box.X, YSize=deconstruct_box.Y, Radius=0)  # -> Rectangle, Length
deconstruct_domain = DeconstructDomain(Domain=deconstruct_box.Z)  # -> Start, End
subtraction_3 = Subtraction(A=deconstruct_domain.End, B=deconstruct_domain.Start)
mesh_z_domain_min = Data(deconstruct_domain.Start)
topo_srf_mesh = Data(s_0_2)
mesh_z_bounds = Data(subtraction_3)
mesh_bbox_rect = Data(rectangle.Rectangle)

# ---- group: Cut Volume m3 _analysis
cut_volume_5 = Data(cut_volume_3)
volume = Volume(Geometry=cut_volume_5)  # -> Volume, Centroid
python_16 = GhPythonScript(x=volume.Volume)  # -> out, a, b
# ---------- python_16: Python ----------
__author__ = "bensay"
__version__ = "2022.08.08"

import rhinoscriptsyntax as rs

a = []
b = []

if x:
    a.append(x)
    print 1
else:
    b.append('NA')
    print 0
# ---------- end python_16 ----------
panel_24 = Panel(python_16.a)
panel_25 = Panel(python_16.b)

# ----
panel_26 = Panel(python_16.out)

# ---- group: Major Contours _analysis
major_contour_spacing_m_2 = Data(major_contour_spacing_m)
mesh_bbox_rect_2 = Data(mesh_bbox_rect)
mesh_z_domain_min_2 = Data(mesh_z_domain_min)
topo_srf_mesh_2 = Data(topo_srf_mesh)
mesh_z_bounds_2 = Data(mesh_z_bounds)
division_3 = Division(A=mesh_z_bounds_2, B=major_contour_spacing_m_2)
series_5 = Series(Start=mesh_z_domain_min_2, Step=major_contour_spacing_m_2, Count=expr("x+1", division_3))
unit_z = UnitZ(Factor=series_5)
move_17 = Move(Geometry=mesh_bbox_rect_2, Motion=unit_z)  # -> Geometry, Transform
polygon_center = PolygonCenter(Polyline=move_17.Geometry)  # -> CenterV, CenterE, CenterA
xy_plane_2 = XYPlane(Origin=Point(0, 0, 0))
plane_origin = PlaneOrigin(Base=xy_plane_2, Origin=polygon_center.CenterV)
mesh_plane = MeshPlane(Mesh=topo_srf_mesh_2, Plane=plane_origin)
major_contour_z_values = Data(series_5)
# Process
major_contour_crvs = Curve(mesh_plane)
major_contour_plans = Data(plane_origin)

# ---- group: Minor Contours _analysis
minor_contour_spacing_m = Data(minor_contour)
mesh_z_domain_min_3 = Data(mesh_z_domain_min)
mesh_z_bounds_3 = Data(mesh_z_bounds)
mesh_bbox_rect_3 = Data(mesh_bbox_rect)
topo_srf_mesh_3 = Data(topo_srf_mesh)
list = Data(major_contour_z_values)
division_4 = Division(A=mesh_z_bounds_3, B=minor_contour_spacing_m)
series_6 = Series(Start=mesh_z_domain_min_3, Step=minor_contour_spacing_m, Count=expr("x+1", division_4))
create_set = CreateSet(List=series_6)  # -> Set, Map
create_set_2 = CreateSet(List=list)  # -> Set, Map
set_intersection = SetIntersection(SetA=create_set_2.Set, SetB=create_set.Set)
member_index = MemberIndex(Set=create_set.Set, Member=set_intersection)  # -> flatten(Index), Count
cull_index = CullIndex(List=create_set.Set, Indices=member_index.Index, Wrap=True)
unit_z_2 = UnitZ(Factor=cull_index)
move_18 = Move(Geometry=mesh_bbox_rect_3, Motion=unit_z_2)  # -> Geometry, Transform
polygon_center_2 = PolygonCenter(Polyline=move_18.Geometry)  # -> CenterV, CenterE, CenterA
xy_plane_3 = XYPlane(Origin=Point(0, 0, 0))
plane_origin_2 = PlaneOrigin(Base=xy_plane_3, Origin=polygon_center_2.CenterV)
mesh_plane_2 = MeshPlane(Mesh=topo_srf_mesh_3, Plane=plane_origin_2)
curve = Curve(mesh_plane_2)

# ---- group: Major Contour Text Location _analysis
major_contour_crvs_2 = Data(major_contour_crvs)
curve_middle = CurveMiddle(Curve=major_contour_crvs_2)
curve_closest_point = CurveClosestPoint(Point=curve_middle, Curve=major_contour_crvs_2)  # -> Point, Parameter, Distance
horizontal_frame = HorizontalFrame(Curve=major_contour_crvs_2, Parameter=curve_closest_point.Parameter)
major_contour_text_location = Data(horizontal_frame)

# ---- group: Major Contour Text _analysis
major_contour_plns = Data(major_contour_plans)
mesh_bbox_rect_4 = Data(mesh_bbox_rect)
polygon_center_3 = PolygonCenter(Polyline=mesh_bbox_rect_4)  # -> CenterV, CenterE, CenterA
xy_plane_4 = XYPlane(Origin=Point(0, 0, 0))
plane_origin_3 = PlaneOrigin(Base=xy_plane_4, Origin=polygon_center_3.CenterV)
distance = Distance(PointA=major_contour_plns, PointB=plane_origin_3)
round_to_decimal_place = RoundToDecimalPlace(NumberX=distance, DecimalPlace=2, RoundType=0)  # -> Rounded, Difference
concatenate = Concatenate(FragmentA=round_to_decimal_place.Rounded, FragmentB="m")  # -> graft(Result)
major_contour_text = Data(concatenate)
# ---- group: Create Platform Thickness _section
platform_section_crv_4 = Data(platform_section_crv)
platform_thickness = Data(working_platform_depth)
Z_8 = UnitZ(Factor=platform_thickness)
move_19 = Move(Geometry=platform_section_crv_4, Motion=expr("-X", Z_8))  # -> Geometry, Transform
end_6 = EndPoints(Curve=platform_section_crv_4)  # -> Start, End
end_7 = EndPoints(Curve=move_19.Geometry)  # -> Start, End
ln_9 = Line(StartPoint=end_6.End, EndPoint=end_7.End)
ln_10 = Line(StartPoint=end_6.Start, EndPoint=end_7.Start)
merge_22 = Merge(Data1=ln_10, Data2=ln_9, Data3=move_19.Geometry, Data4=platform_section_crv_4)
join_7 = JoinCurves(Curves=merge_22, Preserve=False)
platform_extrusion = Data(join_7)

# ----
len = Length(Curve=curve)
sort_4 = SortList(Keys=len, ValuesA=curve)  # -> reverse(Keys), reverse(ValuesA)
item_11 = ListItem(List=sort_4.ValuesA, Index=0, Wrap=True)
midpt_2 = CurveMiddle(Curve=item_11)
pdecon_3 = Deconstruct(Point=midpt_2)  # -> XComponent, YComponent, ZComponent
round_to_decimal_place_2 = RoundToDecimalPlace(NumberX=pdecon_3.ZComponent, DecimalPlace=2, RoundType=0)  # -> Rounded, Difference
concatenate_2 = Concatenate(FragmentA=round_to_decimal_place_2.Rounded, FragmentB="m")  # -> graft(Result)
major_contour_text_2 = Data(concatenate_2)

# ---- group: Orient Plane _section
mesh_srf_4 = Data(topo_srf)
bbox_3 = BoundingBox(Content=flatten(mesh_srf_4), Plane=PlaneXY(0, 0, 0), UnionBox=True)  # -> Box, Box_2
debox = DeconstructBox(Box=bbox_3.Box)  # -> Plane, X, Y, Z
dedomain = DeconstructDomain(Domain=debox.X)  # -> Start, End
dedomain_2 = DeconstructDomain(Domain=debox.Y)  # -> Start, End
pt_5 = ConstructPoint(XCoordinate=expr("x+50", dedomain.End), YCoordinate=dedomain_2.End, ZCoordinate=0)
xy_4 = XYPlane(Origin=Point(0, 0, 0))
pl_origin_3 = PlaneOrigin(Base=xy_4, Origin=pt_5)
oriented_section_plane = Data(pl_origin_3)

# ---- group: Cut Intersection Crv _analysis
topo_mesh_srf_2 = Data(topo_srf)
cut_volume_6 = Data(cut_volume)
mesh_4 = MeshBrep(
    Brep=cut_volume_6,
    Settings={GridMaxCount=0, GridMinCount=16, JaggedSeams=False, MaxEdgeLength=0, MinEdgeLength=0.0001, MinTolerance=0, Refine=True, RefineAngle=0, RelativeTolerance=0.65, SimplePlanes=True, Tolerance=0})
mmx = MeshMesh(MeshA=mesh_4, MeshB=topo_mesh_srf_2)
project_8 = Project(Geometry=mmx, Plane=PlaneXY(0, 0, 0))  # -> Geometry, Transform
cut_intersection_crv = Data(project_8.Geometry)

fill_volume_2 = Data(fill_volume)
mesh_5 = MeshBrep(
    Brep=fill_volume_2,
    Settings={GridMaxCount=0, GridMinCount=16, JaggedSeams=False, MaxEdgeLength=0, MinEdgeLength=0.0001, MinTolerance=0, Refine=True, RefineAngle=0, RelativeTolerance=0.65, SimplePlanes=True, Tolerance=0})
mmx_2 = MeshMesh(MeshA=mesh_5, MeshB=topo_mesh_srf_2)
project_9 = Project(Geometry=mmx_2, Plane=PlaneXY(0, 0, 0))  # -> Geometry, Transform
fill_intersection_crv = Data(project_9.Geometry)

# ---- group: Does extents exceed surface? _analysis
cut_intersection_crv_2 = Data(mmx)
fill_intersection_crv_2 = Data(mmx_2)
cls_3 = Closed(Curve=fill_intersection_crv_2)  # -> Closed, Periodic
cls_4 = Closed(Curve=cut_intersection_crv_2)  # -> Closed, Periodic
python_17 = GhPythonScript(x=cls_3.Closed, y=cls_4.Closed)  # -> out, a
# ---------- python_17: Python ----------
__author__ = "bensay"
__version__ = "2021.05.04"

import rhinoscriptsyntax as rs

if x == True and y == True:
    a = "This calculation will be successful!"
else:
    a = "The extents of the working platform exceeds the extents of the topo surface. Please provide a larger topo surface or reduce the size of the working platform."
# ---------- end python_17 ----------
panel_27 = Panel(python_17.a)
surface_too_small_warning = Data(panel_27)

# ---- group: Warning messages _ui
# Warning Messages
polygon_closed_warning_2 = Data(polygon_closed_warning)
surface_too_small_warning_2 = Data(surface_too_small_warning)
sop_height_warning = Data(sop_height_error_warning)
# GA Plan Tab
screen_width = Data(division)
merge_23 = Merge(Data1=flatten(polygon_closed_warning_2), Data2=flatten(surface_too_small_warning_2), Data3=flatten(sop_height_warning))  # -> graft(Result)
tb_2 = CreateTextBlock(Text=merge_23, TextSize=12, Justification=1)
stack_8 = CreateStack(UIElements=tb_2, Horizontal=True)
adjustpos_14 = AdjustElementPositioning(
    ElementsToAdjust=tb_2,
    Margin="15",
    AbsolutePositioning=False,
    Width=screen_width,
    HorizontalAlignment=1,
    VerticalAlignment=0)
adjustelem_3 = AdjustElementAppearance(ElementsToAdjust=tb_2, Foreground=ColourSwatch(SwatchColor=RGB(255, 0, 0)))
warning_messages_2 = Data(stack_8)

# ---- group: Import Tab _ui
selectpolygoninput = Data(E)
warning_messages_3 = Data(warning_messages_2)
import_dwg_srf_2 = Data(import_dwg_srf)
importpolygon = Data(expander_2)
select_polygon = Data(expander_6)
merge_24 = Merge(
    Data1=flatten(import_dwg_srf_2),
    Data2=flatten(select_polygon),
    Data3=flatten(importpolygon),
    Data4=flatten(selectpolygoninput),
    Data5=flatten(warning_messages),
    Data6=flatten(warning_messages_3))
import_tab = Data(merge_24)

# ----
mesh_section_crv_2 = Data(mesh_crv)
plane = Data(section_plane)
plane_2 = Data(oriented_section_plane)
orient = Orient(Geometry=mesh_section_crv_2, Source=plane, Target=plane_2)  # -> Geometry, Transform
existing_ground_crv = Data(orient.Geometry)

platform_section_crv_5 = Data(platform_section_crv)
plane_3 = Data(section_plane)
plane_4 = Data(oriented_section_plane)
orient_2 = Orient(Geometry=platform_section_crv_5, Source=plane_3, Target=plane_4)  # -> Geometry, Transform
platform_section_crv_6 = Data(orient_2.Geometry)

# ---- group: Create section exclusion zones _section
working_platform_thickness = Data(working_platform_depth)
exclusion_zone_width_3 = Data(edge_zone_width)
working_platform_top_crv = Data(platform_section_crv_6)
ext = ExtendCurve(Curve=working_platform_top_crv, Type=0, Start=expr("-x", exclusion_zone_width_3), End=expr("-x", exclusion_zone_width_3))
end_8 = EndPoints(Curve=working_platform_top_crv)  # -> Start, End
merge_25 = Merge(Data1=end_8.Start, Data2=end_8.End)
end_9 = EndPoints(Curve=ext)  # -> Start, End
merge_26 = Merge(Data1=end_9.Start, Data2=end_9.End)
Y_7 = UnitY(Factor=expr("-x", working_platform_thickness))
ln_11 = Line(StartPoint=merge_25, EndPoint=merge_26)
extr = Extrude(Base=ln_11, Direction=Y_7)
exclusion_zone_crvs = Data(ln_11)
exclusion_zones = Data(extr)

# ---- group: Exclusion zone dim points _section
exclusion_zone_crvs_2 = Data(graft(exclusion_zone_crvs))
exclusion_zone_barrier_height_2 = Data(exclusion_zone_barrier_height)
item_12 = ListItem(List=exclusion_zone_crvs_2, Index=0, Wrap=True)  # -> Item, Item1
flip_5 = FlipCurve(Curve=item_12.Item1)  # -> Curve, Flag
end_10 = EndPoints(Curve=item_12.Item)  # -> Start, End
end_11 = EndPoints(Curve=flip_5.Curve)  # -> Start, End
Y_8 = UnitY(Factor=exclusion_zone_barrier_height_2)
Y_9 = UnitY(Factor=exclusion_zone_barrier_height_2)
move_20 = Move(Geometry=end_10.End, Motion=Y_8)  # -> Geometry, Transform
move_21 = Move(Geometry=end_11.Start, Motion=Y_9)  # -> Geometry, Transform
merge_27 = Merge(Data1=move_20.Geometry, Data2=end_11.End)
merge_28 = Merge(Data1=end_10.Start, Data2=move_21.Geometry)
dim_pt_a = Data(end_10.Start)
dim_pts_a = Data(merge_28)
dim_pt_a_2 = Data(end_11.Start)
dim_pts_b = Data(merge_27)
dim_pt_b = Data(end_10.End)
dim_pt_b_2 = Data(end_11.End)

# ---- group: Exclusion zone barrier _section
exclusion_zone_barrier_height_3 = Data(exclusion_zone_barrier_height)
exclusion_zone_top_crv = Data(exclusion_zone_crvs)
dash_gap_dist = Data(dash_distances)
end_12 = EndPoints(Curve=exclusion_zone_top_crv)  # -> Start, End
Y_10 = UnitY(Factor=1)
line = LineSDL(Start=end_12.End, Direction=Y_10, Length=exclusion_zone_barrier_height_3)
dash = DashPattern(Curve=line, Pattern=dash_gap_dist)  # -> Dashes, Gaps
exclusion_zone_barrier = Data(line)
exclusion_zone_barrier_2 = Data(dash.Dashes)

# ---- group: Spot Level Shape _section
platform_crv = Data(platform_section_crv_6)
shape_size = Data(dim_text_height)
vec_3 = VectorXYZ(XComponent=expr("-x", shape_size), YComponent=shape_size, ZComponent=0)  # -> Vector, Length
midpt_3 = CurveMiddle(Curve=platform_crv)  # -> graft(Midpoint)
vec_4 = VectorXYZ(XComponent=shape_size, YComponent=shape_size, ZComponent=0)  # -> Vector, Length
move_22 = Move(Geometry=midpt_3, Motion=[vec_4.Vector, vec_3.Vector])  # -> Geometry, Transform
pline_7 = PolyLine(Vertices=[move_22.Geometry, midpt_3], Closed=invert(False))
spot_level_shape = Data(pline_7)
shape_size_2 = Data(shape_size)
crv_midpt = Data(midpt_3)

# ---- group: Exclusion zone dim crv _section
dim_height = Data(exclusion_zone_barrier_height)
dim_pt_a_3 = Data(dim_pt_a_2)
dim_pt_b_3 = Data(dim_pt_b_2)
pdecon_4 = Deconstruct(Point=dim_pt_a_3)  # -> XComponent, YComponent, ZComponent
pdecon_5 = Deconstruct(Point=dim_pt_b_3)  # -> XComponent, YComponent, ZComponent
pt_6 = ConstructPoint(XCoordinate=pdecon_5.XComponent, YCoordinate=pdecon_4.YComponent, ZCoordinate=pdecon_5.ZComponent)
Y_11 = UnitY(Factor=dim_height)
ln_12 = Line(StartPoint=dim_pt_a_3, EndPoint=pt_6)
move_23 = Move(Geometry=ln_12, Motion=Y_11)  # -> Geometry, Transform
exclusion_zone_dim_crv = Data(move_23.Geometry)

dim_height_2 = Data(exclusion_zone_barrier_height)
dim_pt_a_4 = Data(dim_pt_a)
dim_pt_b_4 = Data(dim_pt_b)
pdecon_6 = Deconstruct(Point=dim_pt_a_4)  # -> XComponent, YComponent, ZComponent
pdecon_7 = Deconstruct(Point=dim_pt_b_4)  # -> XComponent, YComponent, ZComponent
pt_7 = ConstructPoint(XCoordinate=pdecon_7.XComponent, YCoordinate=pdecon_6.YComponent, ZCoordinate=pdecon_7.ZComponent)
ln_13 = Line(StartPoint=dim_pt_a_4, EndPoint=pt_7)
Y_12 = UnitY(Factor=dim_height_2)
move_24 = Move(Geometry=ln_13, Motion=Y_12)  # -> Geometry, Transform
exclusion_zone_dim_crv_2 = Data(move_24.Geometry)

# ---- group: Spot level tag _section
section_crv = Data(platform_section_crv)
xy_5 = XYPlane(Origin=Point(0, 0, 0))
shape_size_3 = Data(shape_size_2)
crv_midpt_2 = Data(crv_midpt)
midpt_4 = CurveMiddle(Curve=section_crv)
pl_origin_4 = PlaneOrigin(Base=xy_5, Origin=crv_midpt_2)
pdecon_8 = Deconstruct(Point=midpt_4)  # -> XComponent, YComponent, ZComponent
Y_13 = UnitY(Factor=expr("x*2", shape_size_3))
roundd_5 = RoundToDecimalPlace(NumberX=pdecon_8.ZComponent, DecimalPlace=2, RoundType=0)  # -> Rounded, Difference
python_18 = GhPythonScript(x=roundd_5.Rounded)  # -> out, a
# ---------- python_18: Python ----------
__author__ = "bensay"
__version__ = "2022.08.18"

import rhinoscriptsyntax as rs

a = []

if x >= 0:
    a.append("+" + str(x) + "m")
else:
    a.append(str(x) + "m")
# ---------- end python_18 ----------
move_25 = Move(Geometry=pl_origin_4, Motion=Y_13)  # -> Geometry, Transform
text = DefineTextObject(Text=python_18.a, Plane=move_25.Geometry)
T = Data(text)

# ---- group: Merge Dim crvs _section
exclusion_zone_dim_crv_3 = Data(exclusion_zone_dim_crv_2)
exclusion_zone_dim_crv_4 = Data(exclusion_zone_dim_crv)
dim_height_3 = Data(exclusion_zone_dim_height)
merge_29 = Merge(Data2=exclusion_zone_dim_crv_4)
dim_crvs = Data(merge_29)
end_13 = EndPoints(Curve=dim_crvs)  # -> Start, End
linear_dim = DefineLinearDimension(
    Point1=end_13.Start,
    Point2=end_13.End,
    Offset=expr("-X", dim_height_3),
    DimensionStyle="Meters Architectural",
    OverwriteText="2m Exclusion Zone",
    internalize=False)
ld = Data(linear_dim)

# ----
platform_extrusion_2 = Data(platform_extrusion)
plane_5 = Data(section_plane)
plane_6 = Data(oriented_section_plane)
orient_3 = Orient(Geometry=platform_extrusion_2, Source=plane_5, Target=plane_6)  # -> Geometry, Transform
extruded_platform_crv = Data(orient_3.Geometry)

# ---- group: Working Platform _section
hatch_type = ValueList({"SOLID", "Hatch1", "Hatch2", "Hatch3", "HatchDash", "Grid", "Grid60", "Plus", "Squares", "HSBDR3E0", "Earth", "Platform"}, selected="Platform")
platform_crv_2 = Data(extruded_platform_crv)
platform_depth = Data(working_platform_depth)
hatch_scale_3 = Data(hatch_scale)
Y_14 = UnitY(Factor=expr("-x", platform_depth))
working_platform_3 = Data(platform_crv_2)
hatch = DefineHatch(Curve=platform_crv_2, Pattern=hatch_type, Rotation=0, Scale=hatch_scale_3)
platfrom_hatch = Data(hatch)

# ---- group: Working Platform Depth Dim _section
dim_leader_length_2 = Data(dim_leader_length)
working_platform_4 = Data(working_platform_3)
vec_5 = VectorXYZ(XComponent=1, YComponent=1, ZComponent=0)  # -> expr("-x", Vector), Length
pcen = PolygonCenter(Polyline=working_platform_4)  # -> CenterV, CenterE, CenterA
line_2 = LineSDL(Start=pcen.CenterV, Direction=vec_5.Vector, Length=dim_leader_length_2)
X_6 = UnitX(Factor=1)
end_14 = EndPoints(Curve=line_2)  # -> Start, End
line_3 = LineSDL(Start=end_14.End, Direction=expr("-x", X_6), Length=dim_leader_length_2)
join_8 = JoinCurves(Curves=[line_2, line_3], Preserve=False)
explode_5 = Explode(Curve=join_8, Recursive=True)  # -> Segments, Vertices
leader = DefineLeader(Text="Working Platform minimum Xm depth", Points=explode_5.Vertices)

# ---- group: Major Contours _visual
number_slider_7 = Slider(2, range=0..100)  # disabled
colour_swatch = ColourSwatch(SwatchColor=RGB(0, 0, 0))  # disabled
location_3 = Data(major_contour_text_location)  # disabled
text_2 = Data(major_contour_text)  # disabled
geometry = Data(major_contour_crvs)  # disabled
justifiedtext3d = JustifiedText3d(
    Location=location_3,
    Text=text_2,
    Size=number_slider_7,
    Color=colour_swatch,
    HorizontalAlignment=1,
    VerticalAlginment=1,
    UseMeshes=False,
    Bake=False)  # disabled
# Display
custom_preview_lineweights = CustomPreviewLineweights(Geometry=geometry, Shader=colour_swatch, Absolute=False)  # disabled

# ----
panel_28 = Panel("Major Contours")  # disabled
lay = Data(panel_10)  # disabled
col = Data(colour_swatch)  # disabled
bool_5 = Data(bake_model_bool_2)  # disabled
createatts = CreateAttributes(Name=panel_28, LayerName=lay, Color=col, PlotColor=col, enableFullPath=False)  # disabled
bake = BakeObject(ObjectAttributes=createatts, Bake=bool_5)  # disabled

# ---- group: Export CSV _out
save_bool = Data(value_2)
sop_data_2 = Data(flatten)
file_path = Data(value)
concat_2 = Concatenate(FragmentA=file_path, FragmentB=".csv")
path_2 = FilePath(concat_2)
c_script_3 = CSharpScript(save=save_bool, path=path_2, data=sop_data_2)  # inputs save: Boolean, path: String, data: list of String
# ---------- c_script_3: C# ----------
    if(save){
      var fileinfo = new System.IO.FileInfo(path);
      if(!fileinfo.Directory.Exists){
        fileinfo.Directory.Create();
      }

      var sw = fileinfo.CreateText();
      for(int i = 0; i < data.Count; i++){
        string row = data[i];
        if(i < data.Count - 1){
          sw.WriteLine(row);
        } else {
          sw.Write(row);
        }
      }

      sw.Flush();
      sw.Close();

    }
# ---------- end c_script_3 ----------

# ---- group: Input Crv Plan _visual
G = Data(manual_select_curve)
B = Data(crv_5)
project_10 = Project(Geometry=G, Plane=PlaneXY(0, 0, 0))  # -> Geometry, Transform
rdiff = RegionDifference(CurvesA=project_10.Geometry, CurvesB=flatten(B))
preview = CustomPreview(Geometry=project_10.Geometry, Material=ColourSwatch(SwatchColor=RGB(0, 0, 0)))
R = Data(rdiff)

# ---- group: SOP Text _visual
L_2 = Data(move_12.Geometry)
T_2 = Data(merge_21)
text_3 = DefineTextObject(Text=T_2, Plane=L_2)
preview_2 = CustomPreview(Geometry=text_3, Material=ColourSwatch(SwatchColor=RGB(0, 0, 0)))

# ---- group: SOP Geom _visual
sop_geom = Data(crv_6)
project_11 = Project(Geometry=sop_geom, Plane=PlaneXY(0, 0, 0))  # -> Geometry, Transform
previewlw = CustomPreviewLineweights(
    Geometry=project_11.Geometry,
    Shader=ColourSwatch(SwatchColor=RGB(0, 0, 0)),
    Thickness=Slider(2, range=0..10),
    Absolute=False)

# ---- group: SOP Table _visual
G_2 = Data(move_16.Geometry)
G_3 = Data(move_15.Geometry)
preview_3 = CustomPreview(Geometry=[G_3, G_2], Material=ColourSwatch(SwatchColor=RGB(0, 0, 0)))

# ---- group: SOP Tag _visual
sop_locations = Data(pt_3)
sop_txt = Data(join_5)
txt_size = Data(text_height)
text_4 = DefineTextObject(Text=sop_txt, Plane=sop_locations, DimensionStyle="Meters Architectural")
preview_4 = CustomPreview(Geometry=text_4, Material=ColourSwatch(SwatchColor=RGB(0, 0, 0)))

# ----
cls_5 = Closed()  # -> Closed, Periodic

# ---- group: Exclusion Zone _visual
swatch_2 = ColourSwatch(SwatchColor=RGB(255, 0, 0))
R_2 = Data(panel_10)
createatts_2 = CreateAttributes(Name="Exclusion Zone", LayerName=R_2, Color=swatch_2, PlotColor=swatch_2, enableFullPath=False)
exclusion_zone_3 = Data(flatten(crv_5))
B_2 = Data(bake_model_bool_2)
att = Data(createatts_2)
createhatch = CreateHatch(Bake=B_2, Curves=exclusion_zone_3, HatchPatternName="Solid", HatchScale=1, HatchRotation=0, Attributes=att)  # -> HatchGeometry, HatchObjects
preview_5 = CustomPreview(Geometry=createhatch.HatchGeometry, Material=ColourSwatch(SwatchColor=RGB(255, 0, 0)))

# ---- group: Spot Level Tag / Spot level shape _visual
swatch_3 = ColourSwatch(SwatchColor=RGB(0, 0, 0))
shape = Data(spot_level_shape)
preview_6 = CustomPreview(Geometry=shape, Material=swatch_3)

# ---- group: Working Platform / Working Platform _visual
platform_hatch = Data(platfrom_hatch)
swatch_4 = ColourSwatch(SwatchColor=RGB(79, 79, 79))
previewlw_2 = CustomPreviewLineweights(Geometry=platform_hatch, Shader=swatch_4, Absolute=False)

# ---- group: Exclusion zone dim _visual
swatch_5 = ColourSwatch(SwatchColor=RGB(0, 0, 0))
dim_leader = Data(ld)
preview_7 = CustomPreview(Geometry=dim_leader, Material=swatch_5)

bake_bool = Data(bake_model_bool_2)
lay_2 = Data(panel_11)
createatts_3 = CreateAttributes(Name="Exclusion Zone Dim", LayerName=lay_2, Color=swatch_5, PlotColor=swatch_5, enableFullPath=False)
bake_2 = BakeObject(ObjectAttributes=createatts_3, Bake=bake_bool, AllObjects_Object=preview_7)

# ---- group: Exclusion zone barrier _visual
swatch_6 = ColourSwatch(SwatchColor=RGB(255, 0, 0))
crv_thickness = Data(dash_line_thickness)
barrier_crv = Data(exclusion_zone_barrier_2)
previewlw_3 = CustomPreviewLineweights(Geometry=barrier_crv, Shader=swatch_6, Thickness=crv_thickness, Absolute=False)

bake_bool_2 = Data(bake_model_bool_2)
lay_3 = Data(panel_12)
createatts_4 = CreateAttributes(Name="Exclusion Zone Barrier Curve", LayerName=lay_3, Color=swatch_6, PlotColor=swatch_6, enableFullPath=False)
bake_3 = BakeObject(ObjectAttributes=createatts_4, Bake=bake_bool_2, AllObjects_Object=barrier_crv)

# ---- group: Spot Level Text / Spot level tag _visual
text_tag = Data(T)
swatch_7 = ColourSwatch(SwatchColor=RGB(0, 0, 0))
preview_8 = CustomPreview(Geometry=text_tag, Material=swatch_7)

# ---- group: Working platform dim _visual / Workign platformd depth dim _visual
swatch_8 = ColourSwatch(SwatchColor=RGB(0, 0, 0))
dim_leader_2 = Data(leader)
preview_9 = CustomPreview(Geometry=dim_leader_2, Material=swatch_8)

# ---- group: Working platform dim _visual
bake_bool_3 = Data(bake_model_bool_2)
lay_4 = Data(panel_11)
createatts_5 = CreateAttributes(Name="Working Platform Dim", LayerName=lay_4, Color=swatch_8, PlotColor=swatch_8, enableFullPath=False)
bake_4 = BakeObject(ObjectAttributes=createatts_5, Bake=bake_bool_3, AllObjects_Object=dim_leader_2)

# ---- group: Exclusion zone _visual / Section Exclusion Zone _visual
swatch_9 = ColourSwatch(SwatchColor=RGB(255, 0, 0))
exclusion_zone_4 = Data(exclusion_zones)
preview_10 = CustomPreview(Geometry=exclusion_zone_4, Material=swatch_9)

# ---- group: Spot Level Tag
bake_bool_4 = Data(bake_model_bool_2)
lay_5 = Data(panel_12)
createatts_6 = CreateAttributes(Name="Spot Level Tag", LayerName=lay_5, Color=swatch_3, PlotColor=swatch_3, enableFullPath=False)
bake_5 = BakeObject(ObjectAttributes=createatts_6, Bake=bake_bool_4, AllObjects_Object=preview_6)

# ---- group: Working Platform
bake_bool_5 = Data(bake_model_bool_2)
lay_6 = Data(panel_12)
createatts_7 = CreateAttributes(Name="Working Platform", LayerName=lay_6, Color=swatch_4, PlotColor=swatch_4, enableFullPath=False)
bake_6 = BakeObject(ObjectAttributes=createatts_7, Bake=bake_bool_5, AllObjects_Object=platform_hatch)

# ----
R_3 = Data(panel_10)

# ---- group: Exclusion Zone _visual
swatch_10 = ColourSwatch(SwatchColor=RGB(138, 138, 138))
createatts_8 = CreateAttributes(Name="Working Platform", LayerName=R_3, Color=swatch_10, PlotColor=swatch_10, enableFullPath=False)
exclusion_zone_5 = Data(R)
B_3 = Data(bake_model_bool_2)
att_2 = Data(createatts_8)
createhatch_2 = CreateHatch(Bake=B_3, Curves=exclusion_zone_5, HatchPatternName="Solid", HatchScale=1, HatchRotation=0, Attributes=att_2)  # -> HatchGeometry, HatchObjects
preview_11 = CustomPreview(Geometry=createhatch_2.HatchGeometry, Material=ColourSwatch(SwatchColor=RGB(26, 26, 26)))

# ---- group: Spot Level Text
bake_bool_6 = Data(bake_model_bool_2)
lay_7 = Data(panel_12)
createatts_9 = CreateAttributes(Name="Spot Level Text", LayerName=lay_7, Color=swatch_7, PlotColor=swatch_7, enableFullPath=False)
bake_7 = BakeObject(ObjectAttributes=createatts_9, Bake=bake_bool_6, AllObjects_Object=preview_8)

# ---- group: Exclusion zone _visual
bake_bool_7 = Data(bake_model_bool_2)
lay_8 = Data(panel_12)
createatts_10 = CreateAttributes(Name="Exclusion Zone", LayerName=lay_8, Color=swatch_9, PlotColor=swatch_9, enableFullPath=False)
bake_8 = BakeObject(ObjectAttributes=createatts_10, Bake=bake_bool_7, AllObjects_Object=preview_10)

# ---- group: Display Terrain Volume _visual
G_4 = Data(a_2)
terrain = Data(terain)
filter_8 = StreamFilter(Gate=G_4, Stream0=terrain)
custom_preview = CustomPreview(Geometry=filter_8, Material=ColourSwatch(SwatchColor=RGB(87, 255, 188)))
terrain_2 = Data(terrain)

# ---- group: Section Cut _ui
section_cut = Data(platform_section_crv)
swatch_11 = ColourSwatch(SwatchColor=RGB(0, 0, 0))
ext_2 = ExtendCurve(Curve=section_cut, Type=0, Start="2", End="2")
preview_12 = CustomPreview(Geometry=ext_2, Material=swatch_11)
preview_13 = CustomPreview(Geometry=ext_2, Material=swatch_11)

# ---- group: Display Cut Volume _visual
cut_volume_7 = Data(cut_volume_3)
G_5 = Data(a_2)
filter_9 = StreamFilter(Gate=G_5, Stream0=cut_volume_7)
custom_preview_2 = CustomPreview(Geometry=filter_9, Material=ColourSwatch(SwatchColor=RGB(0, 174, 255)))

# ---- group: Existing Terrain _visual
filter_gate = Data(a_2)
topo_srf_3 = Data(topo_srf)
filter_10 = StreamFilter(Gate=filter_gate, Stream1=topo_srf_3)
preview_14 = CustomPreview(Geometry=filter_10, Material=ColourSwatch(SwatchColor=RGBA(0, 212, 255, 98)))

# ---- group: Display Platform Edge _visual
_3d_preview_input_crv = Data(manual_select_curve)
preview_15 = CustomPreview(Geometry=_3d_preview_input_crv, Material=ColourSwatch(SwatchColor=RGB(0, 0, 0)))

# ---- group: Bake SOP Table _export
swatch_12 = ColourSwatch(SwatchColor=RGB(0, 0, 0))
B_4 = Data(bake_model_bool_2)
createatts_11 = CreateAttributes(Name="SOP", LayerName="SOP", Color=swatch_12, PlotColor=swatch_12, enableFullPath=False)
bake_9 = BakeObject(ObjectAttributes=createatts_11, Bake=B_4, AllObjects_Object=[preview_3, preview_2])

# ----
swatch_13 = ColourSwatch(SwatchColor=RGB(0, 0, 0))
lay_9 = Data(panel_10)
B_5 = Data(bake_model_bool_2)
createatts_12 = CreateAttributes(Name="SOPs", LayerName=lay_9, Color=swatch_13, PlotColor=swatch_13, enableFullPath=False)
bake_10 = BakeObject(ObjectAttributes=createatts_12, Bake=B_5, AllObjects_Object=[project_11, text_4])

swatch_14 = ColourSwatch(SwatchColor=RGB(0, 0, 0))
lay_10 = Data(panel_10)
B_6 = Data(bake_model_bool_2)
createatts_13 = CreateAttributes(Name="Spot Level", LayerName=lay_10, Color=swatch_14, PlotColor=swatch_14, enableFullPath=False)
bake_11 = BakeObject(ObjectAttributes=createatts_13, Bake=B_6)

# ---- group: Fill Extents _visual
cut_extents_crv = Data(cut_intersection_crv)
preview_16 = CustomPreview(Geometry=cut_extents_crv, Material=ColourSwatch(SwatchColor=RGB(0, 0, 0)))

fill_extents = Data(fill_intersection_crv)
preview_17 = CustomPreview(Geometry=fill_extents, Material=ColourSwatch(SwatchColor=RGB(0, 0, 0)))

# ---- group: Info Tab _ui / Costain Branding _ui / Costain Logo _ui
panel_29 = Panel("C:\Users\bensay\Costain Group Plc\Digital Engineering Solutions - AutoDesign\04-Ideas_&_Misc\Project Best Practice\GUI\HumanUI")
logo_width = Slider(100, range=0..100)
dir = DirectoryContents(FolderPath=panel_29, Filter="*.jpg", IncludeSubfolders=False)  # -> FilePaths, FileNames
image = CreateImage(ImageSource=dir.FilePaths, ImageWidth=logo_width)
costain_image = Data(image)
setimg = SetImage(ImageToModify=image, NewImagePath=dir.FilePaths)

# ---- group: Info Tab _ui / Costain Branding _ui
horizontal_alignment_4 = ValueList({"Left": 0, "Center": 1, "Right": 2}, selected="Center")
vertical_alignment_2 = ValueList({"Top": 2, "Middle": 1, "Bottom": 0}, selected="Top")
merge_30 = Merge(Data1=flatten(costain_image), Data2=flatten(costain_text))
costain_branding = Data(merge_30)

# ---- group: Info Tab _ui / Costain Branding _ui / Costain Logo _ui (continued)
adjustpos_15 = AdjustElementPositioning(
    ElementsToAdjust=image,
    Margin=Slider(20, range=0..100),
    AbsolutePositioning=invert(True),
    HorizontalAlignment=horizontal_alignment_4,
    VerticalAlignment=vertical_alignment_2)

# ---- group: Info Tab _ui
product_description_3 = Data(product_description_2)
costain_branding_2 = Data(costain_branding)
ben_contact_info_2 = Data(ben_contact_info)
joe_contact_info_2 = Data(joe_contact_info)
product_title_3 = Data(product_title_2)
merge_31 = Merge(
    Data1=flatten(product_title_3),
    Data2=flatten(product_description_3),
    Data3=flatten(joe_contact_info_2),
    Data4=flatten(ben_contact_info_2),
    Data5=flatten(costain_branding_2))
info_tab = Data(merge_31)

# ---- group: Exports _ui / Bake Geometry _ui
button_9 = CreateButton(ButtonName="Create Drawing Sheets", ButtonStyle=0)
values_29 = ValueListener(Elements=button_9, SomeProperty=True)  # -> Values, Indices
adjustpos_16 = AdjustElementPositioning(ElementsToAdjust=button_9, Margin="10", AbsolutePositioning=False, Width=200, HorizontalAlignment=1)
dwg_bool_2 = Data(values_29.Values)

# ----
merge_32 = Merge(Data1=button_9, Data2=button_2)
python_19 = GhPythonScript(x=dwg_bool_2)  # -> out, a
# ---------- python_19: Python ----------
__author__ = "bensay"
__version__ = "2022.10.24"

import rhinoscriptsyntax as rs
import scriptcontext as sc

if x:
    rs.Command('_RunPythonScript')
# ---------- end python_19 ----------
stack_9 = CreateStack(UIElements=merge_32, Horizontal=True)

# ---- group: Exports _ui / Bake Geometry _ui (continued)
expander_19 = CreateExpander(UIElements=stack_9, Header="Drawings", Open=True)
dwg_model_2 = Data(expander_19)

# ---- group: Export Tab _ui
create_dwgs = Data(dwg_model_2)
bake_model_2 = Data(bake_model)
export_csv_2 = Data(export_csv)
merge_33 = Merge(Data1=flatten(bake_model_2), Data2=flatten(create_dwgs), Data3=flatten(export_csv_2))
export_tab = Data(merge_33)

# ---- group: Drawing _ui / Fill Volume Text _ui / Fill Volume _ui
dummy_text_8 = Panel("Fill Volume (m3)")
label_10 = CreateLabel(LabelText=dummy_text_8, LabelSize=12, Justification=0)
panel_30 = Panel(panel_25)
panel_31 = Panel(panel_26)
fill_volume_3 = Data(label_10)

# ---- group: Drawing _ui / Fill Volume Text _ui
merge_34 = Merge(Data1=flatten(label_8), Data2=flatten(fill_volume_3))
stack_10 = CreateStack(UIElements=flatten(merge_34), Horizontal=True)
fill_volume_4 = Data(stack_10)

# ---- group: Drawing _ui / Cut Volume Text _ui / Cut Volume _ui
cut_volume_m3 = Data(panel_24)
round = RoundToIncrements(values=cut_volume_m3, factor=Slider(0.01, range=0..0.01))
merge_35 = Merge(Data1=flatten(round), Data2=flatten(" m3"))
join_9 = TextJoin(Text=merge_35)
dummy_text_9 = Panel("Cut Volume (m3)")
label_11 = CreateLabel(LabelText=dummy_text_9, LabelSize=12, Justification=0)
cut_volume_8 = Data(round)
label_12 = Data(label_11)

# ---- group: Drawing _ui / Cut Volume Text _ui
merge_36 = Merge(Data1=flatten(label_9), Data2=flatten(label_12))
stack_11 = CreateStack(UIElements=flatten(merge_36), Horizontal=True)
cut_volume_m3_2 = Data(cut_volume_8)
cut_volume_9 = Data(stack_11)

# ---- group: Drawing _ui / Total +/- Volumes _ui
cut_volume_m3_3 = Data(cut_volume_m3_2)
dummy_text_10 = Panel("Fill Volume (m3)")
label_13 = CreateLabel(LabelText=dummy_text_10, LabelSize=12, Justification=0)

# ---- group: GA Plan _ui / Select Spot Level Locations _ui
pickbtn_3 = CreateRhinoPickButton(
    ButtonName="Select Spot Level Locations",
    Prompt="Select Rhino Geometry",
    AllowMultiple=True,
    AllowNone=True,
    Type=4,
    ButtonStyle=0)
values_30 = ValueListener(Elements=pickbtn_3, SomeProperty=True)  # -> Values, Indices
pt_8 = Point(values_30.Values)

# ---- group: GA Plan _ui
merge_37 = Merge(Data1=flatten(button_8), Data2=flatten(pickbtn_3))
stack_12 = CreateStack(UIElements=merge_37, Horizontal=True)

# ---- group: GA Plan _ui / Select Spot Level Locations _ui (continued)
expander_20 = CreateExpander(UIElements=flatten(stack_12), Header="Pick Spot Levels", Open=True)

# ---- group: GA Plan Tab _ui
retaining_wall_sop_2 = Data(retaining_wall_sop)
select_spot_levels = Data(expander_20)
edge_zone = Data(edge_zones)
sops_5 = Data(sops)
merge_38 = Merge(Data1=flatten(edge_zone), Data2=flatten(edge_zone_culling), Data4=flatten(select_spot_levels))
ga_plan = Data(merge_38)

# ---- group: Drawing _ui / Total +/- Volumes _ui / Total Volume _ui
label_14 = Data(label_13)

# ---- group: Drawing _ui / Total +/- Volumes _ui (continued)
merge_39 = Merge(Data1=flatten(label_7), Data2=flatten(label_14))
stack_13 = CreateStack(UIElements=flatten(merge_39), Horizontal=True)
total_volume = Data(stack_13)

# ---- group: Drawing _ui
merge_40 = Merge(Data1=flatten(toggle_3), Data2=flatten(cut_volume_9), Data3=flatten(fill_volume_4), Data4=flatten(total_volume))
expander_21 = CreateExpander(UIElements=flatten(merge_40), Header="Earthworks Volumes", Open=True)
earthworks_volumes = Data(expander_21)

# ---- group: Model _ui
earthworks_volumes_toggle = Data(earthworks_volumes)
earthworks_volumes_2 = Data(earthworks_volumes)
merge_41 = Merge(Data1=flatten(earthworks_volumes_toggle), Data2=flatten(earthworks_volumes_2))
model = Data(merge_41)

# ---- group: UI Tabs _ui
import_tab_2 = Data(import_tab)
ui_window = Data(W_2)
export_tab_2 = Data(export_tab)
model_2 = Data(model)
ga_plan_2 = Data(ga_plan)
info_tab_2 = Data(info_tab)
section_2 = Data(section)
panel_32 = Panel("""Import
GA Plan
Section
Model
Export
Info""")
# Inputs
tabs = TabbedView(
    TabNames=panel_32,
    Tab0=flatten(import_tab_2),
    Tab1=flatten(ga_plan_2),
    Tab2=flatten(section_2),
    Tab3=flatten(model_2),
    Tab4=flatten(export_tab_2),
    Tab5=flatten(info_tab_2))
# Selection
addelems = AddElements(Window=ui_window, Elements=tabs, DoVLChecking=True)  # -> AddedElements, ElementNames

# ---- group: Spot Levels _analysis / Get Spot Level Heights _analysis
fill_volume_5 = Data(fpatch)
topo_mesh = Data(topo_srf)
Z_9 = UnitZ(Factor=1)
# Spot Levels
rhino_pts = Point(pt_8)
project_12 = ProjectPoint(Point=rhino_pts, Direction=Z_9, Geometry=fill_volume_5)  # -> Point, Index
spot_levels = Data(project_12.Point)

# ----
pdecon_9 = Deconstruct(Point=project_12.Point)  # -> XComponent, YComponent, ZComponent

# ---- group: Spot Levels _analysis / Get Spot Level Heights _analysis (continued)
spot_level_heights = Data(pdecon_9.ZComponent)

# ---- group: Spot Levels _analysis / Create Spot Level Tags _analysis
spot_level_heights_2 = Data(spot_level_heights)
lng_8 = ListLength(List=spot_level_heights_2)
repeat_3 = RepeatData(Data="+ ", Length=lng_8)  # -> flatten(Data)
repeat_4 = RepeatData(Data=" m", Length=lng_8)  # -> flatten(Data)
round_2 = RoundToIncrements(values=spot_level_heights_2, factor=0.01)  # -> flatten(rounded_values)
merge_42 = Merge(Data1=graft(repeat_3), Data2=graft(round_2), Data3=graft(repeat_4))  # -> simplify(Result)
join_10 = TextJoin(Text=merge_42)
T_3 = Data(join_10)

# ---- group: Spot Levels _visual
spot_level_heights_3 = Data(T_3)
spot_level_pts = Data(spot_levels)
text_5 = DefineTextObject(Text=spot_level_heights_3, Plane=graft(spot_level_pts))
preview_18 = CustomPreview(Geometry=text_5, Material=ColourSwatch(SwatchColor=RGB(0, 0, 0)))

# ---- group: Intersect Fill Volume _analysis
# Earthworks Volume Calculation
fill_volume_6 = Data(fill_volume)
terrain_mesh_4 = Data(topo_srf)

# ----
mesh_6 = MeshBrep(
    Brep=fill_volume_6,
    Settings={GridMaxCount=0, GridMinCount=16, JaggedSeams=False, MaxEdgeLength=0, MinEdgeLength=0.0001, MinTolerance=0, Refine=True, RefineAngle=0, RelativeTolerance=0.65, SimplePlanes=True, Tolerance=0})

# ---- group: Intersect Fill Volume _analysis (continued)
mesh_difference_2 = MeshDifference(MeshesA=mesh_6, MeshesB=s_0)
fill_volume_7 = Data(mesh_difference_2)

# ---- group: Fill Volume m3 _analysis
fill_volume_8 = Data(fill_volume_7)
volume_2 = Volume(Geometry=fill_volume_8)  # -> Volume, Centroid
python_20 = GhPythonScript(x=volume_2.Volume)  # -> out, a, b; same code as python_16
panel_33 = Panel(python_20.a)
panel_34 = Panel(python_20.b)

# ---- group: Drawing _ui / Fill Volume Text _ui / Fill Volume _ui (continued)
fill_volume_m3 = Data(panel_33)
round_3 = RoundToIncrements(values=fill_volume_m3, factor=Slider(0.01, range=0..0.01))
merge_43 = Merge(Data1=flatten(round_3), Data2=flatten(" m3"))
join_11 = TextJoin(Text=merge_43)
filter_11 = StreamFilter(Gate=panel_31, Stream0=panel_30, Stream1=join_11)
setlabel = SetLabelContents(LabelToModify=label_10, NewLabelContents=filter_11)
fill_volume_m3_2 = Data(round_3)
fill = Data(filter_11)

# ----
panel_35 = Panel(python_20.out)

# ---- group: Drawing _ui / Cut Volume Text _ui / Cut Volume _ui (continued)
panel_36 = Panel(panel_34)
panel_37 = Panel(panel_35)
filter_12 = StreamFilter(Gate=panel_37, Stream0=panel_36, Stream1=join_9)
setlabel_2 = SetLabelContents(LabelToModify=label_11, NewLabelContents=filter_12)
cut = Data(filter_12)

# ---- group: Display Fill Volume _visual
fill_volume_9 = Data(fill_volume_7)
G_6 = Data(a_2)
filter_13 = StreamFilter(Gate=G_6, Stream0=fill_volume_9)
custom_preview_3 = CustomPreview(Geometry=filter_13, Material=ColourSwatch(SwatchColor=RGB(255, 21, 0)))
fill_volume_10 = Data(fill_volume_9)

# ---- group: Drawing _ui / Total +/- Volumes _ui (continued)
fill_volume_m3_3 = Data(fill_volume_m3_2)
subtraction_4 = Subtraction(A=fill_volume_m3_3, B=cut_volume_m3_3)
merge_44 = Merge(Data1=flatten(subtraction_4), Data2=flatten(" m3"))
join_12 = TextJoin(Text=merge_44)

# ---- group: Drawing _ui / Total +/- Volumes _ui / Total Volume _ui (continued)
cut_2 = Data(cut)
fill_2 = Data(fill)
python_21 = GhPythonScript(x=cut_2, y=fill_2)  # -> out, a
# ---------- python_21: Python ----------
__author__ = "bensay"
__version__ = "2022.10.24"

import rhinoscriptsyntax as rs

a = []

if x or y != 'NA':
    a.append(1)
else:
    a.append(0)
# ---------- end python_21 ----------
filter_14 = StreamFilter(Gate=python_21.a, Stream0="NA", Stream1=join_12)

# ---- group: Drawing _ui / Total +/- Volumes _ui (continued)
setlabel_3 = SetLabelContents(LabelToModify=label_13, NewLabelContents=filter_14)

# ---- group: Remove Existing Topo Crv _seciton
mesh_section_crv_3 = Data(mesh_crv)
platform_end_pts_4 = Data(platform_end_pts_3)
platform_section_crv_7 = Data(platform_section_crv)
slope_crvs_2 = Data(slope_crvs)
section_bbox_2 = Data(section_bbox)
crv_cp = CurveClosestPoint(Point=platform_end_pts_4, Curve=mesh_section_crv_3)  # -> Point, Parameter, Distance
shatter = Shatter(Curve=mesh_section_crv_3, Parameters=flatten(crv_cp.Parameter))
midpt_5 = CurveMiddle(Curve=shatter)
incurve_2 = PointInCurve(Point=midpt_5, Curve=section_bbox_2)  # -> Relationship, Point

# ----
trim = TrimTree(Tree=slope_crvs_2, Depth=1)
flip_6 = FlipMatrix(Data=trim)
merge_45 = Merge(Data1=platform_section_crv_7, Data2=slope_crvs_2)
join_13 = JoinCurves(Curves=flatten(merge_45), Preserve=False)
bbox_4 = BoundingBox(Content=graft(join_13), Plane=section_plane_5, UnionBox=True)  # -> Box, Box_2
rec_2 = Rectangle(bbox_4.Box)
incurves = PointInCurves(Point=midpt_5, Curves=flatten(rec_2))  # -> Relationship, Index, Point

# ---- group: Remove Existing Topo Crv _seciton (continued)
smaller = SmallerThan(FirstNumber=incurves.Relationship, SecondNumber=2)  # -> SmallerThan, OrEqualTo
cull_4 = CullPattern(List=shatter, CullPattern=smaller.SmallerThan)
merge_46 = Merge(Data1=cull_4, Data2=platform_section_crv_7, Data3=slope_crvs_2)
join_14 = JoinCurves(Curves=flatten(merge_46), Preserve=False)
section_crv_2 = Data(join_14)

# ---- group: Restrict Section Length _sectoin
section_crv_3 = Data(section_crv_2)
section_bbox_3 = Data(section_bbox)
section_bbox_extents = Data(section_bbox_offset)
offset = OffsetCurve(Curve=section_bbox_3, Distance=section_bbox_extents, Corners=1)
ccx = CurveCurve(CurveA=section_crv_3, CurveB=offset)  # -> Points, ParamsA, ParamsB
shatter_2 = Shatter(Curve=section_crv_3, Parameters=ccx.ParamsA)
midpt_6 = CurveMiddle(Curve=shatter_2)
incurve_3 = PointInCurve(Point=midpt_6, Curve=offset)  # -> Relationship, Point
smaller_2 = SmallerThan(FirstNumber=incurve_3.Relationship, SecondNumber=2)  # -> SmallerThan, OrEqualTo
cull_5 = CullPattern(List=shatter_2, CullPattern=invert(smaller_2.SmallerThan))
section_crv_4 = Data(cull_5)

# ----
section_crv_5 = Data(section_crv_4)
plane_7 = Data(section_plane)
plane_8 = Data(oriented_section_plane)
orient_4 = Orient(Geometry=section_crv_5, Source=plane_7, Target=plane_8)  # -> Geometry, Transform
ground_section_crv = Data(orient_4.Geometry)

# ---- group: Earth Hatch Area Crvs
extruded_platform_crv_2 = Data(extruded_platform_crv)
platform_section_crv_8 = Data(platform_section_crv_6)
ground_section_crv_2 = Data(ground_section_crv)
circle_radius = Data(earthworks_hatching_radius)
Y_15 = UnitY(Factor=circle_radius)
move_26 = Move(Geometry=ground_section_crv_2, Motion=expr("-x*2", Y_15))  # -> Geometry, Transform
end_15 = EndPoints(Curve=move_26.Geometry)  # -> Start, End
end_16 = EndPoints(Curve=ground_section_crv_2)  # -> Start, End
ln_14 = Line(StartPoint=end_16.End, EndPoint=end_15.End)
ln_15 = Line(StartPoint=end_16.Start, EndPoint=end_15.Start)
end_17 = EndPoints(Curve=platform_section_crv_8)  # -> Start, End
merge_47 = Merge(Data1=ln_15, Data2=ln_14, Data3=move_26.Geometry, Data4=ground_section_crv_2)
merge_48 = Merge(Data1=end_17.Start, Data2=end_17.End)
join_15 = JoinCurves(Curves=flatten(merge_47), Preserve=False)
cir_2 = Circle(Plane=merge_48, Radius=circle_radius)
rint = RegionIntersection(CurvesA=cir_2, CurvesB=join_15)
rdiff_2 = RegionDifference(CurvesA=rint, CurvesB=extruded_platform_crv_2)
hatch_areas = Data(rdiff_2)

# ---- group: Cull Existing Ground Crv Outside Of Area _section
existing_ground_crv_2 = Data(existing_ground_crv)
section_crv_6 = Data(ground_section_crv)
bbox_5 = BoundingBox(Content=section_crv_6, Plane=PlaneXY(0, 0, 0))  # -> Box, Box_2
rec_3 = Rectangle(bbox_5.Box)
pcen_2 = PolygonCenter(Polyline=rec_3)  # -> CenterV, CenterE, CenterA
scale_nu = ScaleNU(Geometry=rec_3, Plane=pcen_2.CenterV, ScaleX=1, ScaleY=Slider(10, range=0..10), ScaleZ="1")  # -> Geometry, Transform
ccx_2 = CurveCurve(CurveA=existing_ground_crv_2, CurveB=scale_nu.Geometry)  # -> Points, ParamsA, ParamsB
shatter_3 = Shatter(Curve=existing_ground_crv_2, Parameters=ccx_2.ParamsA)
midpt_7 = CurveMiddle(Curve=shatter_3)
incurve_4 = PointInCurve(Point=midpt_7, Curve=scale_nu.Geometry)  # -> Relationship, Point
smaller_3 = SmallerThan(FirstNumber=incurve_4.Relationship, SecondNumber=2)  # -> SmallerThan, OrEqualTo
cull_6 = CullPattern(List=shatter_3, CullPattern=invert(smaller_3.SmallerThan))
existing_ground_crv_3 = Data(cull_6)

# ---- group: Existing ground profile dim leader _section
existing_ground_crv_4 = Data(existing_ground_crv_3)
dim_leader_length_3 = Data(dim_leader_length)
join_16 = JoinCurves(Curves=flatten(existing_ground_crv_4), Preserve=False)  # -> graft(Curves)
vec_6 = VectorXYZ(XComponent=1, YComponent=1, ZComponent=0)  # -> Vector, Length
midpt_8 = CurveMiddle(Curve=join_16)
line_4 = LineSDL(Start=midpt_8, Direction=vec_6.Vector, Length=dim_leader_length_3)
end_18 = EndPoints(Curve=line_4)  # -> Start, End
X_7 = UnitX(Factor=1)
line_5 = LineSDL(Start=end_18.End, Direction=X_7, Length=dim_leader_length_3)
end_19 = EndPoints(Curve=line_5)  # -> Start, End
merge_49 = Merge(Data1=end_18.Start, Data2=end_18.End, Data3=end_19.End)
leader_2 = DefineLeader(Text="Existing ground profile", Points=merge_49)
dim_leader_3 = Data(leader_2)

# ---- group: Earthworks hatching _section
list_2 = ValueList({"SOLID", "Hatch1", "Hatch2", "Hatch3", "HatchDash", "Grid", "Grid60", "Plus", "Squares", "HSBDR3E0", "Earth", "Platform"}, selected="Earth")
hatch_circles = Curve(hatch_areas)
hatch_scale_4 = Data(hatch_scale_2)
hatch_2 = DefineHatch(Curve=hatch_circles, Pattern=list_2, Rotation=0, Scale=hatch_scale_4)
hatch_3 = Data(hatch_2)

# ---- group: Ground profile curve _visual / Existing ground crv _visual
crv_7 = Data(existing_ground_crv_3)
dashpt = Data(ground_level_dash_dist)
swatch_15 = ColourSwatch(SwatchColor=RGB(0, 158, 13))
dash_2 = DashPattern(Curve=crv_7, Pattern=dashpt)  # -> Dashes, Gaps
previewlw_4 = CustomPreviewLineweights(Geometry=dash_2.Dashes, Shader=swatch_15, Thickness=Slider(2, range=0..10), Absolute=False)

# ---- group: Ground profile curve _visual
bake_bool_8 = Data(bake_model_bool_2)
lay_11 = Data(panel_12)
createatts_14 = CreateAttributes(Name="Ground Profile Crv", LayerName=lay_11, PlotColor=swatch_15, enableFullPath=False)
bake_12 = BakeObject(ObjectAttributes=createatts_14, Bake=bake_bool_8)

# ---- group: Ground profile dim _visual / Existing Ground Profile leader _visual
swatch_16 = ColourSwatch(SwatchColor=RGB(0, 0, 0))
leader_3 = Data(dim_leader_3)
preview_19 = CustomPreview(Geometry=leader_3, Material=swatch_16)

# ---- group: Ground profile dim _visual
lay_12 = Data(panel_11)
bake_bool_9 = Data(bake_model_bool_2)
createatts_15 = CreateAttributes(Name="Ground Profile Dim", LayerName=lay_12, Color=swatch_16, PlotColor=swatch_16, enableFullPath=False)
bake_13 = BakeObject(ObjectAttributes=createatts_15, Bake=bake_bool_9, AllObjects_Object=leader_3)

# ---- group: Section Curve _visual / Proposed Terrain Section Crvs _visual
swatch_17 = ColourSwatch(SwatchColor=RGB(0, 0, 0))
section_crv_7 = Data(ground_section_crv)
preview_20 = CustomPreview(Geometry=section_crv_7, Material=swatch_17)

# ---- group: Earthworks Hatch _visual / Earthworks hatching _visual
swatch_18 = ColourSwatch(SwatchColor=RGB(194, 0, 0))
hatch_4 = Data(hatch_3)
preview_21 = CustomPreview(Geometry=hatch_4, Material=swatch_18)

# ---- group: Earthworks Hatch _visual
bake_bool_10 = Data(bake_model_bool_2)
lay_13 = Data(panel_12)
createatts_16 = CreateAttributes(Name="Earthworks Hatch", LayerName=lay_13, Color=swatch_18, PlotColor=swatch_18, enableFullPath=False)
bake_14 = BakeObject(ObjectAttributes=createatts_16, Bake=bake_bool_10, AllObjects_Object=preview_21)

# ---- group: Section Curve _visual
bake_bool_11 = Data(bake_model_bool_2)
lay_14 = Data(panel_12)
createatts_17 = CreateAttributes(Name="Section Curve", LayerName=lay_14, Color=swatch_17, PlotColor=swatch_17, enableFullPath=False)
bake_15 = BakeObject(ObjectAttributes=createatts_17, Bake=bake_bool_11, AllObjects_Object=preview_20)

# ---- group: Exclusion zone barrier dim _section
exclusion_zone_leader_length_2 = Data(exclusion_zone_leader_length)
exclusion_zone_barrier_crv = Data(exclusion_zone_barrier)
vec_7 = VectorXYZ(XComponent=1, YComponent=1, ZComponent=0)  # -> Vector, Length
midpt_9 = CurveMiddle(Curve=exclusion_zone_barrier_crv)
line_6 = LineSDL(Start=midpt_9, Direction=vec_7.Vector, Length=exclusion_zone_leader_length_2)
end_20 = EndPoints(Curve=line_6)  # -> Start, End
X_8 = UnitX(Factor=1)
panel_38 = Panel("""Contractor to provide appropriate
barrier to exclusion zones""")
line_7 = LineSDL(Start=end_20.End, Direction=X_8, Length=exclusion_zone_leader_length_2)
join_17 = JoinCurves(Curves=[line_6, line_7], Preserve=False)
explode_6 = Explode(Curve=join_17, Recursive=True)  # -> Segments, Vertices
leader_4 = DefineLeader(Text=panel_38, Points=explode_6.Vertices)

# ----
item_13 = ListItem(List=flatten(leader_4), Index=0, Wrap=True)

# ---- group: Exclusion zone barrier dim _section (continued)
L_3 = Data(item_13)

# ---- group: Exclusion zone barrier _visual / Exclusion zone barrier dim _visual
swatch_19 = ColourSwatch(SwatchColor=RGB(0, 0, 0))
dim_leader_4 = Data(L_3)
preview_22 = CustomPreview(Geometry=dim_leader_4, Material=swatch_19)

# ---- group: Exclusion zone barrier _visual
bake_bool_12 = Data(bake_model_bool_2)
lay_15 = Data(panel_11)
createatts_18 = CreateAttributes(Name="Exclusion Zone Barrier Dim", LayerName=lay_15, Color=swatch_19, PlotColor=swatch_19, enableFullPath=False)
bake_16 = BakeObject(ObjectAttributes=createatts_18, Bake=bake_bool_12, AllObjects_Object=preview_22)

# ---- group: Minor Contours _visual
location_4 = Data(graft(midpt_2))
text_6 = Data(major_contour_text_2)
colour_swatch_2 = ColourSwatch(SwatchColor=RGB(102, 102, 102))
geometry_2 = Data(curve)

# ----
lay_16 = Data(panel_10)
col_2 = Data(colour_swatch_2)
bool_6 = Data(bake_model_bool_2)
createatts_19 = CreateAttributes(Name="Contours", LayerName=lay_16, Color=col_2, PlotColor=col_2, Visibility=True, enableFullPath=False)
bake_17 = BakeObject(ObjectAttributes=createatts_19, Bake=bool_6, AllObjects_Object=[justifiedtext3d_2, preview_23])

# ---- group: Minor Contours _visual (continued)
justifiedtext3d_2 = JustifiedText3d(
    Location=location_4,
    Text=text_6,
    Size=Slider(2, range=0..100),
    Color=colour_swatch_2,
    HorizontalAlignment=1,
    VerticalAlginment=1,
    UseMeshes=False,
    Attributes=createatts_19,
    Bake=False)

# ----
preview_23 = CustomPreview(Geometry=geometry_2, Material=colour_swatch_2)

# ==== cluster RoundToIncrements: Round Number to nearst number on a multiplication table of factor
factor = ClusterInput()  # Rounding Factor
values = ClusterInput()  # Values to be Rounded
num = Number(factor)
num_2 = Number(values)
expression = Expression(x=num_2, y=num, Expression="y*Cint(x/y)")
num_3 = Number(expression)
rounded_values = ClusterOutput(num_3)
