# Grasshopper definition Automated_Piling_Platform.gh (Grasshopper 1.0.7)
# Copyright: Liljewall Arkitekter
# plug-ins: Human UI, Pufferfish, TbGh19, Human, LunchBox, MetaHopper, TT Toolbox

# ----
# Automated Working Platforms
# Toggle 'True' to run program
# An automated design tool for working platform
# drawing production and earthworks estimation.
# Product Owner: Benjamin Sayers
# Email: benjamin.sayers@costain.com
toggle = BooleanToggle(False)

spot_level_text_offset = Slider(0.7, range=0..1)
edge_zone = Slider(2, range=0..10)

grid_bubble_position = ValueList({"Start": 0, "End": 1, "Both": 2, "None": 3}, selected="End")
grid_bubble_position_2 = ValueList({"Start": 0, "End": 1, "Both": 2, "None": 3}, selected="Start")
grid_rotation = Slider(90, range=0..90)
grid_bubble_size = Slider(2, range=0..10)
grid_size = Slider(8, range=0..10)

# ---- group: Slope Gradient
_1_in = Slider(3, range=1..16)

# ---- group: Topsoil Scrape Parameters
topsoil_scrape_depth = Slider(0.2, range=0..1)
topsoil_scrape_gradient = Slider(3, range=0..10)

# ---- group: SOP Parameters
text_height = Slider(0.7, range=0..1)
text_offset = Slider(0.7, range=0..1)
point_size = Slider(0.6, range=0..1)

# ---- group: Earthworks Contour Parameters
earthworks_contours_on = ValueList({"Yes": 0, "No": 1}, selected="Yes")
major_contour_lines = Slider(1, range=0..1)
minor_contour_lines = Slider(0.1, range=0..0.1)

# ---- group: Site Contour Parameters
site_contours_on = ValueList({"Yes": 0, "No": 1}, selected="No")
major_contour_lines_2 = Slider(1, range=0..1)
minor_contour_lines_2 = Slider(0.1, range=0..0.1)

# ---- group: Panels
brep = Brep(simplify(Tree({0}: [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], {1}: [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], {2}: [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], {3}: [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], {4}: [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], {5}: [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]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)))

# ---- group: Differencers
brep_2 = Brep(simplify(Tree({0}: [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], {1}: [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], {2}: [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], {3}: [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], {4}: [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], {5}: [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]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)))

# ----
Z = UnitZ(Factor=1)

dam = DataDam(DataA=brep, DataB=brep_2, BufferDelay=10000000, BufferMode=0)  # -> DataA, DataB; disabled
c_recursive_boolean = CSharpScript(S=dam.DataA, D=dam.DataB)  # -> out, R, BB; inputs S: tree of Brep, D: tree of Brep; disabled
# ---------- c_recursive_boolean: C# ----------
    /////////////////////////////
    //written by Brian Washburn//
    //washburnarchitecture.com //
    //2018.06.06               //
    /////////////////////////////   

    double tolerance = doc.ModelAbsoluteTolerance;

    //declare dictionaries that work in parallel to hold the successful boolean results and
    //the unsuccessful boolean cutters
    var mainBrepsMT = new System.Collections.Concurrent.ConcurrentDictionary<GH_Path,Rhino.Geometry.Brep>();
    var badBrepsMT = new System.Collections.Concurrent.ConcurrentDictionary<GH_Path,List<Rhino.Geometry.Brep>>();

    //need to reserve a processor for GUI, otherwise we get a "Server Busy..." warning.
    //the booleaning still works, you would just have to click through the warning
    int totalMaxConcurrancy = System.Environment.ProcessorCount - 1;

    //tell us how many threads were using
    this.Component.Message = totalMaxConcurrancy + " threads";


    //start of the parallel engine
    System.Threading.Tasks.Parallel.ForEach(S.Paths, new System.Threading.Tasks.ParallelOptions
      { MaxDegreeOfParallelism = totalMaxConcurrancy},
      pth => {

      List<Rhino.Geometry.Brep> badBrep = new List<Rhino.Geometry.Brep>();
      List<Rhino.Geometry.Brep> goodBrep = new List<Rhino.Geometry.Brep>();
      Rhino.Geometry.Brep mainBrep = S.Branch(pth)[0];
      List<Rhino.Geometry.Brep> diffBreps = D.Branch(pth);

      //difference one cutter brep at a time from the main brep in the branch
      //this allows the boolean operation to continue without failing
      //and bad cutter breps can be discarded to a list that can be used for troubleshooting
      //haven't noticed a hit big hit on performance
      foreach (Rhino.Geometry.Brep b in diffBreps)
      {
        Rhino.Geometry.Brep[] breps = new Rhino.Geometry.Brep[]{};
        breps = Rhino.Geometry.Brep.CreateBooleanDifference(mainBrep, b, tolerance);
        if ((breps == null) || (breps.Length < 1))
        {
          badBrep.Add(b);
        }
        else
        {
          mainBrep = breps[0];
        }
      }
      mainBrepsMT[pth] = mainBrep;
      badBrepsMT[pth] = badBrep;
      });
    //end of the parallel engine

    //convert dictionaries to regular old data trees
    DataTree<Rhino.Geometry.Brep> mainBreps = new DataTree<Rhino.Geometry.Brep>();
    DataTree<Rhino.Geometry.Brep> badBreps = new DataTree<Rhino.Geometry.Brep>();

    foreach(KeyValuePair<GH_Path,Rhino.Geometry.Brep> p in mainBrepsMT)
    {
      mainBreps.Add(p.Value, p.Key);
    }

    foreach(KeyValuePair<GH_Path,List<Rhino.Geometry.Brep>> b in badBrepsMT)
    {
      badBreps.AddRange(b.Value, b.Key);
    }


    R = mainBreps;
    BB = badBreps;
# ---------- end c_recursive_boolean ----------
sdiff = SolidDifference(BrepsA=dam.DataA, BrepsB=dam.DataB)  # disabled
python__sdiff = PythonScript(x=dam.DataA, y=dam.DataB)  # -> out, a; inputs x: tree of Brep, y: tree of Brep; disabled
# ---------- python__sdiff: Python ----------
import rhinoscriptsyntax as rs
import ghpythonlib.components as ghcomp
import scriptcontext as sc
import Rhino
import ghpythonlib.parallel

#for accesing gh classes
import clr
clr.AddReference("Grasshopper")
from Grasshopper.Kernel.Data import GH_Path
from Grasshopper import DataTree

mytree = DataTree[Rhino.Geometry.Brep]()

for i in range(0,x.BranchCount,1):
    sub1 = x.Branches[i]
    ins1 = y.Branch(i)
    diff = []
    diff = Rhino.Geometry.Brep.CreateBooleanDifference(sub1,ins1,0.01)
    if diff: mytree.AddRange(diff)
a = mytree
# ---------- end python__sdiff ----------
python__sdiff_dk = PythonScript(x=dam.DataA, y=dam.DataB)  # -> out, a; inputs x: tree of Brep, y: tree of Brep; disabled
# ---------- python__sdiff_dk: Python ----------
import rhinoscriptsyntax as rs
import ghpythonlib.components as ghcomp
import scriptcontext as sc
import Rhino
import ghpythonlib.parallel

#for accesing gh classes
import clr
clr.AddReference("Grasshopper")
from Grasshopper.Kernel.Data import GH_Path
from Grasshopper import DataTree

mytree = DataTree[Rhino.Geometry.Brep]()


for i in range(0,x.BranchCount,1):
    myPath = GH_Path(i)
    sub1 = x.Branches[i]
    ins1 = y.Branch(i)
    diff = []
    diff = Rhino.Geometry.Brep.CreateBooleanDifference(sub1,ins1,0.01)
    if diff: mytree.AddRange(diff,myPath)
a = mytree
# ---------- end python__sdiff_dk ----------
geo = Geometry(c_recursive_boolean.R)
geo_2 = Geometry()  # disabled
geo_3 = Geometry()  # disabled
geo_4 = Geometry(sdiff)  # disabled
panel = Panel(sdiff)  # disabled
panel_2 = Panel(c_recursive_boolean.R)

num = Number(Slider(10, range=0..10))
c_script = CSharpScript(cut=num, fill=num, difference=num, reset=Button(), print=Toggle(False))  # -> out, geometries; inputs cut: Int32, fill: Int32, difference: Int32, reset: Boolean, print: Boolean
# ---------- c_script: C# usings ----------
using System.Linq;
using Rhino.DocObjects;
# ---------- c_script: C# ----------
    if(print){
      RhinoDoc.ActiveDoc.Objects.UnselectAll();
      string cmd = "!_-Text" +  cut + " _Enter";//"!_-Import " + "\"" + file + "\"" + " _Enter";
      Rhino.RhinoApp.RunScript(cmd, true);
    }

      /*
      var selectedObjs = RhinoDoc.ActiveDoc.Objects.GetSelectedObjects(false, false).ToList();
      geos = new List<GeometryBase>();
      foreach(RhinoObject selectedObj in selectedObjs){
      var geo = selectedObj.Geometry;
      geos.Add(geo);
      RhinoDoc.ActiveDoc.Objects.Delete(selectedObj, true);
      }
      }

      if(reset){
      geos.Clear();
      }


      geometries = geos;

      */
# ---------- c_script: C# additional code ----------
  private List<GeometryBase> geos = new List<GeometryBase>();
# ---------- end c_script ----------
textsty = TextStyle(Font={Bold=False, FontName="Arial", Italic=False}, Height=Slider(1, range=0..10))
pt = Point(<point referenced from the Rhino model>)
number_slider = Slider(5, range=0..100)

# ---- group: Fill Mesh Volume
M = Data()  # disabled
swatch = ColourSwatch(SwatchColor=RGB(217, 255, 244))  # disabled
mcol = MeshColours(Mesh=M, Colours=swatch)  # disabled

# ----
text = CreateText(Location=pt, Text="hello", Style=textsty, Justification=4)
tag = TextTag3D(Location=pt, Size=1, Justification=7)
txt = Text(text)
xy = XYPlane(Origin=Point(0, 0, 0))
Y = UnitY(Factor=1)
textsty_2 = TextStyle(Font={Bold=False, FontName="Arial", Italic=False}, Height=expr("x/1.5", number_slider))
button = CreateButton(ButtonName="Rest Imported Topo", ButtonStyle=0)
filepicker = CreateFilePicker(ButtonLabelText="Select DWG", DialogType=0, MustExist=True, Filter="All Files|*.*")
toggle_2 = CreateToggle(Default=False, OnLabel="Please toggle off!")
values = ValueListener(Elements=button, SomeProperty=True)  # -> Values, Indices
values_2 = ValueListener(Elements=toggle_2, SomeProperty=True)  # -> Values, Indices
values_3 = ValueListener(Elements=filepicker, SomeProperty=True)  # -> Values, Indices
number_slider_2 = Slider(5, range=0..10)
bool = Boolean(values_2.Values)
merge = Merge(Data1=flatten(filepicker), Data2=flatten(toggle_2), Data3=flatten(button))
stack = CreateStack(UIElements=flatten(merge), Horizontal=True)
path = FilePath(values_3.Values)
panel_3 = Panel(path)
c_script_2 = CSharpScript(file=path, import=bool, reset=values.Values)  # -> out, geometries; inputs file: String, import: Boolean, reset: Boolean
# ---------- c_script_2: C# ----------
    if(import){
      RhinoDoc.ActiveDoc.Objects.UnselectAll();
      string cmd = "!_-Import " + "\"" + file + "\"" + " _Enter";
      Rhino.RhinoApp.RunScript(cmd, false);
      var selectedObjs = RhinoDoc.ActiveDoc.Objects.GetSelectedObjects(false, false).ToList();
      geos = new List<GeometryBase>();
      foreach(RhinoObject selectedObj in selectedObjs){
        var geo = selectedObj.Geometry;
        geos.Add(geo);
        RhinoDoc.ActiveDoc.Objects.Delete(selectedObj, true);
      }
    }

    if(reset){
      geos.Clear();
    }


    geometries = geos;
# ---------- c_script_2: C# additional code ----------
  private List<GeometryBase> geos = new List<GeometryBase>();
# ---------- end c_script_2 ----------
dwg_import = Geometry(c_script_2.geometries)
expander = CreateExpander(UIElements=stack, Header="Import DWG Topo Surface", Open=True)

# ---- group: Human UI / Arial Font Types
choose_font = Slider(15, range=15..19)
fonts = FontTable()
item = ListItem(List=fonts, Index=choose_font, Wrap=True)
font_type = Panel(item)

# ----
panel_4 = Panel("""Manually Imported
DWG Import
None""")

# ---- group: Retaining Wall SOP Selection
filepicker_2 = CreateFilePicker(ButtonLabelText="Select CSV File", DialogType=0, MustExist=True, Filter="All Files|*.*")
values_4 = ValueListener(Elements=filepicker_2, SomeProperty=True)  # -> Values, Indices
csv = ReadCSV(CSVString=values_4.Values, Delimiter=",")  # -> Headers, Values
path_2 = FilePath(values_4.Values)
c_script_3 = CSharpScript(csvPath=path_2)  # -> out, T0Planes; inputs csvPath: String
# ---------- c_script_3: C# ----------
    // Read the contents of the CSV files as individual lines
    string[] csvLines = System.IO.File.ReadAllLines(csvPath);

    // List of origins
    var origins = new List<Point3d>();

    // Parse all lines
    for (int i = 1; i < csvLines.Length; i++) {
      string[] rowData = csvLines[i].Split(',');

      // CONTROLLER 0
      // ORIGIN
      double x = Convert.ToDouble(rowData[1]);
      double y = Convert.ToDouble(rowData[2]);
      double z = Convert.ToDouble(rowData[3]);
      
      Point3d origin0 = new Point3d(x, y, z);
      origins.Add(origin0);
     
      T0Planes = origins;

      /* X AXIS
      x = Convert.ToDouble(rowData[4]);
      y = Convert.ToDouble(rowData[5]);
      z = Convert.ToDouble(rowData[6]);
      Vector3d xAxis0 = new Vector3d(x, y, z);

      // Y AXIS
      x = Convert.ToDouble(rowData[7]);
      y = Convert.ToDouble(rowData[8]);
      z = Convert.ToDouble(rowData[9]);
      Vector3d yAxis0 = new Vector3d(x, y, z);

      // CONTROLLER 0 PLANE
      Plane pl0 = new Plane(origin0, xAxis0, yAxis0);
      controller0Planes.Add(pl0);

      // Triggers
      controller0TriggerPressed.Add(Convert.ToBoolean(rowData[10]));
      controller0TriggerClicked.Add(Convert.ToBoolean(rowData[11]));
      controller0TriggerValue.Add(Convert.ToDouble(rowData[12]));

      // Touchpad
      controller0TouchpadPressed.Add(Convert.ToBoolean(rowData[13]));
      controller0TouchpadClicked.Add(Convert.ToBoolean(rowData[14]));
      x = Convert.ToDouble(rowData[15]);
      y = Convert.ToDouble(rowData[16]);
      controller0TouchpadValues.Add(new Vector3d(x, y, 0));


      // CONTROLLER 1
      // ORIGIN
      x = Convert.ToDouble(rowData[17]);
      y = Convert.ToDouble(rowData[18]);
      z = Convert.ToDouble(rowData[19]);
      Point3d origin1 = new Point3d(x, y, z);

      // X AXIS
      x = Convert.ToDouble(rowData[20]);
      y = Convert.ToDouble(rowData[21]);
      z = Convert.ToDouble(rowData[22]);
      Vector3d xAxis1 = new Vector3d(x, y, z);

      // Y AXIS
      x = Convert.ToDouble(rowData[23]);
      y = Convert.ToDouble(rowData[24]);
      z = Convert.ToDouble(rowData[25]);
      Vector3d yAxis1 = new Vector3d(x, y, z);

      // CONTROLLER 0 PLANE
      Plane pl1 = new Plane(origin1, xAxis1, yAxis1);
      controller1Planes.Add(pl1);

      // Triggers
      controller1TriggerPressed.Add(Convert.ToBoolean(rowData[26]));
      controller1TriggerClicked.Add(Convert.ToBoolean(rowData[27]));
      controller1TriggerValue.Add(Convert.ToDouble(rowData[28]));

      // Touchpad
      controller1TouchpadPressed.Add(Convert.ToBoolean(rowData[29]));
      controller1TouchpadClicked.Add(Convert.ToBoolean(rowData[30]));
      x = Convert.ToDouble(rowData[31]);
      y = Convert.ToDouble(rowData[32]);
      controller1TouchpadValues.Add(new Vector3d(x, y, 0));
*/
    }

    /*/ Outputs
    Timestamps = timestamps;

    // Controller info
    T0Planes = controller0Planes;
    T0TriggerPressed = controller0TriggerPressed;
    T0TriggerClicked = controller0TriggerClicked;
    T0TriggerValue = controller0TriggerValue;
    T0TouchpadPressed = controller0TouchpadPressed;
    T0TouchpadClicked = controller0TouchpadClicked;
    T0TouchpadValues = controller0TouchpadValues;

    T1Planes = controller1Planes;
    T1TriggerPressed = controller1TriggerPressed;
    T1TriggerClicked = controller1TriggerClicked;
    T1TriggerValue = controller1TriggerValue;
    T1TouchpadPressed = controller1TouchpadPressed;
    T1TouchpadClicked = controller1TouchpadClicked;
    T1TouchpadValues = controller1TouchpadValues;*/
# ---------- end c_script_3 ----------
pt_2 = Point(c_script_3.T0Planes)
expander_2 = CreateExpander(UIElements=flatten(filepicker_2), Header="Use Pre-Determined CSV Coordinates", Open=True)
pline = PolyLine(Vertices=pt_2, Closed=True)

# ----
csv_input_curve = Curve(pline)
panel_5 = Panel("""Manually Selected
CSV Import
None""")

# ---- group: Human UI / Rhino Geom / Select Topo Surface
pickbtn = CreateRhinoPickButton(ButtonName="Select Topo", Prompt="Select Rhino Geometry", AllowMultiple=False, AllowNone=True, Type=1, ButtonStyle=0)

# ---- group: Human UI / Rhino Geom / Select Spot Level Locations
pickbtn_2 = CreateRhinoPickButton(
    ButtonName="Select Spot Level Points",
    Prompt="Select Rhino Geometry",
    AllowMultiple=True,
    AllowNone=True,
    Type=4,
    ButtonStyle=0)

# ---- group: Human UI / Rhino Geom / Select Rhino Crv
pickbtn_3 = CreateRhinoPickButton(ButtonName="Select Polyline", Prompt="Select Rhino Geometry", AllowMultiple=False, AllowNone=True, Type=2, ButtonStyle=0)

# ---- group: Human UI / Rhino Geom
button_2 = CreateButton(ButtonName="Reset", ButtonStyle=0)

# ---- group: Human UI / Earthworks Volumes / Total +/- Volumes
dummy_text = Panel("Total Volume +/-:")
label = CreateLabel(LabelText=dummy_text, LabelSize=12, Justification=0)

# ---- group: Human UI / Earthworks Volumes / Fill Volume Text
dummy_text_2 = Panel("Fill Volume:")
label_2 = CreateLabel(LabelText=dummy_text_2, LabelSize=12, Justification=0)

# ----
pulldown = CreatePulldownMenu(ListItems=panel_4, SelectedIndex=2, showLabel=True)
pulldown_2 = CreatePulldownMenu(ListItems=panel_5, SelectedIndex=2, showLabel=True)

# ---- group: Human UI / Rhino Geom
values_5 = ValueListener(Elements=pickbtn_3, SomeProperty=True)  # -> Values, Indices
values_6 = ValueListener(Elements=pickbtn_2, SomeProperty=True)  # -> Values, Indices
values_7 = ValueListener(Elements=pickbtn, SomeProperty=True)  # -> Values, Indices
crv = Curve(values_5.Values)
pt_3 = Point(values_6.Values)
brep_3 = Brep(values_7.Values)

# ----
brep_4 = Brep(brep_3)
manual_select_curve = Curve(crv)

# ---- group: Human UI / Earthworks Volumes / Cut Volume Text
dummy_text_3 = Panel("Cut Volume: ")
label_3 = CreateLabel(LabelText=dummy_text_3, LabelSize=12, Justification=0)

# ---- group: Human UI / Window Size
panel_height = Slider(0.75, range=0..1)
panel_width = Slider(3, range=0..10)
getscreen = GetScreenDimensions()  # -> Width, Height
multiplication = Multiplication(A=getscreen.Height, B=panel_height)
division = Division(A=getscreen.Width, B=panel_width)

# ----
subtraction = Subtraction(A=division, B=Slider(38, range=0..100))
values_8 = ValueListener(Elements=pulldown, SomeProperty=True)  # -> Values, Indices
values_9 = ValueListener(Elements=pulldown_2, SomeProperty=True)  # -> Values, Indices
toggle_3 = CreateToggle(Default=False, Label="Export 2D DWG for XREF", OnLabel="Toggle me off!")

# ---- group: Human UI / Bake Geometry
button_3 = CreateButton(ButtonName="Bake Geometry", ButtonStyle=0)
horizontal_alignment = ValueList({"Left": 0, "Center": 1, "Right": 2}, selected="Center")
expander_3 = CreateExpander(UIElements=toggle_3, Header="Export DWG", Open=True)
adjustpos = AdjustElementPositioning(
    ElementsToAdjust=[button_3, toggle_3],
    Margin=Slider(10, range=0..100),
    AbsolutePositioning=False,
    Width=Slider(213, range=0..1000),
    HorizontalAlignment=horizontal_alignment)

# ---- group: Human UI / Retaining Wall SOP Selection
textbox = CreateTextBox(Label="Enter SOP Number", DefaultText="1,2,3", UpdateButton=True, showLabel=True)
values_10 = ValueListener(Elements=textbox, SomeProperty=True)  # -> Values, Indices
csv_2 = ReadCSV(CSVString=values_10.Values, Delimiter=",")  # -> Headers, Values
expander_4 = CreateExpander(UIElements=flatten(textbox), Header="Set Retaining Wall SOPs", Open=True)

# ---- group: Human UI / Drawing / Edge Zone / Cull Edge Zone Edges
textbox_2 = CreateTextBox(Label="Remove Edge Zone", DefaultText="1,2,3", UpdateButton=True, showLabel=True)
values_11 = ValueListener(Elements=textbox_2, SomeProperty=True)  # -> Values, Indices
csv_3 = ReadCSV(CSVString=values_11.Values, Delimiter=",")  # -> Headers, Values

# ----
python = GhPythonScript(x=values_8.Values)  # -> out, a
# ---------- python: Python ----------
__author__ = "bensay"
__version__ = "2021.05.06"

import rhinoscriptsyntax as rs

if x == "Manually Imported":
    a = 0
elif x == "DWG Import":
    a = 1
elif x == "None":
    a = 2
# ---------- end python ----------
topo_selection_gate = Number(python.a)
filter = StreamFilter(Gate=topo_selection_gate, Stream0=brep_4, Stream1=dwg_import)
python_2 = GhPythonScript(x=values_9.Values)  # -> out, a
# ---------- python_2: Python ----------
__author__ = "bensay"
__version__ = "2021.05.06"

import rhinoscriptsyntax as rs

if x == "Manually Selected":
    a = 0
elif x == "CSV Import":
    a = 1
elif x == "None":
    a = 2
# ---------- end python_2 ----------
crv_select_filter_gate = Number(python_2.a)
filter_2 = StreamFilter(Gate=crv_select_filter_gate, Stream0=manual_select_curve, Stream1=csv_input_curve)

# ---- group: Input Crv/Srf
brep_5 = Brep(brep_3)
crv_2 = Curve(filter_2)

# ---- group: Display Terrain
G = Data(brep_5)
preview = CustomPreview(Geometry=G, Material=ColourSwatch(SwatchColor=RGBA(63, 128, 171, 106)))

# ----
explode = Explode(Curve=crv_2, Recursive=True)  # -> Segments, Vertices

# ---- group: Offset Vector
crv_3 = Data(crv_2)
project = Project(Geometry=crv_3, Plane=PlaneXY(0, 0, 0))  # -> Geometry, Transform
offset_l = OffsetCurveLoose(Curve=project.Geometry, Distance=1)
cp = ControlPoints(Curve=offset_l)  # -> Points, Weights, Knots
cp_2 = ControlPoints(Curve=project.Geometry)  # -> Points, Weights, Knots
cp_3 = ControlPoints(Curve=crv_3)  # -> Points, Weights, Knots
cullduppoints = RemoveDuplicatePoints(InputPoints=cp_2.Points, Tolerance=0.001)  # -> OutputPoints, FirstPointIndexes
cullduppoints_2 = RemoveDuplicatePoints(InputPoints=cp.Points, Tolerance=0.001)  # -> OutputPoints, FirstPointIndexes
cullduppoints_3 = RemoveDuplicatePoints(InputPoints=cp_3.Points, Tolerance=0.001)  # -> OutputPoints, FirstPointIndexes
clean = CleanTree(RemoveNulls=True, RemoveInvalid=True, RemoveEmpty=True, Tree=cullduppoints.OutputPoints)
clean_2 = CleanTree(RemoveNulls=True, RemoveInvalid=True, RemoveEmpty=True, Tree=cullduppoints_2.OutputPoints)
clean_3 = CleanTree(RemoveNulls=True, RemoveInvalid=True, RemoveEmpty=True, Tree=cullduppoints_3.OutputPoints)
ln = Line(StartPoint=clean, EndPoint=clean_2)
move2pt = MoveToPoint(Geometry=ln, PointA=clean, PointB=clean_3)  # -> Moved, Vector, Transform
end = EndPoints(Curve=move2pt.Moved)  # -> Start, End
vec2pt = Vector2Pt(PointA=end.Start, PointB=end.End, Unitize=False)  # -> Vector, Length
vdis = VectorDisplay(Anchor=end.Start, Vector=vec2pt.Vector)
offste_vector = Data(vec2pt.Vector)

# ----
project_2 = ProjectPoint(Point=explode.Vertices, Direction=expr("-x", Z), Geometry=brep_5)  # -> Point, Index
project_3 = ProjectPoint(Point=explode.Vertices, Direction=Z, Geometry=brep_5)  # -> Point, Index

_3d_preview_input_crv = Data(crv_2)
previewlw = CustomPreviewLineweights(Geometry=_3d_preview_input_crv, Shader=ColourSwatch(SwatchColor=RGB(0, 0, 0)), Absolute=False)

dist = Distance(PointA=explode.Vertices, PointB=project_3.Point)
dist_2 = Distance(PointA=explode.Vertices, PointB=project_2.Point)

# ---- group: Create Working Platform
B = Data(crv_2)
Z_2 = UnitZ(Factor=Slider(0.7, range=0..10))
extr = Extrude(Base=B, Direction=expr("-x", Z_2))
capex = CapHolesEx(Brep=extr)  # -> Brep, Caps, Solid
B_2 = Data(capex.Brep)

# ----
panel_6 = Panel(dist_2)
panel_7 = Panel(dist)

# ---- group: Site Contours
topo_srf = Data(G)
bool_2 = Data()
filter_3 = StreamFilter(Gate=bool_2, Stream0=topo_srf)

# ----
entwine = Entwine(Branch00=dist, Branch01=dist_2, FlattenInputs=True)

# ---- group: Site Contours / Minor Contours
minor_size = Data(minor_contour_lines_2)
topo_srf_2 = Data(filter_3)
contour = Contour(Shape=topo_srf_2, Point=Point(0, 0, 0), Direction=Vector(0, 0, 1), Distance=minor_size)
series = Series(Start=0, Step=1, Count=10)
dash = DashPattern(Curve=contour, Pattern=series)  # -> Dashes, Gaps
previewlw_2 = CustomPreviewLineweights(Geometry=dash.Dashes, Shader=ColourSwatch(SwatchColor=RGBA(209, 209, 209, 86)), Absolute=False)

# ----
sort = SortList(Keys=flatten(entwine))  # -> reverse(Keys), ValuesA

# ---- group: Site Contours / Major Contours
major_size = Data(major_contour_lines_2)
topo_srf_3 = Data(filter_3)
contour_2 = Contour(Shape=topo_srf_3, Point=Point(0, 0, 0), Direction=Vector(0, 0, 1), Distance=major_size)
preview_2 = CustomPreview(Geometry=contour_2, Material=ColourSwatch(SwatchColor=RGB(255, 255, 255)))

# ----
item_2 = ListItem(List=sort.Keys, Index=0, Wrap=True)
larger = LargerThan(FirstNumber=item_2, SecondNumber=Slider(10, range=0..10))  # -> flatten(LargerThan), OrEqualTo
clean_4 = CleanTree(RemoveNulls=True, RemoveInvalid=True, RemoveEmpty=invert(False), Tree=larger.LargerThan)
python_3 = GhPythonScript(x=clean_4)  # -> out, a
# ---------- python_3: Python ----------
__author__ = "bensay"
__version__ = "2021.05.06"

import rhinoscriptsyntax as rs

if x == True:
    a = "There is at least one SOP that exceeds +10m Elevation from the topo surface."
else:
    a = ""
# ---------- end python_3 ----------

# ---- group: No Go Zone / Create No Go Zone
G_2 = Data(crv_2)
D = Data(edge_zone)
data = Data(csv_3.Headers)
project_4 = Project(Geometry=G_2, Plane=PlaneXY(0, 0, 0))  # -> Geometry, Transform
explode_2 = Explode(Curve=project_4.Geometry, Recursive=True)  # -> graft(Segments), Vertices
offset = OffsetCurve(Curve=explode_2.Segments, Distance=expr("-x", D), Plane=PlaneXY(0, 0, 0), Corners=1)
offset_2 = OffsetCurve(Curve=explode_2.Segments, Distance=D, Plane=PlaneXY(0, 0, 0), Corners=1)
len = Length(Curve=offset_2)
len_2 = Length(Curve=offset)
merge_2 = Merge(Data1=len, Data2=len_2)
merge_3 = Merge(Data1=offset_2, Data2=offset)
sort_2 = SortList(Keys=merge_2, ValuesA=merge_3)  # -> Keys, ValuesA
item_3 = ListItem(List=sort_2.ValuesA, Index=0, Wrap=True)
merge_4 = Merge(Data1=simplify(explode_2.Segments), Data2=simplify(item_3))
loft = Loft(Curves=merge_4, Options={Adjust=False, Closed=False, LoftEnds=0, LoftSimp=0, LoftType=0, Rebuild=10, Refit=0.01})
data_2 = Data(data)
cull_i = CullIndex(List=flatten(loft), Indices=flatten(data_2), Wrap=True)  # -> reverse(List)
runion = RegionUnion(Curves=flatten(cull_i))
R = Data(runion)

# ---- group: Move Points in Z Direction
G_3 = Data(clean_3)
G_4 = Data(brep_5)
Z_3 = UnitZ(Factor=expr("-x", 1))
project_5 = ProjectPoint(Point=G_3, Direction=Z_3, Geometry=G_4)  # -> Point, Index
dist_3 = Distance(PointA=G_3, PointB=project_5.Point)
sort_3 = SortList(Keys=dist_3)  # -> reverse(Keys), ValuesA
item_4 = ListItem(List=flatten(sort_3.Keys), Index=0, Wrap=True)
Z_4 = UnitZ(Factor=expr("-x", item_4))
move = Move(Geometry=G_3, Motion=expr("x*2", Z_4))  # -> Geometry, Transform
i = Data(item_4)
G_5 = Data(move.Geometry)

# ----
Z_5 = UnitZ(Factor=item_4)
move_2 = Move(Geometry=G_3, Motion=expr("x*2", Z_5))  # -> Geometry, Transform

# ---- group: Offset Points Out
A = Data(i)
B_3 = Data(_1_in)
V = Data(offste_vector)
multiplication_2 = Multiplication(A=A, B=B_3)
amp = Amplitude(Vector=V, Amplitude=multiplication_2)
V_2 = Data(amp)

# ---- group: Replace Gradient Vectors w/ Retaining Wall
L = Data(V_2)
retaining_wall_sops = Data(csv_2.Headers)
panel_8 = Panel(retaining_wall_sops)
vec = VectorXYZ(XComponent="0", YComponent="0", ZComponent="0")  # -> Vector, Length
replace = ReplaceItems(List=L, Item=vec.Vector, Indices=panel_8, Wrap=False)
L_2 = Data(replace)

# ----
i_2 = Data(item_4)
G_6 = Data(move_2.Geometry)

# ---- group: No Go Zone / Hatch
hatch_scale = Slider(2, range=0..10)
C = Data(R)
hatchtable = HatchTable(Update=True)
item_5 = ListItem(List=hatchtable, Index=Slider(1, range=0..10), Wrap=True)
createhatch = CreateHatch(Bake=False, Curves=C, HatchPatternName=item_5, HatchScale=hatch_scale, HatchRotation=0)  # -> HatchGeometry, HatchObjects
hg = Data(createhatch.HatchGeometry)

# ---- group: Move Points w/ Appropritate Vector
G_7 = Data(G_5)
T = Data(L_2)
move_3 = Move(Geometry=G_7, Motion=T)  # -> Geometry, Transform
G_8 = Data(move_3.Geometry)

G_9 = Data(G_6)
T_2 = Data(L_2)
move_4 = Move(Geometry=G_9, Motion=T_2)  # -> Geometry, Transform
G_10 = Data(move_4.Geometry)

# ----
panel_9 = Panel(L_2)

# ---- group: Create Fill Volume
V_3 = Data(clean_3)
V_4 = Data(G_8)
pline_2 = PolyLine(Vertices=V_3, Closed=True)
pline_3 = PolyLine(Vertices=V_4, Closed=True)
loft_2 = Loft(
    Curves=flatten([pline_3, pline_2]),
    Options={Adjust=False, Closed=False, LoftEnds=0, LoftSimp=0, LoftType=0, Rebuild=10, Refit=0.01})
capex_2 = CapHolesEx(Brep=loft_2)  # -> Brep, Caps, Solid
B_4 = Data(capex_2.Brep)

V_5 = Data(clean_3)
V_6 = Data(G_10)
pline_4 = PolyLine(Vertices=V_5, Closed=True)
pline_5 = PolyLine(Vertices=V_6, Closed=True)
loft_3 = Loft(
    Curves=flatten([pline_5, pline_4]),
    Options={Adjust=False, Closed=False, LoftEnds=0, LoftSimp=0, LoftType=0, Rebuild=10, Refit=0.01})
capex_3 = CapHolesEx(Brep=loft_3)  # -> Brep, Caps, Solid
B_5 = Data(capex_3.Brep)

# ---- group: No Go Zone / Display No Go Zone
G_11 = Data(R)
G_12 = Data(hg)
previewlw_3 = CustomPreviewLineweights(Geometry=[G_11, G_12], Shader=ColourSwatch(SwatchColor=RGB(255, 0, 0)), Absolute=False)

# ---- group: Fill Intersection Crv
A_2 = Data(B_5)
B_6 = Data(brep_5)
bbx = BrepBrep(BrepA=A_2, BrepB=B_6)  # -> Curves, Points
project_6 = Project(Geometry=bbx.Curves, Plane=PlaneXY(0, 0, 0))  # -> Geometry, Transform
G_13 = Data(project_6.Geometry)

# ---- group: Display Fill Extents
G_14 = Data(G_13)
previewlw_4 = CustomPreviewLineweights(Geometry=G_14, Shader=ColourSwatch(SwatchColor=RGB(0, 0, 0)), Absolute=False)

# ---- group: Fill Intersection Crv
A_3 = Data(B_4)
B_7 = Data(brep_5)
bbx_2 = BrepBrep(BrepA=A_3, BrepB=B_7)  # -> Curves, Points
project_7 = Project(Geometry=bbx_2.Curves, Plane=PlaneXY(0, 0, 0))  # -> Geometry, Transform
G_15 = Data(project_7.Geometry)

# ----
cls = Closed(Curve=bbx_2.Curves)  # -> Closed, Periodic
cls_2 = Closed(Curve=bbx.Curves)  # -> Closed, Periodic
python_4 = GhPythonScript(x=cls.Closed, y=cls_2.Closed)  # -> out, a
# ---------- python_4: Python ----------
__author__ = "bensay"
__version__ = "2021.05.04"

import rhinoscriptsyntax as rs

if x == True and y == True:
    a = "This calculation will be successful!"
else:
    a = "The extents of the working platform exceeds the extents of the topo surface. Please provide a larger topo surface or reduce the size of the working platform."
# ---------- end python_4 ----------
panel_10 = Panel(python_4.a)

# ---- group: Display Fill Extents
G_16 = Data(G_15)
previewlw_5 = CustomPreviewLineweights(Geometry=G_16, Shader=ColourSwatch(SwatchColor=RGB(0, 0, 0)), Absolute=False)

# ---- group: Bounding Box
D_2 = Data(grid_rotation)
d1 = Data(G_13)
d2 = Data(G_15)
rad = Radians(Degrees=D_2)
xy_2 = XYPlane(Origin=Point(0, 0, 0))
merge_5 = Merge(Data1=d1, Data2=d2)
prot = RotatePlane(Plane=xy_2, Angle=rad)
bbox = BoundingBox(Content=merge_5, Plane=prot, UnionBox=True)  # -> Box, Box_2
B_8 = Data(bbox.Box)

# ---- group: Define Grid Axis
rec = Data(B_8)
rec_2 = Rectangle(rec)
explode_3 = Explode(Curve=rec_2, Recursive=True)  # -> Segments, Vertices
item_6 = ListItem(List=explode_3.Segments, Index=0, Wrap=True)  # -> Item, Item1
x_axis = Curve(item_6.Item)
rec_3 = Data(rec_2)
y_axis = Curve(item_6.Item1)

# ---- group: Y Axis Grid Lines
l1 = Data(grid_size)
C_2 = Data(x_axis)
C_3 = Data(y_axis)
P = Data(rec_3)
midpt = CurveMiddle(Curve=C_3)
pcen = PolygonCenter(Polyline=P)  # -> CenterV, CenterE, CenterA
len_3 = Length(Curve=C_2)
vec2pt_2 = Vector2Pt(PointA=midpt, PointB=pcen.CenterV, Unitize=False)  # -> Vector, Length
division_2 = Division(A=len_3, B=l1)
amp_2 = Amplitude(Vector=vec2pt_2.Vector, Amplitude=l1)
round = Round(Number=division_2)  # -> Nearest, Floor, Ceiling
arrlinear = LinearArray(Geometry=C_3, Direction=amp_2, Count=expr("x+1", round.Nearest))  # -> Geometry, Transform
ext = ExtendCurve(Curve=arrlinear.Geometry, Type=0, Start=l1, End=l1)
C_4 = Data(ext)

# ---- group: X Axis Grid Lines
l1_2 = Data(grid_size)
C_5 = Data(y_axis)
C_6 = Data(x_axis)
P_2 = Data(rec_3)
midpt_2 = CurveMiddle(Curve=C_6)
pcen_2 = PolygonCenter(Polyline=P_2)  # -> CenterV, CenterE, CenterA
len_4 = Length(Curve=C_5)
vec2pt_3 = Vector2Pt(PointA=midpt_2, PointB=pcen_2.CenterV, Unitize=False)  # -> Vector, Length
division_3 = Division(A=len_4, B=l1_2)
amp_3 = Amplitude(Vector=vec2pt_3.Vector, Amplitude=l1_2)
round_2 = Round(Number=division_3)  # -> Nearest, Floor, Ceiling
arrlinear_2 = LinearArray(Geometry=C_6, Direction=amp_3, Count=expr("x+1", round_2.Nearest))  # -> Geometry, Transform
ext_2 = ExtendCurve(Curve=arrlinear_2.Geometry, Type=0, Start=l1_2, End=l1_2)
C_7 = Data(ext_2)

# ----
panel_11 = Panel(panel_10)
panel_12 = Panel(python_3.a)
cls_3 = Closed(Curve=filter_2)  # -> Closed, Periodic

# ---- group: X Axis Dim
L_3 = Data(C_4)
item_7 = ListItem(List=L_3, Index=0, Wrap=True)  # -> Item1, Item
end_2 = EndPoints(Curve=item_7.Item1)  # -> Start, End
end_3 = EndPoints(Curve=item_7.Item)  # -> Start, End
aligndim = AlignedDimension(Plane=PlaneXY(0, 0, 0), PointA=end_2.Start, PointB=end_3.Start, Offset=1, Text="{0:0.00}", Size=1)

# ---- group: Y A xis Dim
L_4 = Data(C_7)
item_8 = ListItem(List=L_4, Index=0, Wrap=True)  # -> Item1, Item
end_4 = EndPoints(Curve=item_8.Item1)  # -> Start, End
end_5 = EndPoints(Curve=item_8.Item)  # -> Start, End
aligndim_2 = AlignedDimension(Plane=PlaneXY(0, 0, 0), PointA=end_4.End, PointB=end_5.End, Offset=1, Text="{0:0.00}", Size=1)

# ----
python_5 = GhPythonScript(curveClosed=cls_3.Closed)  # -> out, message, bool
# ---------- python_5: Python ----------
__author__ = "bensay"
__version__ = "2021.05.04"

import rhinoscriptsyntax as rs

if curveClosed == True:
    message = "This calculation will be successful!"
    bool = True
elif curveClosed == False:
    message = "The polyline input for the platform edge is not closed. Please provide a closed polyine."
    bool = False
else:
    message = ""
    bool = ""
# ---------- end python_5 ----------
panel_13 = Panel(cls_3.Closed)
bool_3 = Boolean(invert(python_5.bool))
panel_14 = Panel(python_5.message)
dummy_text_4 = Panel(panel_14)
merge_6 = Merge(Data1=flatten(dummy_text_4), Data2=flatten(panel_11), Data3=flatten(panel_12))  # -> graft(Result)
panel_15 = Panel(bool_3)

# ---- group: Grid Line Filte
G_17 = Data(grid_bubble_position_2)
C_8 = Data(C_7)
end_6 = EndPoints(Curve=C_8)  # -> Start, End
filter_4 = StreamFilter(Gate=G_17, Stream0=end_6.Start, Stream1=end_6.End, Stream2=[end_6.Start, end_6.End])
s_0 = Data(filter_4)

# ----
tb = CreateTextBlock(Text=merge_6, TextSize=12, Justification=1)

# ---- group: Grid Line Filter
G_18 = Data(grid_bubble_position)
C_9 = Data(C_4)
end_7 = EndPoints(Curve=C_9)  # -> Start, End
filter_5 = StreamFilter(Gate=G_18, Stream0=end_7.Start, Stream1=end_7.End, Stream2=[end_7.Start, end_7.End])
s_1 = Data(filter_5)

# ----
stack_2 = CreateStack(UIElements=tb, Horizontal=True)
adjustelem = AdjustElementAppearance(ElementsToAdjust=tb, Foreground=ColourSwatch(SwatchColor=RGB(255, 0, 0)))

# ---- group: X Axis Grid Numbering
L_5 = Data(s_0)
lng = ListLength(List=L_5)
series_2 = Series(Start=0, Step=1, Count=lng)  # -> reverse(Series)
tag_2 = TextTag3D(Location=L_5, Text=series_2, Size=Slider(1, range=0..10), Colour=ColourSwatch(SwatchColor=RGB(0, 0, 0)), Justification=5)

# ---- group: X Axis Grid Lines
C_10 = Data(C_7)
series_3 = Series(Start=0, Step=1, Count=Slider(3, range=0..10))
dash_2 = DashPattern(Curve=C_10, Pattern=series_3)  # -> Dashes, Gaps
previewlw_6 = CustomPreviewLineweights(Geometry=dash_2.Dashes, Shader=ColourSwatch(SwatchColor=RGB(0, 0, 0)), Absolute=False)

# ---- group: Y Axis Grid Lines
C_11 = Data(C_4)
series_4 = Series(Start=0, Step=1, Count=Slider(3, range=0..10))
dash_3 = DashPattern(Curve=C_11, Pattern=series_4)  # -> Dashes, Gaps
previewlw_7 = CustomPreviewLineweights(Geometry=dash_3.Dashes, Shader=ColourSwatch(SwatchColor=RGB(0, 0, 0)), Absolute=False)

# ---- group: Grid Bubbles
P_3 = Data(s_0)
P_4 = Data(s_1)
R_2 = Data(grid_bubble_size)
cir = Circle(Plane=P_3, Radius=R_2)
cir_2 = Circle(Plane=P_4, Radius=R_2)
merge_7 = Merge(Data1=cir, Data2=cir_2)
previewlw_8 = CustomPreviewLineweights(Geometry=merge_7, Shader=ColourSwatch(SwatchColor=RGB(0, 0, 0)), Absolute=False)

# ---- group: Y Axis Numbering
pt_4 = Point(s_1)
lng_2 = ListLength(List=pt_4)
charseq = CharSequence(Count=lng_2, CharPool="ABCDEFGHIJKLMNOPQRSTUVWXYZ", Format="{0}")  # -> reverse(Sequence)
tag_3 = TextTag3D(Location=pt_4, Text=charseq, Size=Slider(1, range=0..10), Colour=ColourSwatch(SwatchColor=RGB(0, 0, 0)), Justification=5)

# ---- group: Sections / Section AA Plane
L_6 = Data(C_7)
lng_3 = ListLength(List=L_6)
division_4 = Division(A=lng_3, B=2)
round_3 = Round(Number=division_4)  # -> Nearest, Floor, Ceiling
item_9 = ListItem(List=L_6, Index=expr("x-1", round_3.Nearest), Wrap=True)
midpt_3 = CurveMiddle(Curve=item_9)
xz = XZPlane(Origin=Point(0, 0, 0))
pl_origin = PlaneOrigin(Base=xz, Origin=midpt_3)

# ---- group: Sections / Section BB Plane
L_7 = Data(C_4)
lng_4 = ListLength(List=L_7)
division_5 = Division(A=lng_4, B=2)
round_4 = Round(Number=division_5)  # -> Nearest, Floor, Ceiling
item_10 = ListItem(List=L_7, Index=expr("x-1", round_4.Nearest), Wrap=True)
midpt_4 = CurveMiddle(Curve=item_10)
yz = YZPlane(Origin=Point(0, 0, 0))
pl_origin_2 = PlaneOrigin(Base=yz, Origin=midpt_4)

# ---- group: SOPs / SOP Plane
crv_4 = Data(crv_2)
xy_3 = XYPlane(Origin=Point(0, 0, 0))
disc = Discontinuity(Curve=crv_4, Level=1)  # -> Points, Parameters
pl_origin_3 = PlaneOrigin(Base=xy_3, Origin=disc.Points)
P_5 = Data(xy_3)
pl = Data(pl_origin_3)
P_6 = Data(disc.Points)

# ---- group: Spot Levels / Get Spot Level Heights
Z_6 = UnitZ(Factor=expr("-x", 1))
pt_5 = Point(pt_3)
G_19 = Data(B_4)
G_20 = Data(brep_5)
project_8 = ProjectPoint(Point=pt_5, Direction=Z_6, Geometry=G_19)  # -> Point, Index
project_9 = ProjectPoint(Point=project_8.Point, Direction=Z_6, Geometry=G_20)  # -> Point, Index
dist_4 = Distance(PointA=project_8.Point, PointB=project_9.Point)
D_3 = Data(dist_4)
P_7 = Data(project_8.Point)

# ---- group: SOPs / SOP Coords
P_8 = Data(pl)
deplane = DeconstructPlane(Plane=P_8)  # -> Origin, XAxis, YAxis, ZAxis
pdecon = Deconstruct(Point=deplane.Origin)  # -> XComponent, YComponent, ZComponent
X = Data(pdecon.XComponent)
Y_2 = Data(pdecon.YComponent)
Z_7 = Data(pdecon.ZComponent)

# ---- group: SOPs / Create SOP Tag
F = Data(text_offset)
G_21 = Data(pl)
H = Data(text_height)
L_8 = Data(P_6)
X_2 = UnitX(Factor=F)
move_5 = Move(Geometry=G_21, Motion=X_2)  # -> Geometry, Transform
Y_3 = UnitY(Factor=F)
lng_5 = ListLength(List=L_8)
move_6 = Move(Geometry=move_5.Geometry, Motion=Y_3)  # -> Geometry, Transform
series_5 = Series(Start=0, Step=1, Count=lng_5)
lng_6 = ListLength(List=series_5)
repeat = RepeatData(Data="SOP ", Length=lng_6)
data_3 = Data(flatten(repeat))
data_4 = Data(flatten(series_5))
pdecon_2 = Deconstruct(Point=move_6.Geometry)  # -> XComponent, YComponent, ZComponent
merge_8 = Merge(Data1=graft(data_3), Data2=graft(data_4))
pt_6 = ConstructPoint(XCoordinate=pdecon_2.XComponent, YCoordinate=pdecon_2.YComponent, ZCoordinate=0)  # -> graft(Point)
join = TextJoin(Text=merge_8)

# ---- group: Spot Levels / Create Spot Level Tags
L_9 = Data(D_3)
lng_7 = ListLength(List=L_9)
repeat_2 = RepeatData(Data="+ ", Length=lng_7)
repeat_3 = RepeatData(Data=" m", Length=lng_7)
round_5 = RoundToIncrements(values=L_9, factor=0.01)
merge_9 = Merge(Data1=simplify(graft(repeat_2)), Data2=simplify(graft(round_5)), Data3=simplify(graft(repeat_3)))  # -> simplify(Result)
join_2 = TextJoin(Text=merge_9)
T_3 = Data(join_2)

# ---- group: SOPs / Create SOP Geom
F_2 = Data(point_size)
P_9 = Data(pl)
X_3 = UnitX(Factor=expr("x*1.5", F_2))
Y_4 = UnitY(Factor=expr("x*1.5", F_2))
pt_7 = Point(P_9)
move_7 = Move(Geometry=pt_7, Motion=expr("-x", X_3))  # -> Geometry, Transform
move_8 = Move(Geometry=pt_7, Motion=expr("-x", Y_4))  # -> Geometry, Transform
move_9 = Move(Geometry=pt_7, Motion=X_3)  # -> Geometry, Transform
move_10 = Move(Geometry=pt_7, Motion=Y_4)  # -> Geometry, Transform
cir_3 = Circle(Plane=P_9, Radius=F_2)
ln_2 = Line(StartPoint=move_9.Geometry, EndPoint=move_7.Geometry)
ln_3 = Line(StartPoint=move_10.Geometry, EndPoint=move_8.Geometry)
merge_10 = Merge(Data1=cir_3, Data2=ln_2, Data3=ln_3)
crv_5 = Curve(merge_10)

# ---- group: SOPs / SOP Coords
sop = Panel(series_5)
panel_16 = Panel("Schedule Title")
panel_17 = Panel("SOP ")
easting_m = Panel(X)
panel_18 = Panel("Easting (m)")
northing_m = Panel(Y_2)
panel_19 = Panel("Northing (m)")
elevatoin_m = Panel(Z_7)
panel_20 = Panel("Elevation (m)")

# ---- group: Extennd Section Crv
number_slider_3 = Slider(5, range=0..20)
C_12 = Data(item_9)
ext_3 = ExtendCurve(Curve=C_12, Type=0, Start=number_slider_3, End=number_slider_3)
C_13 = Data(ext_3)

# ----
A_4 = Data(item_10)
B_9 = Data(C_13)
ccx = CurveCurve(CurveA=A_4, CurveB=B_9)  # -> Points, ParamsA, ParamsB
yz_2 = YZPlane(Origin=Point(0, 0, 0))
pl_origin_4 = PlaneOrigin(Base=yz_2, Origin=ccx.Points)
pl_2 = Data(pl_origin_4)

# ---- group: Human UI / Calculate Earthworks Volume
pulldown_3 = CreatePulldownMenu(Label="Calculate", ListItems=["No", "Yes"], showLabel=True)
values_12 = ValueListener(Elements=pulldown_3, SomeProperty=True)  # -> Values, Indices
python_6 = GhPythonScript(x=values_12.Values)  # -> out, a
# ---------- python_6: Python ----------
__author__ = "bensay"
__version__ = "2021.02.10"

import rhinoscriptsyntax as rs

if x == "Yes":
    a = 1
elif x == "No":
    a = 0
# ---------- end python_6 ----------
horizontal_alignment_2 = ValueList({"Left": 0, "Center": 1, "Right": 2}, selected="Center")
expander_5 = CreateExpander(UIElements=pulldown_3, Header="Calculate Earthworks Volume", Open=True)
adjustpos_2 = AdjustElementPositioning(
    ElementsToAdjust=pulldown_3,
    Margin=Slider(10, range=0..100),
    AbsolutePositioning=False,
    Width=Slider(213, range=0..1000),
    HorizontalAlignment=horizontal_alignment_2)

# ----
num_2 = Number(python_6.a)

S = Data(B_4)
S_2 = Data(brep_5)
G_22 = Data(num_2)
gate = StreamGate(Stream=S, Gate=G_22)  # -> Target0, Target1
gate_2 = StreamGate(Stream=S_2, Gate=G_22)  # -> Target0, Target1
geo_5 = Geometry(gate.Target1)
geo_6 = Geometry(gate_2.Target1)
c_recursive_boolean_2 = CSharpScript(S=geo_5, D=geo_6)  # -> out, R, BB; inputs S: tree of Brep, D: tree of Brep; same code as c_recursive_boolean
geo_7 = Geometry(c_recursive_boolean_2.R)
geo_8 = Data(geo_7)

S_3 = Data(B_5)
S_4 = Data(brep_5)
G_23 = Data(num_2)
gate_3 = StreamGate(Stream=S_3, Gate=G_23)  # -> Target0, Target1
gate_4 = StreamGate(Stream=S_4, Gate=G_23)  # -> Target0, Target1
geo_9 = Geometry(gate_3.Target1)
geo_10 = Geometry(gate_4.Target1)
c_recursive_boolean_3 = CSharpScript(S=geo_9, D=geo_10)  # -> out, R, BB; inputs S: tree of Brep, D: tree of Brep; same code as c_recursive_boolean
geo_11 = Geometry(c_recursive_boolean_3.R)
geo_12 = Data(geo_11)

S_5 = Data(B_5)
S_6 = Data(brep_5)
G_24 = Data(num_2)
gate_5 = StreamGate(Stream=S_5, Gate=G_24)  # -> Target0, Target1
gate_6 = StreamGate(Stream=S_6, Gate=G_24)  # -> Target0, Target1
geo_13 = Geometry(gate_5.Target1)
geo_14 = Geometry(gate_6.Target1)
c_recursive_boolean_4 = CSharpScript(S=geo_14, D=geo_13)  # -> out, R, BB; inputs S: tree of Brep, D: tree of Brep; same code as c_recursive_boolean
geo_15 = Geometry(c_recursive_boolean_4.R)
geo_16 = Data(geo_15)

# ---- group: Fill Volume
G_25 = Data(geo_8)
volume = Volume(Geometry=G_25)  # -> Volume, Centroid
panel_21 = Panel(volume.Volume)

# ---- group: Cut Volume
G_26 = Data(geo_9)
G_27 = Data(geo_12)
volume_2 = Volume(Geometry=G_26)  # -> Volume, Centroid
volume_3 = Volume(Geometry=G_27)  # -> Volume, Centroid
subtraction_2 = Subtraction(A=volume_2.Volume, B=volume_3.Volume)
panel_22 = Panel(subtraction_2)

# ---- group: Display Fill
brep_6 = Brep(geo_8)
preview_3 = CustomPreview(Geometry=brep_6, Material=ColourSwatch(SwatchColor=RGBA(65, 209, 192, 141)))

# ---- group: Fill Volume
geo_17 = Geometry(brep_6)

# ---- group: Display Cut
brep_7 = Brep(geo_16)
preview_4 = CustomPreview(Geometry=brep_7, Material=ColourSwatch(SwatchColor=RGBA(227, 163, 68, 141)))

# ---- group: Cut Volume
geo_18 = Geometry(brep_7)

# ---- group: Earthworks Contours
D_4 = Data(major_contour_lines)
G_28 = Data()
d1_2 = Data(geo_18)
d2_2 = Data(geo_17)
D_5 = Data(minor_contour_lines)
merge_11 = Merge(Data1=d1_2, Data2=d2_2)
filter_6 = StreamFilter(Gate=G_28, Stream0=merge_11)

# ---- group: Earthworks Contours / Minor Contours
contour_3 = Contour(Shape=filter_6, Point=Point(0, 0, 0), Direction=Vector(0, 0, 1), Distance=D_5)
series_6 = Series(Start=0, Step=1, Count=10)
dash_4 = DashPattern(Curve=contour_3, Pattern=series_6)  # -> Dashes, Gaps
previewlw_9 = CustomPreviewLineweights(Geometry=dash_4.Dashes, Shader=ColourSwatch(SwatchColor=RGBA(209, 209, 209, 86)), Absolute=False)

# ---- group: Earthworks Contours / Major Contours
contour_4 = Contour(Shape=filter_6, Point=Point(0, 0, 0), Direction=Vector(0, 0, 1), Distance=D_4)
preview_5 = CustomPreview(Geometry=contour_4, Material=ColourSwatch(SwatchColor=RGB(0, 0, 0)))

# ---- group: Fill Mesh Edges
mesh = Data(geo_8)  # disabled
mshedge = MeshEdgesWithTolerance(Mesh=mesh, AngleThreshold=45)  # -> InteriorEdges, NakedEdges; disabled
join_3 = JoinCurves(Curves=flatten(mshedge.InteriorEdges), Preserve=False)  # disabled
C_14 = Data(join_3)  # disabled

# ----
subtraction_3 = Subtraction(A=panel_21, B=panel_22)
cut_volume = Number(panel_22)
fill_volume = Number(subtraction_3)
fill_volume_2 = Number(panel_21)

# ---- group: Fill Mesh Edges
G_29 = Data(C_14)  # disabled
swatch_2 = ColourSwatch(SwatchColor=RGB(0, 0, 0))  # disabled
previewlw_10 = CustomPreviewLineweights(Geometry=G_29, Shader=swatch_2, Absolute=False)  # disabled

# ----
join_4 = TextJoin(Text=["Total Fill Volume: ", fill_volume_2])
join_5 = TextJoin(Text=["Total Cut Volume: ", cut_volume])
join_6 = TextJoin(Text=["Total Earthworks Volumes +/-: ", fill_volume])
merge_12 = Merge(Data1=join_5, Data2=join_4, Data3=join_6)
lng_8 = ListLength(List=merge_12)
series_7 = Series(Start=0, Step=number_slider, Count=lng_8)
amp_4 = Amplitude(Vector=Y, Amplitude=series_7)

# ---- group: Fill Mesh Topsoil Scrape
A_5 = Data(topsoil_scrape_depth)  # disabled
C_15 = Data(C_14)  # disabled
B_10 = Data(topsoil_scrape_gradient)  # disabled
disc_2 = Discontinuity(Curve=C_15, Level=1)  # -> Points, Parameters; disabled
Z_8 = UnitZ(Factor=A_5)  # disabled
move_11 = Move(Geometry=disc_2.Points, Motion=expr("-x", Z_8))  # -> Geometry, Transform; disabled
pline_6 = PolyLine(Vertices=disc_2.Points, Closed=True)  # disabled
pline_7 = PolyLine(Vertices=move_11.Geometry, Closed=True)  # disabled
pcen_3 = PolygonCenter(Polyline=pline_7)  # -> CenterV, CenterE, CenterA; disabled
vec2pt_4 = Vector2Pt(PointA=move_11.Geometry, PointB=pcen_3.CenterV, Unitize=False)  # -> Vector, Length; disabled
multiplication_3 = Multiplication(A=A_5, B=B_10)  # disabled
amp_5 = Amplitude(Vector=vec2pt_4.Vector, Amplitude=multiplication_3)  # disabled
move_12 = Move(Geometry=move_11.Geometry, Motion=amp_5)  # -> Geometry, Transform; disabled
pline_8 = PolyLine(Vertices=move_12.Geometry, Closed=True)  # disabled
loft_4 = Loft(
    Curves=[pline_6, pline_8],
    Options={Adjust=False, Closed=False, LoftEnds=0, LoftSimp=0, LoftType=0, Rebuild=10, Refit=0.01})  # disabled
capex_4 = CapHolesEx(Brep=loft_4)  # -> Brep, Caps, Solid; disabled
B_11 = Data(capex_4.Brep)  # disabled
pl_3 = Data(pline_8)  # disabled

# ----
move_13 = Move(Geometry=xy, Motion=expr("-x", amp_4))  # -> Geometry, Transform
text_2 = CreateText(Location=move_13.Geometry, Text=merge_12, Style=textsty_2, Justification=6)
preview_6 = CustomPreview(Geometry=text_2, Material=ColourSwatch(SwatchColor=RGB(0, 0, 0)))

# ---- group: Fill Mesh Edges
B_12 = Data(B_11)  # disabled
mesh_2 = MeshBrep(
    Brep=B_12,
    Settings={GridMaxCount=0, GridMinCount=16, JaggedSeams=False, MaxEdgeLength=0, MinEdgeLength=0.0001, MinTolerance=0, Refine=True, RefineAngle=0, RelativeTolerance=0.65, SimplePlanes=True, Tolerance=0})  # disabled
mshedge_2 = MeshEdgesWithTolerance(Mesh=mesh_2, AngleThreshold=45)  # -> InteriorEdges, NakedEdges; disabled
M_2 = Data(mesh_2)  # disabled

# ---- group: Fill Mesh Volume
swatch_3 = ColourSwatch(SwatchColor=RGB(178, 116, 80))  # disabled
M_3 = Data(M_2)  # disabled
mcol_2 = MeshColours(Mesh=M_3, Colours=swatch_3)  # disabled

# ---- group: Fill Mesh Edges
G_30 = Data(pl_3)  # disabled
swatch_4 = ColourSwatch(SwatchColor=RGB(0, 0, 0))  # disabled
previewlw_11 = CustomPreviewLineweights(Geometry=G_30, Shader=swatch_4, Absolute=False)  # disabled

# ---- group: Human UI / Earthworks Volumes / Fill Volume Text
round_6 = RoundToIncrements(values=volume.Volume, factor=Slider(0.01, range=0..0.01))
merge_13 = Merge(Data1=round_6, Data2=" m3")
dummy_text_5 = Panel("Fill Volume (m3)")
join_7 = TextJoin(Text=merge_13)
label_4 = CreateLabel(LabelText=dummy_text_5, LabelSize=12, Justification=0)
setlabel = SetLabelContents(LabelToModify=label_4, NewLabelContents=join_7)

# ---- group: Human UI / Earthworks Volumes / Cut Volume Text
round_7 = RoundToIncrements(values=panel_22, factor=Slider(0.01, range=0..0.01))
merge_14 = Merge(Data1=round_7, Data2=" m3")
dummy_text_6 = Panel("Cut Volume (m3)")
join_8 = TextJoin(Text=merge_14)
label_5 = CreateLabel(LabelText=dummy_text_6, LabelSize=12, Justification=0)
setlabel_2 = SetLabelContents(LabelToModify=label_5, NewLabelContents=join_8)

# ---- group: Human UI / Earthworks Volumes / Total +/- Volumes
subtraction_4 = Subtraction(A=round_6, B=round_7)
merge_15 = Merge(Data1=subtraction_4, Data2=" m3")
dummy_text_7 = Panel("Fill Volume (m3)")
join_9 = TextJoin(Text=merge_15)
label_6 = CreateLabel(LabelText=dummy_text_7, LabelSize=12, Justification=0)
setlabel_3 = SetLabelContents(LabelToModify=label_6, NewLabelContents=join_9)

merge_16 = Merge(Data1=flatten(label), Data2=flatten(label_6))
stack_3 = CreateStack(UIElements=flatten(merge_16), Horizontal=True)

# ---- group: Human UI / Earthworks Volumes / Fill Volume Text
merge_17 = Merge(Data1=flatten(label_2), Data2=flatten(label_4))
stack_4 = CreateStack(UIElements=flatten(merge_17), Horizontal=True)

# ---- group: Human UI / Drawing / Edge Zone / Hatch Scale
selobj = GetSelectedObjects(AllObjects_Object=hatch_scale)  # -> ComponentObjects, ParamObjects, OtherObjects
slider = CreateSlider(Slider=selobj.ParamObjects, ShowBounds=False, ShowTicks=False, ShowTooltip=False, ShowValLabel=True, showLabel=True)
values_13 = ValueListener(Elements=slider, SomeProperty=True)  # -> Values, Indices
setobj = SetObjectValue(ObjectToSet=graft(selobj.ParamObjects), ValueToSet=values_13.Values)

# ---- group: Human UI / Contours
checkbox = CreateCheckbox(Label="Earthworks Contours", StartingValue=False)
checkbox_2 = CreateCheckbox(Label="Site Contours", StartingValue=False)
values_14 = ValueListener(Elements=checkbox, SomeProperty=True)  # -> Values, Indices
values_15 = ValueListener(Elements=checkbox_2, SomeProperty=True)  # -> Values, Indices
txt_2 = Text(values_14.Values)
merge_18 = Merge(Data1=flatten(checkbox_2), Data2=flatten(checkbox))
txt_3 = Text(values_15.Values)
python_7 = GhPythonScript(x=txt_2)  # -> out, a
# ---------- python_7: Python ----------
__author__ = "bensay"
__version__ = "2021.02.15"

import rhinoscriptsyntax as rs

if x == "False":
    a = 1
elif x == "True":
    a = 0
# ---------- end python_7 ----------
python_8 = GhPythonScript(x=txt_3)  # -> out, a; same code as python_7
expander_6 = CreateExpander(UIElements=flatten(merge_18), Header="Toggle Contours", Open=True)

# ---- group: Human UI / Drawing / SOPs / Text Offset
selobj_2 = GetSelectedObjects(AllObjects_Object=text_offset)  # -> ComponentObjects, ParamObjects, OtherObjects
slider_2 = CreateSlider(Slider=selobj_2.ParamObjects, ShowBounds=False, ShowTicks=False, ShowTooltip=False, ShowValLabel=True, showLabel=True)
values_16 = ValueListener(Elements=slider_2, SomeProperty=True)  # -> Values, Indices
setobj_2 = SetObjectValue(ObjectToSet=graft(selobj_2.ParamObjects), ValueToSet=values_16.Values)

# ---- group: Human UI / Slope Gradient Slider
selobj_3 = GetSelectedObjects(AllObjects_Object=_1_in)  # -> ComponentObjects, ParamObjects, OtherObjects
slider_3 = CreateSlider(Slider=selobj_3.ParamObjects, ShowBounds=False, ShowTicks=False, ShowTooltip=False, ShowValLabel=True, showLabel=True)
values_17 = ValueListener(Elements=slider_3, SomeProperty=True)  # -> Values, Indices
setobj_3 = SetObjectValue(ObjectToSet=graft(selobj_3.ParamObjects), ValueToSet=values_17.Values)
expander_7 = CreateExpander(UIElements=slider_3, Header="Slope Gradient", Open=True)

# ---- group: Human UI / Earthworks Volumes / Cut Volume Text
merge_19 = Merge(Data1=flatten(label_3), Data2=flatten(label_5))
stack_5 = CreateStack(UIElements=flatten(merge_19), Horizontal=True)

# ---- group: Human UI / Drawing / SOPs / SOP Point Size
selobj_4 = GetSelectedObjects(AllObjects_Object=point_size)  # -> ComponentObjects, ParamObjects, OtherObjects
slider_4 = CreateSlider(Slider=selobj_4.ParamObjects, ShowBounds=False, ShowTicks=False, ShowTooltip=False, ShowValLabel=True, showLabel=True)
values_18 = ValueListener(Elements=slider_4, SomeProperty=True)  # -> Values, Indices
setobj_4 = SetObjectValue(ObjectToSet=graft(selobj_4.ParamObjects), ValueToSet=values_18.Values)

# ---- group: Human UI / Drawing / SOPs / Text Height
selobj_5 = GetSelectedObjects(AllObjects_Object=text_height)  # -> ComponentObjects, ParamObjects, OtherObjects
slider_5 = CreateSlider(Slider=selobj_5.ParamObjects, ShowBounds=False, ShowTicks=False, ShowTooltip=False, ShowValLabel=True, showLabel=True)
values_19 = ValueListener(Elements=slider_5, SomeProperty=True)  # -> Values, Indices
setobj_5 = SetObjectValue(ObjectToSet=graft(selobj_5.ParamObjects), ValueToSet=values_19.Values)

# ---- group: Human UI / Drawing / Edge Zone / Edge Zone Dimension
selobj_6 = GetSelectedObjects(AllObjects_Object=edge_zone)  # -> ComponentObjects, ParamObjects, OtherObjects
slider_6 = CreateSlider(Slider=selobj_6.ParamObjects, ShowBounds=False, ShowTicks=False, ShowTooltip=False, ShowValLabel=True, showLabel=True)
values_20 = ValueListener(Elements=slider_6, SomeProperty=True)  # -> Values, Indices
setobj_6 = SetObjectValue(ObjectToSet=graft(selobj_6.ParamObjects), ValueToSet=values_20.Values)

# ---- group: Human UI / Drawing / Grid / Grid Bubble Size
selobj_7 = GetSelectedObjects(AllObjects_Object=grid_bubble_size)  # -> ComponentObjects, ParamObjects, OtherObjects
slider_7 = CreateSlider(Slider=selobj_7.ParamObjects, ShowBounds=False, ShowTicks=False, ShowTooltip=False, ShowValLabel=True, showLabel=True)
values_21 = ValueListener(Elements=slider_7, SomeProperty=True)  # -> Values, Indices
setobj_7 = SetObjectValue(ObjectToSet=graft(selobj_7.ParamObjects), ValueToSet=values_21.Values)

# ---- group: Human UI / Drawing / Grid / Grid Size
selobj_8 = GetSelectedObjects(AllObjects_Object=grid_size)  # -> ComponentObjects, ParamObjects, OtherObjects
slider_8 = CreateSlider(Slider=selobj_8.ParamObjects, ShowBounds=False, ShowTicks=False, ShowTooltip=False, ShowValLabel=True, showLabel=True)
values_22 = ValueListener(Elements=slider_8, SomeProperty=True)  # -> Values, Indices
setobj_8 = SetObjectValue(ObjectToSet=graft(selobj_8.ParamObjects), ValueToSet=values_22.Values)

# ---- group: Human UI / Drawing / Grid / Grid Rotation
selobj_9 = GetSelectedObjects(AllObjects_Object=grid_rotation)  # -> ComponentObjects, ParamObjects, OtherObjects
slider_9 = CreateSlider(Slider=selobj_9.ParamObjects, ShowBounds=False, ShowTicks=False, ShowTooltip=False, ShowValLabel=True, showLabel=True)
values_23 = ValueListener(Elements=slider_9, SomeProperty=True)  # -> Values, Indices
setobj_9 = SetObjectValue(ObjectToSet=graft(selobj_9.ParamObjects), ValueToSet=values_23.Values)

# ----
expander_8 = CreateExpander(UIElements=flatten(pulldown), Header="Select Polyline Input Type", Open=True)

# ---- group: Human UI / Costain Branding / Copyright Info
label_7 = CreateLabel(LabelText="Costain Group Ltd.", LabelSize=8, Justification=0)
horizontal_alignment_3 = ValueList({"Left": 0, "Center": 1, "Right": 2}, selected="Center")
vertical_alignment = ValueList({"Top": 2, "Middle": 1, "Bottom": 0}, selected="Middle")
adjustpos_3 = AdjustElementPositioning(
    ElementsToAdjust=label_7,
    Margin=Slider(0, range=0..100),
    AbsolutePositioning=True,
    HorizontalAlignment=horizontal_alignment_3,
    VerticalAlignment=vertical_alignment)

# ----
expander_9 = CreateExpander(UIElements=flatten(pulldown_2), Header="Select Polyline Input Type", Open=True)
panel_23 = Panel(python.a)

# ---- group: Human UI / Contact Info
dummy_text_8 = Panel("benjamin.sayers@costain.com")
label_8 = CreateLabel(LabelText=dummy_text_8, LabelSize=12, Justification=0)

# ----
dummy_text_9 = Panel("The 2D drawing outputs produced are for the approval of the client or delivery team. Please carry out a check of all 2D outputs.")
values_24 = ValueListener(Elements=button_3, SomeProperty=True)  # -> Values, Indices

# ---- group: Human UI / Contact Info
dummy_text_10 = Panel("Product Owner: Benjamin Sayers")
label_9 = CreateLabel(LabelText=dummy_text_10, LabelSize=12, Justification=0)

# ----
dummy_text_11 = Panel("Please note, the volumetric data outputs (m3) are geometric volumes only. This volume data-set does not include compacted earthworks as the volume(m3) may increase.")
dummy_text_12 = Panel("Please note this design tool is not currently optimised for large scale calculation (+5km). Min 8gb RAM required.")
expander_10 = CreateExpander(UIElements=flatten(pickbtn_3), Header="Select A Manually Drawn Platform Edge", Open=True)
expander_11 = CreateExpander(UIElements=flatten(pickbtn), Header="Select Imported Topo Surface", Open=True)
values_25 = ValueListener(Elements=toggle_3, SomeProperty=True)  # -> Values, Indices

# ---- group: Human UI / Info Text
dummy_text_13 = Panel("An automated design tool for working platform drawing production and earthworks estimation.")
tb_2 = CreateTextBlock(Text=dummy_text_13, TextSize=12, Justification=1)

dummy_text_14 = Panel("Automated Working Platforms")
label_10 = CreateLabel(LabelText=dummy_text_14, LabelSize=24, Justification=0)

# ----
bool_4 = Boolean(values_24.Values)

curve = Data(C_13)
B_13 = Data(brep_5)
mesh_3 = MeshBrep(
    Brep=B_13,
    Settings={GridMaxCount=0, GridMinCount=16, JaggedSeams=False, MaxEdgeLength=0, MinEdgeLength=0.0001, MinTolerance=0, Refine=True, RefineAngle=0, RelativeTolerance=0.65, SimplePlanes=True, Tolerance=0})
Z_9 = UnitZ(Factor=1)
projecttomesh = ProjectToMesh(Curve=curve, Mesh=mesh_3, Direction=Z_9)  # -> out, A; inputs Curve: Curve, Mesh: Mesh, Direction: Vector3d
# ---------- projecttomesh: C# ----------
    if (null != Curve && null != Mesh && Direction.IsValid)
    {
      var tol = RhinoDoc.ActiveDoc.ModelAbsoluteTolerance;
      A = Curve.ProjectToMesh(Curve, Mesh, Direction, tol);
    }
# ---------- end projecttomesh ----------
A_6 = Data(projecttomesh.A)

# ---- group: Spot Levels / Display Spot Level
L_10 = Data(P_7)
T_4 = Data(T_3)
tag_4 = TextTag3D(Location=graft(L_10), Text=T_4, Size=1, Colour=ColourSwatch(SwatchColor=RGB(0, 0, 0)), Justification=4)

# ----
tb_3 = CreateTextBlock(Text=dummy_text_9, TextSize=12, Justification=1)
tb_4 = CreateTextBlock(Text=dummy_text_11, TextSize=12, Justification=1)
tb_5 = CreateTextBlock(Text=dummy_text_12, TextSize=12, Justification=1)

# ---- group: SOPs / Display SOP Geom
G_31 = Data(crv_5)
project_10 = Project(Geometry=G_31, Plane=PlaneXY(0, 0, 0))  # -> Geometry, Transform
previewlw_12 = CustomPreviewLineweights(
    Geometry=project_10.Geometry,
    Shader=ColourSwatch(SwatchColor=RGB(0, 0, 0)),
    Thickness=Slider(2, range=0..10),
    Absolute=False)

# ---- group: Human UI / Earthworks Volumes
merge_20 = Merge(Data1=flatten(stack_5), Data2=flatten(stack_4), Data3=flatten(stack_3))
expander_12 = CreateExpander(UIElements=flatten(merge_20), Header="Earthworks Volumes", Open=True)

# ----
P_10 = Data(pl_2)
xz_2 = XZPlane(Origin=Point(0, 0, 0))
deplane_2 = DeconstructPlane(Plane=P_10)  # -> Origin, XAxis, YAxis, ZAxis
pl_origin_5 = PlaneOrigin(Base=xz_2, Origin=deplane_2.Origin)
pl_4 = Data(pl_origin_5)

# ---- group: SOPs / Display SOP Tag
L_11 = Data(pt_6)
T_5 = Data(join)
S_7 = Data(text_height)
tag_5 = TextTag3D(Location=L_11, Text=T_5, Size=S_7, Colour=ColourSwatch(SwatchColor=RGB(0, 0, 0)), Justification=7)

# ---- group: Human UI / Contact Info
merge_21 = Merge(Data1=flatten(label_9), Data2=flatten(label_8))
stack_6 = CreateStack(UIElements=merge_21, Horizontal=invert(True))
adjustpos_4 = AdjustElementPositioning(ElementsToAdjust=stack_6, Margin=Slider(20, range=0..100), AbsolutePositioning=False, HorizontalAlignment=1)

# ---- group: Woring Platform Box Section
B_14 = Data(B_2)
P_11 = Data(pl_2)
sec = BrepPlane(Brep=B_14, Plane=P_11)  # -> Curves, Points
C_16 = Data(sec.Curves)

# ---- group: Fill Section
geo_19 = Data(geo_8)
P_12 = Data(pl_2)
sec_2 = BrepPlane(Brep=geo_19, Plane=P_12)  # -> Curves, Points
C_17 = Data(sec_2.Curves)

# ---- group: Human UI / Info Text
horizontal_alignment_4 = ValueList({"Left": 0, "Center": 1, "Right": 2}, selected="Center")
number_slider_4 = Slider(20, range=0..100)
adjustelem_2 = AdjustElementAppearance(ElementsToAdjust=label_10, FontSize=Slider(18, range=0..100))
adjustpos_5 = AdjustElementPositioning(
    ElementsToAdjust=label_10,
    Margin=Slider(30, range=0..100),
    AbsolutePositioning=False,
    HorizontalAlignment=horizontal_alignment_4)
adjustpos_6 = AdjustElementPositioning(ElementsToAdjust=tb_2, Margin=number_slider_4, AbsolutePositioning=False, HorizontalAlignment=horizontal_alignment_4)
adjustelem_3 = AdjustElementAppearance(ElementsToAdjust=[tb_3, tb_2], Foreground=ColourSwatch(SwatchColor=RGB(255, 255, 255)))

# ----
adjustpos_7 = AdjustElementPositioning(
    ElementsToAdjust=tb,
    Margin=Slider(20, range=0..100),
    AbsolutePositioning=False,
    Width=subtraction,
    HorizontalAlignment=horizontal_alignment_4,
    VerticalAlignment=0)
expander_13 = CreateExpander(UIElements=button_3, Header="Bake 3D Geometry", Open=True)

# ---- group: Human UI / Drawing / Edge Zone
merge_22 = Merge(Data1=flatten(slider_6), Data2=flatten(slider), Data3=textbox_2)
expander_14 = CreateExpander(UIElements=flatten(merge_22), Header="Edge Zone", Open=True)

# ---- group: Human UI / Drawing / Grid
merge_23 = Merge(Data1=flatten(slider_8), Data2=flatten(slider_9), Data3=flatten(slider_7))
expander_15 = CreateExpander(UIElements=merge_23, Header="Grid", Open=True)

# ---- group: Human UI / Drawing / SOPs
merge_24 = Merge(Data1=flatten(slider_5), Data2=flatten(slider_4), Data3=flatten(slider_2))
expander_16 = CreateExpander(UIElements=merge_24, Header="SOPs", Open=True)

# ---- group: SOPs / Headings
d1_3 = Data(panel_17)
d2_3 = Data(panel_18)
d3 = Data(panel_19)
d4 = Data(panel_20)

# ---- group: SOPs / Coords
d1_4 = Data(sop)
d2_4 = Data(easting_m)
d3_2 = Data(northing_m)
d4_2 = Data(elevatoin_m)

# ---- group: SOPs / Create CSV
merge_25 = Merge(Data1=d1_3, Data2=d1_4)  # -> flatten(Result)
merge_26 = Merge(Data1=d2_3, Data2=d2_4)  # -> flatten(Result)
merge_27 = Merge(Data1=d3, Data2=d3_2)  # -> flatten(Result)
merge_28 = Merge(Data1=d4, Data2=d4_2)  # -> flatten(Result)
merge_29 = Merge(Data1=graft(merge_25), Data2=graft(merge_26), Data3=graft(merge_27), Data4=graft(merge_28))
join_10 = TextJoin(Text=merge_29, Join=",")
flatten = FlattenTree(Tree=join_10, Path="{0}")

# ----
d2_5 = Data(C_16)
d3_3 = Data(A_6)
A_7 = Data(pl_2)
B_15 = Data(pl_4)
d1_5 = Data(C_17)
merge_30 = Merge(Data1=d1_5, Data2=d2_5, Data3=d3_3)
orient = Orient(Geometry=merge_30, Source=A_7, Target=B_15)  # -> Geometry, Transform
G_32 = Data(orient.Geometry)

adjustpos_8 = AdjustElementPositioning(
    ElementsToAdjust=[tb_3, tb_4, tb_5],
    Margin=number_slider_4,
    AbsolutePositioning=False,
    HorizontalAlignment=horizontal_alignment_4)
adjustelem_4 = AdjustElementAppearance(ElementsToAdjust=[tb_4, tb_3, tb_5], Foreground=ColourSwatch(SwatchColor=RGB(255, 0, 0)))

# ---- group: Display Fill Crvs
d2_6 = Data(G_15)
d3_4 = Data(G_13)
merge_31 = Merge(Data2=d2_6, Data3=d3_4)
previewlw_13 = CustomPreviewLineweights(Geometry=merge_31, Shader=ColourSwatch(SwatchColor=RGB(0, 0, 0)), Absolute=False)

# ---- group: Display Input Crv
G_33 = Data(crv_2)
project_11 = Project(Geometry=G_33, Plane=PlaneXY(0, 0, 0))  # -> Geometry, Transform
previewlw_14 = CustomPreviewLineweights(
    Geometry=project_11.Geometry,
    Shader=ColourSwatch(SwatchColor=RGB(0, 0, 0)),
    Thickness=Slider(2, range=0..10),
    Absolute=False)

# ----
G_34 = Data(G_32)
previewlw_15 = CustomPreviewLineweights(Geometry=G_34, Shader=ColourSwatch(SwatchColor=RGB(0, 0, 0)), Absolute=False)

merge_32 = Merge(
    Data1=flatten(expander_10),
    Data2=flatten(expander_2),
    Data3=flatten(expander_9),
    Data4=flatten(expander_11),
    Data5=flatten(expander),
    Data6=flatten(expander_8),
    Data7=flatten(stack_2))
panel_24 = Panel("Cut/Fill")
swatch_5 = ColourSwatch(SwatchColor=RGB(0, 0, 0))
geo_20 = Geometry([geo_16, geo_8])
bake_cut_fill_intersection = BakeObject(Objects=geo_20, Bake=Toggle(False), AllObjects_Object=previewlw_13)
number_slider_5 = Slider(4, range=0..10)  # disabled
xy_4 = XYPlane(Origin=Point(0, 0, 0))  # disabled
dom = ConstructDomain(DomainStart=expr("-5", number_slider_5), DomainEnd=number_slider_5)  # disabled
Z_10 = UnitZ(Factor=expr("x*3", number_slider_5))  # disabled
rectangle = Rectangle(Plane=xy_4, XSize=dom, YSize=dom, Radius=0)  # -> Rectangle, Length; disabled
move_14 = Move(Geometry=rectangle.Rectangle, Motion=Z_10)  # -> Geometry, Transform; disabled
pcen_4 = PolygonCenter(Polyline=move_14.Geometry)  # -> CenterV, CenterE, CenterA; disabled
scale = Scale(Geometry=move_14.Geometry, Center=pcen_4.CenterV, Factor=expr("1/x", number_slider_5))  # -> Geometry, Transform; disabled
rad_2 = Radians(Degrees=expr("x^3", number_slider_5))  # disabled
rotate = Rotate(Geometry=scale.Geometry, Angle=rad_2, Plane=xy_4)  # -> Geometry, Transform; disabled
loft_5 = Loft(
    Curves=[rotate.Geometry, rectangle.Rectangle],
    Options={Adjust=False, Closed=False, LoftEnds=0, LoftSimp=0, LoftType=0, Rebuild=10, Refit=0.01})  # disabled
platform_edge = Geometry(_3d_preview_input_crv)
no_go_zone = Geometry([C, hg])
cut_fill_crvs = Geometry(merge_31)
sop_2 = Geometry(project_10.Geometry)
grid = Geometry([dash_3.Dashes, merge_7, dash_2.Dashes])
cap = CapHoles(Brep=loft_5)  # disabled
panel_25 = Panel("cadexportsample.dwg")  # disabled
entwine_2 = Entwine(Branch00=sop_2, Branch01=grid, Branch02=platform_edge, Branch03=no_go_zone, Branch04=cut_fill_crvs, FlattenInputs=True)
toggle_4 = BooleanToggle(False)  # disabled
path_3 = FilePath("C:\Users\bensay\Costain Group Plc\Digital Engineering Solutions - AutoDesign\02-Workstreams\16-Earthworks Volumes\Working Platforms\APP\")  # disabled
geo_21 = Geometry(entwine_2)
clean_5 = CleanTree(RemoveNulls=True, RemoveInvalid=True, RemoveEmpty=False, Tree=geo_21)
toggle_5 = BooleanToggle(False)  # disabled
panel_26 = Panel("A1")  # disabled
c_script_4 = CSharpScript(geometries=cap, filename=panel_25, directory=path_3, export=toggle_4)  # -> out; inputs geometries: tree of GeometryBase, filename: String, directory: String, export: Boolean; disabled
# ---------- c_script_4: C# usings ----------
using System.IO;
# ---------- c_script_4: C# ----------
    if(export){
      List<Guid> guids = new List<Guid>();
      for(int i = 0; i < geometries.BranchCount; i++){
        for(int n = 0; n < geometries.Branches[i].Count; n++){
          var geom = geometries.Branches[i][n];
          var guid = Rhino.RhinoDoc.ActiveDoc.Objects.Add(geom);
          guids.Add(guid);
        }
      }

      Rhino.RhinoDoc.ActiveDoc.Objects.Select(guids);

      string filepath = Path.Combine(directory, filename);
      string cmd = "_-Export " + "\"" + filepath + "\"" + " _Enter _Enter";

      Rhino.RhinoApp.RunScript(cmd, false);

      Rhino.RhinoDoc.ActiveDoc.Objects.Delete(guids, true);

    }
# ---------- end c_script_4 ----------
panel_27 = Panel(clean_5)
path_4 = FilePath("C:\Users\bensay\Costain Group Plc\Digital Engineering Solutions - AutoDesign\02-Workstreams\16-Earthworks Volumes\Working Platforms\APP\")
bool_5 = Boolean(values_25.Values)
c_script_5 = CSharpScript(filename=panel_25, directory=path_3, viewport=panel_26, export=toggle_5)  # -> out; inputs filename: String, directory: String, viewport: String, export: Boolean; disabled
# ---------- c_script_5: C# ----------
    if(export){
      string filepath = Path.Combine(directory, filename);
      string cmd = "-_Print Setup View ViewportArea Window -10,-10 Enter 20,20 Enter Enter Enter Enter testy.pdf Enter";
      //string cmd = "_-Export " + "\"" + filepath + "\"" + " _Enter";

      Rhino.RhinoApp.RunScript(cmd, true);
    }
# ---------- end c_script_5 ----------
c_script_6 = CSharpScript(geometries=clean_5, filename="new_dwg_export.dwg", directory=path_4, export=bool_5)  # -> out; inputs geometries: tree of GeometryBase, filename: String, directory: String, export: Boolean; same code as c_script_4

button_4 = CreateButton(ButtonName="Export", ButtonStyle=0)
values_26 = ValueListener(Elements=button_4, SomeProperty=True)  # -> Values, Indices

textbox_3 = CreateTextBox(Label="Input CSV File Path", UpdateButton=True, showLabel=True)

values_27 = ValueListener(Elements=textbox_3, SomeProperty=True)  # -> Values, Indices
merge_33 = Merge(Data1=flatten(textbox_3), Data2=flatten(button_4))
stack_7 = CreateStack(UIElements=flatten(merge_33), Horizontal=invert(True))
expander_17 = CreateExpander(UIElements=stack_7, Header="Export SOPs as CSV", Open=True)

# ---- group: Human UI / Export CSV
horizontal_alignment_5 = ValueList({"Left": 0, "Center": 1, "Right": 2}, selected="Center")
adjustpos_9 = AdjustElementPositioning(
    ElementsToAdjust=stack_7,
    Margin=Slider(0, range=0..100),
    AbsolutePositioning=False,
    HorizontalAlignment=horizontal_alignment_5)

# ---- group: SOPs / Export
path_5 = FilePath(values_27.Values)
c_script_7 = CSharpScript(save=Button(), path=path_5, data=flatten)  # inputs save: Boolean, path: String, data: list of String
# ---------- c_script_7: C# ----------
    if(save);{
      var fileinfo = new System.IO.FileInfo(path);
      if(!fileinfo.Directory.Exists){
        fileinfo.Directory.Create();
      }

      var sw = fileinfo.CreateText();
      for(int i = 0; i < data.Count; i++){
        string row = data[i];
        if(i < data.Count - 1){
          sw.WriteLine(row);
        } else {
          sw.Write(row);
        }
      }

      sw.Flush();
      sw.Close();
    }
# ---------- end c_script_7 ----------

# ---- group: Human UI / Costain Branding / Costain Logo
panel_28 = Panel("C:\Users\bensay\Costain Group Plc\Digital Engineering Solutions - AutoDesign\04-Ideas_&_Misc\Project Best Practice\GUI\HumanUI")
logo_width = Slider(100, range=0..100)
dir = DirectoryContents(FolderPath=panel_28, Filter="*.jpg", IncludeSubfolders=False)  # -> FilePaths, FileNames
image = CreateImage(ImageSource=dir.FilePaths, ImageWidth=logo_width)
setimg = SetImage(ImageToModify=image, NewImagePath=dir.FilePaths)

# ---- group: Human UI / Costain Branding
horizontal_alignment_6 = ValueList({"Left": 0, "Center": 1, "Right": 2}, selected="Center")
vertical_alignment_2 = ValueList({"Top": 2, "Middle": 1, "Bottom": 0}, selected="Top")
merge_34 = Merge(Data1=flatten(image), Data2=flatten(label_7))

# ---- group: Human UI / Costain Branding / Costain Logo (continued)
adjustpos_10 = AdjustElementPositioning(
    ElementsToAdjust=image,
    Margin=Slider(20, range=0..100),
    AbsolutePositioning=invert(True),
    HorizontalAlignment=horizontal_alignment_6,
    VerticalAlignment=vertical_alignment_2)

# ---- group: Human UI
launchwin = LaunchWindow(
    Show=toggle,
    Name="Automated Design",
    Width=division,
    Height=multiplication,
    FontFamily=item,
    ChildStatus=0,
    EnableHorizScroll=False)
merge_35 = Merge(Data1=flatten(expander_17), Data2=flatten(expander_3), Data3=flatten(expander_13))
merge_36 = Merge(
    Data1=flatten(label_10),
    Data2=flatten(tb_2),
    Data3=flatten(tb_3),
    Data4=flatten(tb_5),
    Data5=flatten(tb_4),
    Data6=flatten(stack_6),
    Data7=flatten(merge_34))
merge_37 = Merge(
    Data2=flatten(expander_6),
    Data3=flatten(expander_7),
    Data4=flatten(expander_12),
    Data5=flatten(expander_4),
    Data6=flatten(expander_5))
merge_38 = Merge(Data1=flatten(expander_14), Data2=flatten(expander_16), Data3=flatten(expander_15))

# ---- group: Human UI / Window Styling
accent_colors = ValueList({"Amber", "Blue", "Brown", "Cobalt", "Crimson", "Cyan", "Emerald", "Green", "Indigo", "Lime", "Magenta", "Mauve", "Olive", "Orange", "Pink", "Purple", "Red", "Sienna", "Steel", "Taupe", "Teal", "Violet", "Yellow"}, selected="Steel")
swatch_6 = White(SwatchColor=RGB(38, 35, 35))
winprops = SetWindowProperties(
    Window=launchwin,
    Theme=Toggle(True),
    AccentColor=accent_colors,
    ShowTitleBar=Toggle(True),
    BackgroundColor=swatch_6,
    ScaleFactor=1)

# ---- group: Human UI / Tabs
panel_29 = Panel("""Import
Model
Drawing
Export
Info""")
tabs = TabbedView(
    TabNames=panel_29,
    Tab0=flatten(merge_32),
    Tab1=flatten(merge_37),
    Tab2=flatten(merge_38),
    Tab3=flatten(merge_35),
    Tab4=flatten(merge_36))

# ---- group: Human UI (continued)
addelems = AddElements(Window=launchwin, Elements=flatten(tabs), DoVLChecking=True)  # -> AddedElements, ElementNames

# ==== cluster RoundToIncrements: Round Number to nearst number on a multiplication table of factor
factor = ClusterInput()  # Rounding Factor
values = ClusterInput()  # Values to be Rounded
num = Number(factor)
num_2 = Number(values)
expression = Expression(x=num_2, y=num, Expression="y*Cint(x/y)")
num_3 = Number(expression)
rounded_values = ClusterOutput(num_3)
