# Grasshopper definition Adjusting Appearance.gh (Grasshopper 0.9.76)
# plug-ins: Human UI, Human

# ----
# Adjust Fonts
# Fonts are set at a window-wide level - this will affect most of the text elements inside the window.
pan = Panel("""Impact
Arial
Segoe UI
Calibri
Verdana
Minion Pro
Rosewood Std
Tw Cen MT""")
list = ItemSelector(
    pan,
    {"Impact", "Arial", "Segoe UI", "Calibri", "Verdana", "Minion Pro", "Rosewood Std", "Tw Cen MT"}, selected="Tw Cen MT")

seq = Sequence(Count=10, CharPool="ABCDEFGHIJKLMNOPQRSTUVWXYZ", Format="{0}")
# HUMAN UI: Adjusting Appearance
toggle = BooleanToggle(True)
radiobtn = CreateRadioButton(RadioButtonName=seq, RadioButtonGroup="grp", InitiallySelected=False)
partition = PartitionList(List=radiobtn, Size="5")
stack = CreateStack(UIElements=partition, Horizontal=True)  # -> flatten(Stack)
slider = CreateSlider(Slider=Slider(34, range=0..100), ShowBounds=False, showLabel=True, ShowTicks=False, ShowTooltip=False, ShowValLabel=True)
button = CreateButton(ButtonName="Adjust This Button!", ButtonStyle=0)
label = CreateLabel(LabelText="Adjusting Appearance", LabelSize=24, Justification=0)
label_2 = CreateLabel(LabelText="A modified Label", LabelSize=24, Justification=0)

# ----
# Transparent Window
# You can create a window that supports a transparent background - use the Adjust Window Properties component to control its color and opacity.
toggle_2 = BooleanToggle(False)
launchxpwin = LaunchTransparentWindow(Show=toggle_2, Name="Control Window", Width=370, Height=400, ChildStatus=0, EnableHorizScroll=False)

launchwin = LaunchWindow(Show=toggle, Name="Appearance Demo", Width=370, Height=400, FontFamily=list, ChildStatus=0, EnableHorizScroll=False)

# ----
# Margins can be supplied as a comma separated series of values, to control left, top, right, and bottom margins individually; as a single value, to control all margins at once; or as a Point, to control just the left and top margins.
pan_2 = Panel("""0,5,2,20
45
{100,16,0}""")
list_2 = ItemSelector(pan_2, {"0,5,2,20", "45", "{100,16,0}"}, selected="0,5,2,20")

# ----
# You can also set justification - where the element is positioned relative to. Elements are typically positioned relative to their top - different elements have different defaults for horizontal alignment.
horizontal_alignment = ValueList({"Left": 0, "Center": 1, "Right": 2}, selected="Center")
vertical_alignment = ValueList({"Top": 2, "Middle": 1, "Bottom": 0}, selected="Top")

merge = Merge(Data1=label, Data2=slider, Data3=label_2, Data4=stack, Data5=button)

# ----
# You can dynamically adjust the size of elements - in some cases without this they will just fill whatever space is available.
number_slider = Slider(37, range=0..1000)

# ----
# The absolute positioning toggle decides if the element should live in the stack (the default, which just places it below the previous element added to the window), or in the grid, which means it is positioned relative to the boundaries of the window, ignoring other elements.
toggle_3 = BooleanToggle(False)

addelems = AddElements(Window=launchwin, Elements=flatten(merge), DoVLChecking=True)  # -> AddedElements, ElementNames

# ----
# Adjust Element Appearance
# The Adjust Element Appearance component lets you set the text color, background color, and text size, where available. It works best on text elements like labels and text blocks, but works on other elements as well.
number_slider_2 = Slider(31, range=0..100)
swatch = Red(SwatchColor=RGB(255, 0, 0))
swatch_2 = White(SwatchColor=RGB(255, 255, 255))
swatch_3 = Blue(SwatchColor=RGB(0, 128, 255))
adjustelem = AdjustElementAppearance(ElementsToAdjust=radiobtn, Foreground=swatch_3, FontSize=number_slider_2)
adjustelem_2 = AdjustElementAppearance(ElementsToAdjust=label_2, Foreground=swatch, Background=swatch_2, FontSize=Slider(24, range=0..100))

# ----
# Adjust Window Properties
# You can edit the window properties - choose a theme, an accent color, a background color, and position it relative to screen coordinates. You can even show or hide the title bar, although hiding it can make the window difficult to drag around.
# 
# Note that for the accent color list, you can simply right-click the component and choose "Create Accent List" for a pre-populated pulldown including the allowed accent colors.
accent_colors = ValueList({"Amber", "Blue", "Brown", "Cobalt", "Crimson", "Cyan", "Emerald", "Green", "Indigo", "Lime", "Magenta", "Mauve", "Olive", "Orange", "Pink", "Purple", "Red", "Sienna", "Steel", "Taupe", "Teal", "Violet", "Yellow"}, selected="Cobalt")
swatch_4 = White(SwatchColor=RGB(57, 68, 76))

winprops = SetWindowProperties(
    Window=launchwin,
    Theme=Toggle(True),
    AccentColor=accent_colors,
    ShowTitleBar=Toggle(True),
    BackgroundColor=swatch_4,
    ScaleFactor=1)

# ----
# Adjust Element Positioning
# Adjust Element Positioning gives you lots of control over where the element is located in the window.
adjustpos = AdjustElementPositioning(
    ElementsToAdjust=button,
    Margin=list_2,
    AbsolutePositioning=toggle_3,
    Width=Slider(150, range=0..1000),
    Height=number_slider,
    HorizontalAlignment=horizontal_alignment,
    VerticalAlignment=vertical_alignment)
