# Grasshopper definition Beginner Examples.gh (Grasshopper 0.9.76)
# plug-ins: Human UI

# ----
# Example 1: Image Picker
# Set the toggle to the right to "True" to launch the window.
# 4. Listen to the UI Elements
image_source_directory = Panel("C:\Users\Public\Pictures\Sample Pictures")
directory_contents = DirectoryContents(x=image_source_directory)  # -> out, A; inputs x: String
# ---------- directory_contents: C# ----------
   A= Directory.EnumerateFiles(x);
# ---------- end directory_contents ----------
item = ListItem(List=directory_contents.A, Index=0, Wrap=True)

# ----
# Example 2: Interactive 2D Drawing
# Set the toggle to the right to "True" to launch the window.
# 4. Listen to the UI Elements
pan = Panel("0 to -4")
rectangle = Rectangle(Plane=PlaneXY(0, 0, 0), XSize="5", YSize=pan, Radius=0)  # -> Rectangle, Length

# ----
# 2. Create an element
pan_2 = Panel("My First Button")
button = CreateButton(ButtonName=pan_2, ButtonStyle=0)

# ----
# HUMAN UI: Beginner Examples
# Setting up Human UI
# A simple Human UI setup only requires you to do 4 things:
# Set the toggle to the right to "True" to launch the window.
# 1. Create a window
toggle = BooleanToggle(False)
launchwin = LaunchWindow(Show=toggle, Name="Control Window", Width=370, Height=400, ChildStatus=0, EnableHorizScroll=False)

# ----
# 2. Create UI Elements
number_slider = Slider(56, range=0..100)
attractor_position = Slider(0.5, range=0..1)
swatch = Red(SwatchColor=RGB(255, 0, 0))
colorpicker = CreateColorPicker(DefaultColor=swatch)
shape = CreateShape(
    Shape=rectangle.Rectangle,
    FillColor=swatch,
    StrokeWeight=Slider(0, range=0..100),
    StrokeColor=RGB(0, 0, 0),
    Scale=number_slider)

# ----
# 1. Create a window
number_slider_2 = Slider(387, range=0..1000)
launchwin_2 = LaunchWindow(
    Show=Toggle(False),
    Name="Image Selector",
    Width=number_slider_2,
    Height=Slider(329, range=0..1000),
    ChildStatus=0,
    EnableHorizScroll=False)

values = ValueListener(Elements=button, SomeProperty=True)  # -> Values, Indices

# ----
# 3. Add the element to the window
addelems = AddElements(Window=launchwin, Elements=flatten(button), DoVLChecking=True)  # -> AddedElements, ElementNames

pulldown = CreatePulldownMenu(ListItems=directory_contents.A, SelectedIndex=0)  # -> flatten(Pulldown)

# ----
# 2. Create UI Elements
image = CreateImage(ImageSource=item, ImageWidth=Slider(309, range=0..1000))

# ----
# 1. Create a window
number_slider_3 = Slider(342, range=0..1000)
launchwin_3 = LaunchWindow(
    Show=Toggle(False),
    Name="Shape Configurator",
    Width=Slider(387, range=0..1000),
    Height=number_slider_3,
    ChildStatus=0,
    EnableHorizScroll=False)

# ----
# 4. Listen to the UI Elements
panel = Panel(values.Values)

slider = CreateSlider(Slider=attractor_position, ShowBounds=False, showLabel=True, ShowTicks=False, ShowTooltip=False, ShowValLabel=True)
values_2 = ValueListener(Elements=pulldown, SomeProperty=True)  # -> Values, Indices

# ----
# 3. Add the element to the window
addelems_2 = AddElements(Window=launchwin_2, Elements=flatten([image, pulldown]), DoVLChecking=True)  # -> AddedElements, ElementNames

values_3 = ValueListener(Elements=colorpicker, SomeProperty=True)  # -> Values, Indices
values_4 = ValueListener(Elements=slider, SomeProperty=True)  # -> Values, Indices

# ----
# 2. Create UI Elements
monkeys = Slider(32, range=0..100)
# Set the toggle to the right to "True" to launch the window.
pan_3 = Panel("There are no monkeys.")
label = CreateLabel(LabelText=pan_3, LabelSize=12, Justification=0)

# ----
# 3. Add the elements to the window
addelems_3 = AddElements(Window=launchwin_3, Elements=flatten([shape, slider, colorpicker]), DoVLChecking=True)  # -> AddedElements, ElementNames

# ----
# Updating a UI Element
# 1. Create a window
toggle_2 = BooleanToggle(False)
launchwin_4 = LaunchWindow(Show=toggle_2, Name="Control Window", Width=370, Height=400, ChildStatus=0, EnableHorizScroll=False)

slider_2 = CreateSlider(Slider=monkeys, ShowBounds=False, showLabel=True, ShowTicks=False, ShowTooltip=False, ShowValLabel=True)

# ----
# Grasshopper Geometry Logic
rectangle_boundary = Curve(rectangle.Rectangle)
number_slider_4 = Slider(10, range=0..10)
mesh_uv = MeshSurface(Surface=rectangle_boundary, UCount=number_slider_4, VCount=number_slider_4, Overhang=True, Equalize=False)
box = EvaluateBox(Box=rectangle_boundary, UParameter=values_4.Values, VParameter=0.5, WParameter=0.5)  # -> Plane, Point, Include
demesh = DeconstructMesh(Mesh=mesh_uv)  # -> Vertices, Faces, Colours, Normals
nv = CSharpScript(x=mesh_uv)  # -> out, A; inputs x: Mesh
# ---------- nv: C# ----------
 A =  x.GetNakedEdgePointStatus();
# ---------- end nv ----------
dispatch = Dispatch(List=demesh.Vertices, DispatchPattern=nv.A)  # -> ListA, ListB
pt = Point(dispatch.ListB)
dist = Distance(PointA=box.Point, PointB=pt)
dom = ConstructDomain(DomainStart=Slider(0.05, range=0..0.1), DomainEnd=Slider(0.46, range=0..1))
remap = RemapNumbers(Value=dist, Source=Slider(6, range=0..10), Target=dom)  # -> Mapped, Clipped
domcen = CenteredDomain(num=remap.Mapped)
rectangle_2 = Rectangle(Plane=pt, XSize=domcen, YSize=domcen, Radius=0)  # -> Rectangle, Length
new_shape = Curve(flatten([rectangle_boundary, rectangle_2.Rectangle]))

# ----
# 5. Update the contents of existing elements
setimg = SetImage(ImageToModify=image, NewImagePath=values_2.Values)

values_5 = ValueListener(Elements=slider_2, SomeProperty=True)  # -> Values, Indices

# ----
# 3. Add the element to the window
addelems_4 = AddElements(Window=launchwin_4, Elements=flatten([label, slider_2]), DoVLChecking=True)  # -> AddedElements, ElementNames

# ----
# 4. Listen to the UI Elements
panel_2 = Panel(values_5.Values)

# ----
# 5. Update the contents of existing elements
pan_4 = Panel("There are {0} monkeys.")
format = Format(Format=pan_4, Culture=127, Data0=values_5.Values)
setlabel = SetLabelContents(LabelToModify=label, NewLabelContents=format)

# ----
# 5. Update the contents of existing elements
setshape = SetShape(ShapeToModify=shape, ShapeCurve=new_shape, FillColor=values_3.Values, StrokeColor=RGB(0, 0, 0), Scale=number_slider)

# ----
# Example 3: Interactive 3D Model
# Set the toggle to the right to "True" to launch the window.
# 4. Listen to the UI Elements
icosahedron = Mesh(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)
distance = Slider(1, range=1..10)
vertex_b_offset = Slider(0.5, range=0..1)
vertex_c_offset = Slider(0.5, range=0..1)
vertex_a_offset = Slider(0.5, range=0..1)
window = Slider(1, range=0.1..1)
swatch_2 = Red(SwatchColor=RGB(255, 0, 0))

# ----
# 1. Create a window
number_slider_5 = Slider(634, range=0..1000)
launchwin_5 = LaunchWindow(
    Show=Toggle(False),
    Name="3D Model Configurator",
    Width=Slider(387, range=0..1000),
    Height=number_slider_5,
    ChildStatus=0,
    EnableHorizScroll=False)

# ----
# 2. Create UI Elements
checkbox = CreateCheckbox(Label="Stellate", StartingValue=False)
_3dview = Create3DView(MeshToDisplay=icosahedron, MeshColors=RGB(255, 0, 0), ViewWidth=300, ViewHeight=300)
colorpicker_2 = CreateColorPicker(DefaultColor=swatch_2)

slider_3 = CreateSlider(
    Slider=[distance, vertex_a_offset, vertex_b_offset, vertex_c_offset, window],
    ShowBounds=False,
    showLabel=True,
    ShowTicks=False,
    ShowTooltip=False,
    ShowValLabel=True)

# ----
# Hint: It's useful to preface the Add Elements component with a Merge so you can easily re-order elements.
merge = Merge(Data1=_3dview, Data2=checkbox, Data3=slider_3, Data4=colorpicker_2)

values_6 = ValueListener(Elements=slider_3, SomeProperty=True)  # -> Values, Indices
values_7 = ValueListener(Elements=checkbox, SomeProperty=True)  # -> Values, Indices
values_8 = ValueListener(Elements=colorpicker_2, SomeProperty=True)  # -> Values, Indices

# ----
# 3. Add the elements to the window
addelems_5 = AddElements(Window=launchwin_5, Elements=flatten(merge), DoVLChecking=True)  # -> AddedElements, ElementNames

bang = ExplodeTree(Data=values_6.Values)  # -> Branch0, Branch1, Branch2, Branch3, Branch4

# ----
# Thanks to David Mans for these components from Mesh+
# Grasshopper Geometry Logic
m_facet = MFacet(
    m=icosahedron,
    s=values_7.Values,
    c=True,
    d=bang.Branch0,
    ta=bang.Branch1,
    tb=bang.Branch2,
    tc=bang.Branch3,
    td=0,
    clr=values_8.Values)  # -> out, A; inputs m: Mesh, s: list, c: list, d: list, ta: list, tb: list, tc: list, td: list, clr: list of Color
# ---------- m_facet: VB ----------
    Component.Params.Input(0).Name = "Mesh"
    Component.Params.Input(0).Description = "Open or closed mesh"
    Component.Params.Input(1).Name = "Stellate"
    Component.Params.Input(1).Description = "A single or list of boolean values corresponding to each face of a mesh which if false create new geometry that will be extruded parallel to the face normal and if true will extruded towards an offset point"
    Component.Params.Input(2).Name = "Closed"
    Component.Params.Input(2).Description = "If True no naked edges will result from the operation"
    Component.Params.Input(3).Name = "Distance (Rhino Units)"
    Component.Params.Input(3).Description = "A single number or list of numbers corresponding to each face of a mesh which sets the Rhino unit based distance that the new geometry is offset from each mesh face"
    Component.Params.Input(4).Name = "Vertex A Offset (Unitized)"
    Component.Params.Input(4).Description = "A single number or list of numbers corresponding to each face of a mesh which sets unitized distance the new face's vertex is offset from the existing face's vertex A"
    Component.Params.Input(5).Name = "Vertex B Offset (Unitized)"
    Component.Params.Input(5).Description = "A single number or list of numbers corresponding to each face of a mesh which sets unitized distance the new face's vertex is offset from the existing face's vertex B"
    Component.Params.Input(6).Name = "Vertex C Offset (Unitized)"
    Component.Params.Input(6).Description = "A single number or list of numbers corresponding to each face of a mesh which sets unitized distance the new face's vertex is offset from the existing face's vertex C"
    Component.Params.Input(7).Name = "Vertex D Offset Quad Face Only (Unitized)"
    Component.Params.Input(7).Description = "A single number or list of numbers corresponding to each face of a mesh which sets unitized distance the new face's vertex is offset from the existing face's vertex D"
    Component.Params.Input(8).Name = "Face Color "
    Component.Params.Input(8).Description = "A an optional color or list of colors corresponding to each face of a mesh which colors the new edge vertices"
    
    Component.Params.Output(1).Name = "Mesh"
    Component.Params.Output(1).Description = "If successful, a valid mesh"

    If m IsNot Nothing Then
      Dim msh As New Mesh
      Dim pts As Rhino.Geometry.Collections.MeshVertexList
      Dim faces As Rhino.Geometry.Collections.MeshFaceList
      Dim norm As Rhino.Geometry.Collections.MeshFaceNormalList
      Dim clrs As Rhino.Geometry.Collections.MeshVertexColorList
      Dim face As MeshFace
      Dim i,j,k,r,p,q As Integer
      Dim clrBool As Boolean
      Dim _s,_c As Boolean
      Dim _d,_ta,_tb,_tc,_td As Double
      Dim _clr As color

      faces = m.Faces
      m.FaceNormals.ComputeFaceNormals
      m.FaceNormals.UnitizeFaceNormals
      norm = m.FaceNormals
      pts = m.Vertices
      If m.VertexColors.count() = 0 Then m.VertexColors.CreateMonotoneMesh(color.FromArgb(100, 100, 100))
      clrs = m.VertexColors


      Dim ptList As New list(Of point3d)
      Dim fcList As New list(Of MeshFace)
      Dim clrList As New list(Of color)

      If clr.count() > 0 Then clrBool = False Else clrBool = True

      For i = 0 To faces.Count() - 1 Step 1
        If i > (s.count() - 1) Then _s = s.item(s.count() - 1) Else _s = s.item(i)
        If i > (c.count() - 1) Then _c = c.item(c.count() - 1) Else _c = c.item(i)
        If i > (d.count() - 1) Then _d = d.item(d.count() - 1) Else _d = d.item(i)
        If i > (ta.count() - 1) Then _ta = ta.item(ta.count() - 1) Else _ta = ta.item(i)
        If i > (tb.count() - 1) Then _tb = tb.item(tb.count() - 1) Else _tb = tb.item(i)
        If i > (tc.count() - 1) Then _tc = tc.item(tc.count() - 1) Else _tc = tc.item(i)
        If i > (td.count() - 1) Then _td = td.item(td.count() - 1) Else _td = td.item(i)
        If clrBool = False Then If i > (clr.count() - 1) Then _clr = clr.item(clr.count() - 1) Else _clr = clr.item(i)

        Dim cen, tip As New Point3d
        Dim vec As New Vector3d
        Dim tPts As New list(Of point3d)
        Dim arrt As New list(Of Double)
        Dim cL As New list(Of Integer)
        Dim tclr As New list(Of Color)
        Dim fclr As New color
        Dim rV,gV,bV As New Double

        face = faces(i)
        k = ptList.count()

        'Create Point List
        If face.IsQuad Then r = 4 Else r = 3

        tPts.add(New point3d(pts(face.A)))
        tPts.add(New point3d(pts(face.B)))
        tPts.add(New point3d(pts(face.C)))
        If face.IsQuad Then tPts.add(New point3d(pts(face.D)))

        tclr.add(clrs(face.A))
        tclr.add(clrs(face.B))
        tclr.add(clrs(face.C))
        If face.IsQuad Then tclr.add(clrs(face.D))

        'Get the Normal Vector
        vec = norm.item(i)
        vec.Unitize()
        vec = vec * _d

        'Get the averaged Center Point
        For j = 0 To tPts.count() - 1 Step 1
          cen += tPts.item(j)
          rV += tclr.item(j).r
          gV += tclr.item(j).g
          bV += tclr.item(j).b
        Next

        cen = cen / r
        tip = cen + vec
        fclr = color.FromArgb(CInt(rV / r), CInt(gV / r), CInt(bV / r))

        arrT.add(_ta)
        arrT.add(_tb)
        arrT.add(_tc)
        arrT.add(_td)
        arrT.toarray()
        'Create the new Vertex Points
        For j = 0 To tPts.count() - 1 Step 1
          ptList.add(tPts.item(j))
          clrList.add(tclr.item(j))
          If arrT(j) > 0 Then
            If _s Then ptList.add(tPts.item(j) + (tip - tPts.item(j)) * arrT(j)) Else ptList.add(tPts.item(j) + vec * arrT(j))
            q = q + 1
            If clrBool = True Then _clr = color.FromArgb(CInt(fclr.r * arrT(j) + tclr.item(j).r * (1 - arrT(j))), CInt(fclr.g * arrT(j) + tclr.item(j).g * (1 - arrT(j))), CInt(fclr.b * arrT(j) + tclr.item(j).b * (1 - arrT(j))))
            clrList.add(_clr)
          End If

          cL.add(q)
          q = q + 1
        Next

        'Assign the Faces
        p = 0
        For j = 0 To r - 2 Step 1
          If arrT(j) > 0 And arrT(j + 1) > 0 Then
            fcList.add(New MeshFace(k + p + 2, k + p + 3, k + p + 1, k + p))
            p = p + 2
          ElseIf arrT(j) > 0 And arrT(j + 1) = 0 Then
            fcList.add(New MeshFace(k + p + 2, k + p + 1, k + p))
            p = p + 2
          ElseIf arrT(j) = 0 And arrT(j + 1) > 0 Then
            fcList.add(New MeshFace(k + p + 1, k + p + 2, k + p))
            p = p + 1
          Else
            p = p + 1
          End If
        Next
        If arrT(r - 1) > 0 And arrT(0) > 0 Then
          fcList.add(New MeshFace(k, k + 1, k + p + 1, k + p))
        ElseIf arrT(r - 1) > 0 And arrT(0) = 0 Then
          fcList.add(New MeshFace(k, k + p + 1, k + p))
        ElseIf arrT(r - 1) = 0 And arrT(0) > 0 Then
          fcList.add(New MeshFace(k, k + 1, k + p))
        End If
        If _c Then
          If face.IsQuad Then fcList.add(New MeshFace(cL.item(0), cL.item(1), cL.item(2), cL.item(3))) Else fcList.add(New MeshFace(cL.item(0), cL.item(1), cL.item(2)))
        End If
      Next

      msh.Vertices.AddVertices(ptList.toarray())
      msh.Faces.AddFaces(fcList.toarray())
      msh.FaceNormals.ComputeFaceNormals
      msh.VertexColors.SetColors(clrList.toarray())

      A = msh
    End If
# ---------- end m_facet ----------
m_carpet = MCarpet(m=m_facet.A, t0=bang.Branch4, t1=0.5, clr=values_8.Values)  # -> out, A; inputs m: Mesh, t0: list, t1: list, clr: list of Color
# ---------- m_carpet: VB ----------
    Component.Params.Input(0).Name = "Mesh"
    Component.Params.Input(0).Description = "Open or closed mesh"
    Component.Params.Input(1).Name = "Center Offset (Unitized)"
    Component.Params.Input(1).Description = "A single number or list of numbers corresponding to each vertex of a mesh which sets the new mesh faces distance from the origin face's center point"
    Component.Params.Input(2).Name = "Edge Offset (Unitized) "
    Component.Params.Input(2).Description = "A single number or list of numbers corresponding to each vertex of a mesh which sets the new mesh faces distance from the origin face's vertex to it's corresponding edge midpoint"
    Component.Params.Input(3).Name = "Face Color "
    Component.Params.Input(3).Description = "A an optional color or list of colors corresponding to each face of a mesh which colors the new edge vertices"

    Component.Params.Output(1).Name = "Mesh"
    Component.Params.Output(1).Description = "If successful, a valid mesh"

    If m IsNot Nothing Then
      Dim msh As New Mesh
      Dim pts As Rhino.Geometry.Collections.MeshVertexList
      Dim faces As Rhino.Geometry.Collections.MeshFaceList
      Dim clrs As Rhino.Geometry.Collections.MeshVertexColorList
      Dim clrBool As Boolean
      Dim _clr As color
      Dim face As MeshFace
      Dim i,j,k,r As Integer

      faces = m.Faces
      pts = m.Vertices
      If m.VertexColors.count() = 0 Then m.VertexColors.CreateMonotoneMesh(color.FromArgb(100, 100, 100))
      clrs = m.VertexColors

      Dim ptList As New list(Of point3d)
      Dim fcList As New list(Of MeshFace)
      Dim clrList As New list(Of color)

      If clr.count() > 0 Then clrBool = False Else clrBool = True

      For i = 0 To faces.Count() - 1 Step 1
        If clrBool = False Then If i > (clr.count() - 1) Then _clr = clr.item(clr.count() - 1) Else _clr = clr.item(i)
        Dim _t0, _t1 As New list(Of Double)

        Dim cen As New Point3d
        Dim tPts As New list(Of point3d)
        Dim tclr As New list(Of Color)
        Dim fclr,avgClr As New color
        Dim rV,gV,bV As New Double
        face = faces(i)
        k = ptList.count()

        'Create Point List
        If face.IsQuad Then r = 4 Else r = 3

        If face.IsQuad Then tPts.add(New point3d(pts(face.D))) Else tPts.add(New point3d(pts(face.C)))
        tPts.add(New point3d(pts(face.A)))
        tPts.add(New point3d(pts(face.B)))
        tPts.add(New point3d(pts(face.C)))
        If face.IsQuad Then tPts.add(New point3d(pts(face.D)))
        tPts.add(New point3d(pts(face.A)))

        If face.IsQuad Then tclr.add(clrs(face.D)) Else tclr.add(clrs(face.C))
        tclr.add(clrs(face.A))
        tclr.add(clrs(face.B))
        tclr.add(clrs(face.C))
        If face.IsQuad Then tclr.add(clrs(face.D))
        tclr.add(clrs(face.A))

        If face.IsQuad Then If face.D > (t0.count() - 1) Then _t0.add(t0.item(t0.count() - 1)) Else _t0.add(t0.item(face.D)) Else If face.C > (t0.count() - 1) Then _t0.add(t0.item(t0.count() - 1)) Else _t0.add(t0.item(face.C))
        If face.A > (t0.count() - 1) Then _t0.add(t0.item(t0.count() - 1)) Else _t0.add(t0.item(face.A))
        If face.B > (t0.count() - 1) Then _t0.add(t0.item(t0.count() - 1)) Else _t0.add(t0.item(face.B))
        If face.C > (t0.count() - 1) Then _t0.add(t0.item(t0.count() - 1)) Else _t0.add(t0.item(face.C))
        If face.IsQuad Then If face.D > (t0.count() - 1) Then _t0.add(t0.item(t0.count() - 1)) Else _t0.add(t0.item(face.D))
        If face.A > (t0.count() - 1) Then _t0.add(t0.item(t0.count() - 1)) Else _t0.add(t0.item(face.A))

        If face.IsQuad Then If face.D > (t1.count() - 1) Then _t1.add(t1.item(t1.count() - 1)) Else _t1.add(t1.item(face.D)) Else If face.C > (t1.count() - 1) Then _t1.add(t1.item(t1.count() - 1)) Else _t1.add(t1.item(face.C))
        If face.A > (t1.count() - 1) Then _t1.add(t1.item(t1.count() - 1)) Else _t1.add(t1.item(face.A))
        If face.B > (t1.count() - 1) Then _t1.add(t1.item(t1.count() - 1)) Else _t1.add(t1.item(face.B))
        If face.C > (t1.count() - 1) Then _t1.add(t1.item(t1.count() - 1)) Else _t1.add(t1.item(face.C))
        If face.IsQuad Then If face.D > (t1.count() - 1) Then _t1.add(t1.item(t1.count() - 1)) Else _t1.add(t1.item(face.D))
        If face.A > (t1.count() - 1) Then _t1.add(t1.item(t1.count() - 1)) Else _t1.add(t1.item(face.A))

        'Get the averaged Center Point
        For j = 1 To tPts.count() - 2 Step 1
          cen += tPts.item(j)
          rV += tclr.item(j).r
          gV += tclr.item(j).g
          bV += tclr.item(j).b
        Next

        cen = cen / r
        fclr = color.FromArgb(CInt(rV / r), CInt(gV / r), CInt(bV / r))

        'Create the new Vertex Points
        For j = 1 To tPts.count() - 2 Step 1
          Dim tp0,tp1 As New Double
          tp0 = (_t0.item(j) + _t0.item(j + 1)) / 2
          tp1 = (_t1.item(j) + _t1.item(j + 1)) / 2
          tp1 = (tp0 + (tp0 / 3)) * tp1
          If tp1 > 1 Then tp1 = 1

          ptList.add(tPts.item(j))
          ptList.add(tPts.item(j) + (cen - tPts.item(j)) * _t0.item(j))
          ptList.add(tPts.item(j) + ((tPts.item(j) + tPts.item(j + 1)) / 2 - tPts.item(j)) * tp1)
          ptList.add(tPts.item(j + 1) + ((tPts.item(j) + tPts.item(j + 1)) / 2 - tPts.item(j + 1)) * tp1)

          avgClr = colorAverage(tclr.item(j), tclr.item(j + 1), 0.5)
          clrList.add(tclr.item(j))
          If clrBool = True Then clrList.add(colorAverage(fclr, tclr.item(j), _t0.item(j))) Else clrList.add(_clr)
          clrList.add(colorAverage(tclr.item(j), avgClr, 1 - tp1))
          clrList.add(colorAverage(tclr.item(j + 1), avgClr, 1 - tp1))
        Next

        'Assign the Faces
        r = r * 4
        For j = k To k + r - 5 Step 4

          fcList.add(New MeshFace(j + 1, j + 2, j + 3, j + 5))
          fcList.add(New MeshFace(j + 5, j + 3, j + 4, j + 6))
        Next

        fcList.add(New MeshFace(k + r - 3, k + r - 2, k + r - 1, k + 1))
        fcList.add(New MeshFace(k + 1, k + r - 1, k, k + 2))
      Next

      msh.Vertices.AddVertices(ptList.toarray())
      msh.Faces.AddFaces(fcList.toarray())
      msh.VertexColors.SetColors(clrList.toarray())
      msh.Vertices.CombineIdentical(False, False)
      msh.Faces.CullDegenerateFaces()
      msh.FaceNormals.ComputeFaceNormals

      A = msh
    End If
# ---------- m_carpet: VB additional code ----------
  Function colorAverage(ByVal clrA As color, ByVal clrB As color, ByVal t As Double)
    Dim clrOut As color
    Dim R,G,B As Integer

    If CInt(clrA.r * t + clrB.r * (1 - t)) > 255 Then
      R = 255
    ElseIf CInt(clrA.r * t + clrB.r * (1 - t)) < 0 Then
      R = 0
    Else
      R = CInt(clrA.r * t + clrB.r * (1 - t))
    End If

    If CInt(clrA.g * t + clrB.g * (1 - t)) > 255 Then
      G = 255
    ElseIf CInt(clrA.g * t + clrB.g * (1 - t)) < 0 Then
      G = 0
    Else
      G = CInt(clrA.g * t + clrB.g * (1 - t))
    End If

    If CInt(clrA.b * t + clrB.b * (1 - t)) > 255 Then
      B = 255
    ElseIf CInt(clrA.b * t + clrB.b * (1 - t)) < 0 Then
      B = 0
    Else
      B = CInt(clrA.b * t + clrB.b * (1 - t))
    End If

    clrOut = color.fromargb(R, G, B)
    Return clrOut
  End Function
# ---------- end m_carpet ----------

# ----
# 5. Update the contents of existing elements
set3dview = Set3DView(_3DView=_3dview, MeshToDisplay=m_carpet.A, MeshColors=values_8.Values)

# ==== cluster CenteredDomain: creates a domain from -A/2 to A/2
num = ClusterInput()
num_2 = Number(num)
division = Division(A=num_2, B="2")
division_2 = Division(A=num_2, B="-2")
dom = Domain(DomainStart=division_2, DomainEnd=division)
I = ClusterOutput(dom)
