# Grasshopper definition Getting To Know The Elements.gh (Grasshopper 0.9.76)
# plug-ins: Human UI

# ----
# A grid is unlike a stack - it can be used as a free plane in which to place elements, which may overlap each other. All elements are positioned according to their alignment and margins, which can be set using the Adjust Element Positioning component. The grid can also have multiple rows and columns into which you can place elements by specifying their row and column index and span.
# Grid
number_slider = Slider(60, range=0..100)
pt = Point(Point(67.98325426, 81.18927549, 0))
seq = Sequence(Count=10, CharPool="ABCDEFGHIJKLMNOPQRSTUVWXYZ", Format="{0}")
cir = Circle(Plane=pt, Radius=number_slider)
lng = ListLength(List=seq)
radiobtn = CreateRadioButton(RadioButtonName=seq, RadioButtonGroup="grp2", InitiallySelected=False)
divide = DivideCurve(Curve=cir, Count=lng, Kinks=False)  # -> Points, Tangents, Parameters
grid = CreateGrid(
    UIElements=radiobtn,
    Width=Slider(300, range=0..1000),
    Height=Slider(170, range=0..1000),
    ElementRowSpan=1,
    ElementColumnSpan=1)
adjustpos = AdjustElementPositioning(ElementsToAdjust=radiobtn, Margin=divide.Points, AbsolutePositioning=False)

# ----
# HUMAN UI: Getting to know the Elements
# The Essentials
# As in Grasshopper, the slider is a key element to interaction. The slider component tries to harvest properties from the Grasshopper sliders connected to it: Name, default value, decimal place accuracy / integer snapping, etc.
# 
# Multiple sliders connected to the same slider component will automatically adjust their label sizing so the left edge of the sliders are all aligned.
# 
# You can also specify snap values with the optional second input - and configure the slider's appearance and behavior in more detail with the component right-click menu.
# Slider
floating_pt_slider = Slider(0.5, range=0..1)
integer_slider = Slider(45, range=0..100)

# ----
# A Tabbed View lets you place different lists of elements into selectable Tabs. Only the content of one tab is visible at a time. You must have the same number of Tab names as you do tab group inputs - you can zoom into the component to add or remove the group inputs.
# 
# The demo window in this definition is itself displaying a tabbed view with the four sections of this document.
# Tabbed View
number_slider_2 = Slider(41, range=0..100)
pt_2 = Point(Point(2.568802091, -2.981895579, 0))
pan = Panel("""3
4
5""")
polygon = Polygon(Plane=pt_2, Radius=3, Segments=pan, FilletRadius=0)  # -> graft(Polygon), Length
shape = CreateShape(Shape=polygon.Polygon, FillColor=RGB(96, 255, 64), StrokeColor=RGB(0, 0, 0), Scale=number_slider_2)
bang = ExplodeTree(Data=shape)  # -> Branch0, Branch1, Branch2
pan_2 = Panel("""Triangle
Diamond
Pentagon""")
tabs = TabbedView(TabNames=pan_2, Tab0=flatten(bang.Branch0), Tab1=flatten(bang.Branch1), Tab2=flatten(bang.Branch2))

# ----
# The label is useful for keeping your windows organized, and for displaying information. You can adjust text size and alignment.
# Label
number_slider_3 = Slider(0, range=0..2)
label = CreateLabel(LabelText="Here's my Label", LabelSize=Slider(23, range=0..100), Justification=number_slider_3)

# ----
# The Text Block is similar to a label, but can support long blocks of multi-line text and will handle text wrapping - but only if you specify a width for the element with the "Adjust Element Positioning" Component.
# Text Block
panel = Panel("For designers who are exploring new shapes using generative algorithms, Grasshopper® is a graphical algorithm editor tightly integrated with Rhino’s 3-D modeling tools. Unlike RhinoScript, Grasshopper requires no knowledge of programming or scripting, but still allows designers to build form generators from the simple to the awe-inspiring.")
tb = CreateTextBlock(Text=panel, TextSize=12, Justification=0)
adjustpos_2 = AdjustElementPositioning(ElementsToAdjust=tb, Margin="10", AbsolutePositioning=False, Width=Slider(327, range=0..1000))

# ----
# Containers
# You may have noticed that elements in a Human UI window seem to "Stack" one on top of another. This is because all elements are by default placed into a vertically oriented "Stack" element within the window. This is an invisible container that dictates how its children elements are arranged. You can also create your own vertical or horizontal stacks - you can even put stacks inside of stacks.
# Stack
pan_3 = Panel("""A
B
C""")
radiobtn_2 = CreateRadioButton(RadioButtonName=pan_3, RadioButtonGroup="grp", InitiallySelected=False)
stack = CreateStack(UIElements=radiobtn_2, Horizontal=Toggle(True))

# ----
# The button acts like a Grasshopper button - it is true when pressed, and then resets to false when the mouse click ends. Note that there are lots of styling options - you can supply either a text label or an icon graphic, and the right-click menu exposes a number of display styles.
# Button
pan_4 = Panel("My Button")
button = CreateButton(ButtonName=pan_4, ButtonStyle=1)

# ----
# Displaying Media
# The 3d View creates an orbitable viewport to display a mesh or list of meshes. You can assign one color per mesh if desired.
# 3D View
range = Range(Domain=Domain(0, 1), Steps=10)
number_slider_4 = Slider(200, range=0..1000)
gradient = Gradient(
    LowerLimit=0,
    UpperLimit=1,
    Parameter=range,
    stops=[0: RGB(103, 0, 120), 0.165: RGB(39, 72, 161), 0.295: RGB(1, 192, 229), 0.452: RGB(18, 178, 90), 0.572: RGB(79, 186, 8), 0.663: RGB(220, 237, 32), 0.829: RGB(247, 159, 20), 1: RGB(243, 57, 0)])
box = CenterBox(Base=PlaneXY(0, 0, 0), X=range, Y=reverse(range), Z=range)
_3dview = Create3DView(MeshToDisplay=box, MeshColors=gradient, ViewWidth=number_slider_4, ViewHeight=number_slider_4)

# ----
# All the elements inside a view box will scale up or down to fit inside its specified width + height - this lets you make elements in your UI bigger or smaller at will.
# View Box
pan_5 = Panel("""Small
Medium
Large""")
button_2 = CreateButton(ButtonName=pan_5, ButtonStyle=0)  # -> graft(Button)
pan_6 = Panel("""50
100
200""")
multiplication = Multiplication(A=pan_6, B=0.5)
viewbox = CreateViewBox(UIElements=button_2, Width=graft(pan_6), Height=graft(multiplication))  # -> flatten(ViewBox)

# ----
# The Create Shape component will try to take a list of curves and turn them into a single shape. Curves inside other curves create holes in the shape. Note that its positioning treats the world origin as its UPPER left rather than lower left corner - you may need to reposition your geometry to get it to show properly in the window.
# Create Shape
number_slider_5 = Slider(8, range=0..10)
pt_3 = Point(Point(5.045303795, -4.299476277, 0))
pan_7 = Panel("""4
5""")
swatch = Blue(SwatchColor=RGB(0, 128, 255))
polygon_2 = Polygon(Plane=pt_3, Radius=pan_7, Segments=6, FilletRadius=0)  # -> Polygon, Length
shape_2 = CreateShape(Shape=polygon_2.Polygon, FillColor=swatch, StrokeColor=RGB(0, 0, 0), Scale=number_slider_5)

# ----
# XAML is a special markup language used for the development of WPF interfaces. If you know the XAML code for an element or group of elements, you can add it to a window with this component.
# XAML object
panel_2 = Panel(""" <Expander Header="Peekaboo" HorizontalAlignment="Left" Margin="10,10,0,0" VerticalAlignment="Top" Width="200">
            <Grid Background="#FFE5E5E5" Width="200">
                <Label>I See You!</Label>
            </Grid>
        </Expander>""")
# Click the "Containers" tab at the top of the window to see these examples in action.
xaml = CreateObjectsFromXAML(XAML=panel_2)

# ----
# The Checkbox functions like a boolean toggle in Grasshopper - it can either be on or off. You can specify a default value with the second component input.
# Checkbox
pan_8 = Panel("Enable")
checkbox = CreateCheckbox(Label=pan_8, StartingValue=False)

# ----
# The Create Shapes component is just like Create Shape, except that it treats each input curve individually, so you can create composite graphics more easily. It is harder to create "holes" in shapes, but much easier to create graphics that compose multiple shapes with different attributes and maintain their relative positions. Note that the order curves are fed in affects the draw order - the component draws from the back to the front.
# Create Shapes
pan_9 = Panel("""5
4""")
pt_4 = Point(Point(5.045303795, -4.299476277, 0))
swatch_2 = Blue(SwatchColor=RGB(0, 128, 255))
swatch_3 = Red(SwatchColor=RGB(255, 0, 0))
polygon_3 = Polygon(Plane=pt_4, Radius=pan_9, Segments=6, FilletRadius=0)  # -> Polygon, Length
shapes = CreateShapes(
    Shapes=polygon_3.Polygon,
    FillColor=[swatch_3, swatch_2],
    StrokeColor=RGB(0, 0, 0),
    Scale=Slider(8, range=0..10),
    ClickMode=3)

# ----
# The Checklist creates a fixed-height, scrollable selector containing a list of checkboxes. The list of possible options can be updated with the "Set Checklist" component.
# Checklist
number_slider_6 = Slider(109, range=0..1000)
seq_2 = Sequence(Count=10, CharPool="ABCDEFGHIJKLMNOPQRSTUVWXYZ", Format="{0}")
checklist = CreateChecklist(ChecklistItems=seq_2, Selected=False, Height=number_slider_6)

# ----
# The Create Browser component creates an activeX webcontrol that can render webpages in your window. Note that it is not compatible with the Transparent Window component.
# Create Browser
number_slider_7 = Slider(400, range=0..1000)
browser = CreateBrowser(URL="http://www.google.com", Width=number_slider_7, Height=Slider(200, range=0..1000))

# ----
# The Create Image component lets you display a jpg or png image from your hard drive in the window.
# Create Image
# Specialty Elements
panel_3 = Panel("C:\Users\Public\Pictures\Sample Pictures\Penguins.jpg")
image = CreateImage(ImageSource=panel_3, ImageWidth=300)

# ----
# The text box lets you accept text input from the user. It can be set up with or without a button - without, the value listener will pass a new value every time a character is typed; with, it will only pass a value when the button is pressed.
# Text Box
pan_10 = Panel("Name")

# ----
# Radio Buttons typically come in sets - and only one in the set can be selected at a time. All radio button elements sharing the same group name will operate this way - only one from a given group can be selected. This way you can also supply multiple sets of radio buttons belonging to different groups.  You can also specify which button is selected by default.
# Radio Button
pan_11 = Panel("TempEval")
pan_12 = Panel("""Too Hot
Too Cold
Just Right""")
pan_13 = Panel("""True
False
False""")
radiobtn_3 = CreateRadioButton(RadioButtonName=pan_12, RadioButtonGroup=pan_11, InitiallySelected=pan_13)

# ----
# Also identical to a regular button, the Rhino Command Button allows you to trigger a command line script in Rhino as soon as the button is pressed. This is totally independent of the Grasshopper solution flow so it can be very responsive.
# Rhino Command Button
pan_14 = Panel("GradientView")
cmdbutton = CreateRhinoCommandButton(ButtonName="Toggle Gradient Background", RhinoScript=pan_14, ButtonStyle=0)

# ----
# List Box and Pulldown Menu are both used to allow the user to select from a set of possible options - they just have slightly different appearances.
# List Box and Pulldown Menu
seq_3 = Sequence(Count=10, CharPool="ABCDEFGHIJKLMNOPQRSTUVWXYZ", Format="{0}")
pulldown = CreatePulldownMenu(ListItems=seq_3, SelectedIndex=0)  # -> flatten(Pulldown)
listbox = CreateListBox(ListItems=seq_3, SelectedIndex=0, Height=100)

# ----
# Though it looks no different from a regular button, the True Button only triggers an event in the value listener on mouse down - the regular button triggers on both mouse down and mouse up (so it always sets itself back to false.) It has all the same styling options as a regular button.
# True Button
pan_15 = Panel("Activate!")
true_button = CreateTrueOnlyButton(ButtonName=pan_15, ButtonStyle=0)

slider = CreateSlider(
    Slider=[floating_pt_slider, integer_slider],
    ShowBounds=False,
    showLabel=True,
    ShowTicks=False,
    ShowTooltip=False,
    ShowValLabel=True)
# Click the "Displaying Media" tab at the top of the window to see these examples in action.
textbox = CreateTextBox(Label=pan_10, UpdateButton=True, showLabel=True)

# ----
# Click the "Specialty Elements" tab at the top of the window to see these examples in action.
# The Color Picker lets your user pick a color. You can specify a default color, as well as a list of possible colors to have available for selection (though the user can still force select a different color by clicking "Advanced")
# Color Picker
colorpicker = CreateColorPicker()

merge = Merge(
    Data1=flatten(slider),
    Data2=flatten(checkbox),
    Data3=flatten(label),
    Data4=flatten(button),
    Data5=flatten(radiobtn_3),
    Data6=flatten(listbox),
    Data7=flatten(pulldown),
    Data8=flatten(textbox))
merge_2 = Merge(Data1=flatten(_3dview), Data2=flatten(shape_2), Data3=flatten(shapes), Data4=flatten(browser), Data5=flatten(image))
merge_3 = Merge(
    Data1=flatten(colorpicker),
    Data2=flatten(tb),
    Data3=flatten(checklist),
    Data4=flatten(true_button),
    Data5=flatten(cmdbutton),
    Data6=flatten(xaml))
merge_4 = Merge(Data1=flatten(stack), Data2=flatten(grid), Data3=flatten(tabs), Data4=flatten(viewbox))
pan_16 = Panel("""The Essentials
Displaying Media
Specialty Elements
Containers""")
launchwin = LaunchWindow(
    Show=Toggle(True),
    Name="Getting To Know The Elements",
    Width=Slider(426, range=0..1000),
    Height=Slider(550, range=0..1000),
    ChildStatus=0,
    EnableHorizScroll=False)
tabs_2 = TabbedView(
    TabNames=pan_16,
    TabTextSize=Slider(13, range=0..100),
    Tab0=flatten(merge),
    Tab1=flatten(merge_2),
    Tab2=flatten(merge_3),
    Tab3=flatten(merge_4))
addelems = AddElements(Window=launchwin, Elements=flatten(tabs_2), DoVLChecking=True)  # -> AddedElements, ElementNames
